# Grasshopper definition Baker structure 1.gh (Grasshopper 1.0.7)
# Copyright: © 2017-2018 Pierre Cuvilliers, Caitlin Mueller, Massachusetts Institute of Technology
# plug-ins: Weaverbird, Pufferfish, Kangaroo2 Components, karambaGH, SelectablePreview

number_slider = Slider(6, range=0..100)
neg = Negative(Value=number_slider)
dom = ConstructDomain(DomainStart=neg, DomainEnd=number_slider)
panel = Panel("""1.2
2.4
3.6
4.8""")
number_slider_2 = Slider(4, range=0..10)
rectangle = Rectangle(Plane=PlaneXY(0, 0, 0), XSize=dom, YSize=dom, Radius=0)  # -> Rectangle, Length
splitatcorners = SplitAtCorners(Poly=rectangle.Rectangle, Angle=1)  # -> Corners, Parts
neg_2 = Negative(Value=panel)
offset = OffsetCurve(Curve=rectangle.Rectangle, Distance=neg_2, Plane=PlaneXY(0, 0, 0), Corners=1)
splitatcorners_2 = SplitAtCorners(Poly=offset, Angle=1)  # -> Corners, Parts
divide = DivideCurve(Curve=splitatcorners.Parts, Count=Slider(5, range=0..10), Kinks=False)  # -> Points, Tangents, Parameters
bang = ExplodeTree(Data=divide.Points)  # -> Branch0, Branch1, Branch2, Branch3
shatter = Shatter(Curve=splitatcorners.Parts, Parameters=divide.Parameters)
rev = ReverseList(List=bang.Branch3)
rev_2 = ReverseList(List=bang.Branch1)
ln = Line(StartPoint=bang.Branch2, EndPoint=rev)
line = Line(shatter)
pt = Point(bang.Branch2)
pt_2 = Point(bang.Branch0)
pt_3 = Point(bang.Branch3)
pt_4 = Point(bang.Branch1)
ln_2 = Line(StartPoint=bang.Branch0, EndPoint=rev_2)
cull_i = CullIndex(List=ln, Indices=Slider(0, range=-1..0), Wrap=True)
rev_3 = ReverseList(List=pt_4)
rev_4 = ReverseList(List=pt_3)
ln_3 = Line(StartPoint=rev_3, EndPoint=pt)
ln_4 = Line(StartPoint=pt_2, EndPoint=rev_4)
cull_i_2 = CullIndex(List=ln_4, Indices=Slider(-1, range=-1..0), Wrap=True)
llinter = LineLineIntersectionKaramba3D(Line=flatten([ln_2, ln_3, splitatcorners_2.Parts, cull_i_2, cull_i]), LimitDistance_m=0.005)  # -> IntersectionPoints, LineSubSegements
dupln = RemoveDuplicateLines(Lines=llinter.LineSubSegements, Tolerance=0.01)
line_2 = Line(llinter.LineSubSegements)
line_3 = Line([line, dupln])
wbweave = WeaverbirdsMeshFromLinesWeaveBack(Lines=flatten(line_3), MaximumValence=4)
nv = NakedVertices(Mesh=wbweave)  # -> ClothedIndex, NakedIndex, ClothedPts, NakedPts
wbedges = WeaverbirdsMeshEdges(MeshOrPolylines=wbweave)
demesh = DeconstructMesh(Mesh=wbweave)  # -> Vertices, Faces, Colours, Normals
multiplication = Multiplication(A=Slider(1, range=0..10), B=Slider(15, range=0..100))

# ---- group: FORCE DENSITY
panel_2 = Panel(multiplication)
lng = ListLength(Edges=wbedges)
neg_3 = Negative(Value=panel_2)
repeat = RepeatData(Data=neg_3, Length=lng)
multiplication_2 = Multiplication(A=repeat, B=Slider(1, range=0..10))

# ----
Y = UnitY(Factor=Slider(-20, range=-30..20))

# ---- group: IMPORT GHPYTHON
panel_3 = Panel("""numpy
scipy
networkx
scipy.sparse""")
pythonremote = GHPythonRemote(location="C:\Users\nisha\anaconda3\envs\rhino_remote\python.exe", run=Toggle(True), modules=panel_3)  # -> out, linked_modules, rpy, import_statements

# ----
move = Move(Geometry=rectangle.Rectangle, Motion=Y)  # -> Geometry, Transform

# ---- group: Dimension
box_corners = BoxCorners(Box=move.Geometry)  # -> CornerA, CornerB, CornerC, CornerD, CornerE, CornerF, CornerG, CornerH
neg_4 = Negative(Value=Slider(1, range=0..1))
aligndim = AlignedDimension(
    Plane=PlaneXY(0, 0, 0),
    PointA=box_corners.CornerA,
    PointB=box_corners.CornerD,
    Offset=1,
    Text="{0:0.00}",
    Size=Slider(0.4, range=0..1))
aligndim_2 = AlignedDimension(
    Plane=PlaneXY(0, 0, 0),
    PointA=box_corners.CornerC,
    PointB=box_corners.CornerD,
    Offset=neg_4,
    Text="{0:0.00}",
    Size=Slider(0.4, range=0..1))

# ----
X = UnitX(Factor=Slider(25, range=0..100))
matprops = MaterialPropertiesKaramba3D(
    FamilyOfMaterial="Mild Steel",
    Name="Fe250",
    YoungsModulus_kN_cm2="21000",
    InPlaneShearModulus_kN_cm2=8076,
    TransverseShearModulus_kN_cm2=8076,
    SpecificWeight_kN_m3="78.5",
    CoefficientOfThermalExpansion_1_C=1e-05,
    YieldStrength_kN_cm2="25",
    mode="Isotrop")
box_corners_2 = BoxCorners(Box=rectangle.Rectangle)  # -> CornerA, CornerB, CornerC, CornerD, CornerE, CornerF, CornerG, CornerH
relay = Relay([box_corners_2.CornerA, box_corners_2.CornerB, box_corners_2.CornerC, box_corners_2.CornerD])
panel_4 = Panel("""ISNB40M
ISNB50M
ISNB65M
ISNB80M
ISNB90M
ISNB100M
ISNB110M""")
panel_5 = Panel("""ISNB50M
ISNB50M
ISNB65M
ISNB80M
ISNB90M
ISNB100M
ISNB110M""")
panel_6 = Panel("""0.32
0.36
0.36
0.4
0.4
0.45
0.48""")
panel_7 = Panel("""4.83
6.03
7.61
8.89
10.16
11.43
12.7""")
cross_section = CrossSectionKaramba3D(
    FamilyNameOfCrossSection="ISNB",
    NameOfCrossSection=panel_4,
    ElementIdentifier=panel_5,
    Material=matprops,
    Diameter_cm=panel_7,
    WallThickness_cm=panel_6,
    mode="Circular Hollow")
gencstable = GenerateCrossSectionTableKaramba3D(CrossSections=cross_section)
panel_8 = Panel(gencstable)
readcstable = ReadCrossSectionTableFromFileKaramba3D()  # -> CrossSection, Info
panel_9 = Panel("3.53")
panel_10 = Panel("""2
3
7
8
13
12
17
18""")
panel_11 = Panel("""1
10
20
30""")
pt_5 = Point(relay)
panel_12 = Panel("""135
137
120
121""")
number_slider_3 = Slider(120, range=0..250)
panel_13 = Panel("""34
35
44
48""")
number_slider_4 = Slider(15, range=0..100)
duppt = RemoveDuplicatePts(Points=pt_5, Tolerance=0.01)
panel_14 = Panel("""20
24
53
55""")
panel_15 = Panel("""130
131
148
142""")
number_slider_5 = Slider(0.01, range=0..0.1)
number_slider_6 = Slider(0.5, range=0..1)
number_slider_7 = Slider(4, range=0..10)
matprops_2 = MaterialPropertiesKaramba3D(
    FamilyOfMaterial="Mild Steel",
    Name="Fe250",
    YoungsModulus_kN_cm2="21000",
    InPlaneShearModulus_kN_cm2=8076,
    TransverseShearModulus_kN_cm2=8076,
    SpecificWeight_kN_m3="78.5",
    CoefficientOfThermalExpansion_1_C=1e-05,
    YieldStrength_kN_cm2="25",
    mode="Isotrop")
panel_16 = Panel("""ISNB40M
ISNB50M
ISNB65M
ISNB80M
ISNB90M
ISNB100M
ISNB110M
ISNB125M
ISNB125H""")
panel_17 = Panel("""ISNB50M
ISNB50M
ISNB65M
ISNB80M
ISNB90M
ISNB100M
ISNB110M
ISNB125M
ISNB125H""")
panel_18 = Panel("""4.83
6.03
7.61
8.89
10.16
11.43
12.7
13.97
13.97""")
panel_19 = Panel("""0.32
0.36
0.36
0.4
0.4
0.45
0.48
0.48
0.54""")
cross_section_2 = CrossSectionKaramba3D(
    FamilyNameOfCrossSection="ISNB",
    NameOfCrossSection=panel_16,
    ElementIdentifier=panel_17,
    Material=matprops_2,
    Diameter_cm=panel_18,
    WallThickness_cm=panel_19,
    mode="Circular Hollow")
gencstable_2 = GenerateCrossSectionTableKaramba3D(CrossSections=cross_section_2)
panel_20 = Panel(gencstable_2)
readcstable_2 = ReadCrossSectionTableFromFileKaramba3D()  # -> CrossSection, Info
number_slider_8 = Slider(5, range=0..10)

# ---- group: LOADING
number_slider_9 = Slider(4, range=0..10)
area = Area(Geometry=rectangle.Rectangle)  # -> Area, Centroid
pt_6 = Point(demesh.Vertices)
lng_2 = ListLength(List=pt_6)
num = Number("3.5")
multiplication_3 = Multiplication(A="3.5", B=area.Area)

# ---- group: FORCE DENSITY METHOD SOLVER
line_4 = Line(wbedges)
# FORCE DENSITY METHOD
fixed_points = Point(nv.NakedPts)
end = EndPoints(Curve=line_4)  # -> Start, End
num_2 = Number(multiplication_2)
python = GhPythonScript(x=end.Start, y=end.End)  # -> flatten(array); inputs x: Point3d, y: Point3d
# ---------- python: Python ----------
import rhinoscriptsyntax as rs


array  = [ ((x[0],x[1]) , (y[0],y[1])) ]


print(array)
# ---------- end python ----------
python_2 = GhPythonScript(x=fixed_points)  # -> aa; inputs x: list of Point3d
# ---------- python_2: Python ----------
import rhinoscriptsyntax as rs

#CONVERT GUID DATA TO RS POINT3D
a = []
for item in x:
    a.append(rs.coerce3dpoint(item))

# MAKE ARRAYS OF POINTS
aa=[]
for item in a:
    aa.append((item[0],item[1]))
# ---------- end python_2 ----------

# ----
lng_3 = ListLength(List=fixed_points)
subtraction = Subtraction(A=lng_2, B=lng_3)

# ---- group: LOADING (continued)
division = Division(A=multiplication_3, B=subtraction)

# ---- group: FORCE DENSITY METHOD SOLVER (continued)
num_3 = Number(division)
loading = Negative(Value=num_3)
solver = GhPythonScript(fxpt=flatten(python_2), x=flatten(python), q=num_2, load=loading)  # -> Cr, Cf, x_ound, y_ound, z_found, fxpt, CON, fxpt_indx, rpt_indx, u; inputs fxpt: list, x: list, q: list
# ---------- solver: Python ----------
import ghpythonremote
import scriptcontext as sc
from ghpythonlib.treehelpers import list_to_tree
ssa = sc.sticky['scipy.sparse']
sci = sc.sticky['scipy']
np =sc.sticky['numpy']

lines = np.array(x)
lines = np.around(lines,decimals =4)
no_lines = len(lines)  # no_lines means no. of lines 

#get unique sets of points save them in matrix u and get indices in indices
lines = np.reshape(lines,(no_lines*2,2))
u,indices = np.unique(lines,return_inverse = True,axis = 0)
unqpt= np.unique(indices,return_inverse = False)
u_pt_len = len(indices)
#print ("length of u is",len(u))


# CREATE CONNNECTIVITY MATRIX.
row = np.repeat(np.arange(no_lines),repeats =2 )
col = indices
data = np.tile([1,-1],no_lines)
cols = len(u)
C = ssa.csc_matrix( (data,(row,col)), shape = (no_lines,cols) ).todense()
CON = C.copy()

#GET FIXED POINT INDEX FROM LIST OF UNIQUE POINTS
fxpt = np.array(fxpt)
fxpt = np.around(fxpt,decimals =4)
fxpt_id = np.lexsort((fxpt[:,1],fxpt[:,0]))
fxpt = fxpt[fxpt_id]
res = (u[:, None] == fxpt).all(-1).any(-1)
fxpt_indx = np.where(res)
rpt_indx = np.where(np.invert(res))


#print('FXPT_INDX' , fxpt_indx)
#print(fxpt)

#create Q and Qf matrix for fixed point and free point - connectivity matrices. 
Qf = C[:,fxpt_indx]
Cf = np.reshape(Qf,(Qf.shape[0],Qf.shape[2]))
Qr = C[:,rpt_indx]
Cr = np.reshape(Qr,(Qr.shape[0],Qr.shape[2]))
#Cr = np.delete(C, fxpt_indx, axis=1)
#print(Cr.shape)

#CREATE DIAGONAL FORCE DENSITY MATRIX
q=np.array(q)
q = np.around(q,decimals =4)
Q=np.diag(q)
#print('Q shape',Q.shape)

#CREATE POINT LOAD VECTORS 
p_x = np.zeros((len(u)-len(fxpt),1))
p_y = np.zeros((len(u)-len(fxpt),1))
p_z = np.full((len(u)-len(fxpt),1),load)
#np.tile(load,len(u)-len(fxpt))
#p_z = np.reshape(p_z,(p_z.shape[0],1))

#CREATE FIXED POINT CO-ORDINATE VECTORS
x_f = fxpt[:,0]
x_f = np.reshape(x_f,(x_f.shape[0],))
y_f = fxpt[:,1]
y_f = np.reshape(y_f,(y_f.shape[0],))
z_f=  np.full((x_f.shape[0],), 0)

print(C.shape)

#CREATE D AND D_F
D = Cr.T.dot(Q).dot(Cr)
D_f = Cr.T.dot(Q).dot(Cf)


#GET THE CO-ORDINATES
#print("OK TILL NOW2")

print(np.linalg.inv(D).dot(p_x))
x_ound = np.linalg.inv(D).dot(p_x - np.reshape(D_f.dot(x_f),(D_f.dot(x_f).shape[1],1)))
y_ound = np.linalg.inv(D).dot(p_y - np.reshape(D_f.dot(y_f),(D_f.dot(y_f).shape[1],1)))
z_found = np.linalg.inv(D).dot(p_z - np.reshape(D_f.dot(z_f),(D_f.dot(z_f).shape[1],1)))



print("ok")
# ---------- end solver ----------
python_3 = GhPythonScript(
    Cr=solver.Cr,
    Cf=solver.Cf,
    x=solver.x_ound,
    y=solver.y_ound,
    z=solver.z_found,
    fxpt=solver.fxpt,
    CON=solver.CON,
    fxpt_indx=solver.fxpt_indx,
    rpt_indx=solver.rpt_indx,
    u=solver.u)  # -> a, sptx, spty, sptz, eptx, epty, eptz
# ---------- python_3: Python ----------
import rhinoscriptsyntax as rs
import ghpythonremote
import scriptcontext as sc
from ghpythonlib.treehelpers import list_to_tree
ssa = sc.sticky['scipy.sparse']
sci = sc.sticky['scipy']
np =sc.sticky['numpy']
                
xx =np.array(x)
x=np.reshape(x,(len(x),1))
y = np.array(y)
y=np.reshape(y,(len(y),1))
z = np.array(z)
z = np.around(z,decimals=4)
z=np.reshape(z,(len(z),1))
        
xedo = np.zeros((len(fxpt),1))
fxpt = np.hstack((fxpt,xedo))
fxpt_id = np.lexsort((fxpt[:,1],fxpt[:,0]))
fxpt = fxpt[fxpt_id]
        
xyz=np.concatenate((x,y,z),axis=1)
#xyz= np.vstack((fxpt,xyz))
        
pt_num = len(fxpt)+len(x)
allpt = np.zeros((pt_num,3))
allpt[fxpt_indx] = fxpt
allpt[rpt_indx]=xyz

print(u)
xedo = np.zeros((len(u),1))
u = np.hstack((u,xedo))
print(fxpt)
print(fxpt_indx)
#print(allpt)
                
                
        
con =CON.copy()
#con = np.concatenate((Cf,Cr),axis =1)
cone =CON.copy()
                
con[con==1] =0
con[con==-1] = 1
spt = np.dot(con,allpt)
                
cone[cone==-1] =0
ept = np.dot(cone,allpt)
                
#PUSH DATA TO GRASSHOPPER TREE
sptx = ghpythonremote.obtain(spt[0:,0].tolist())
sptx =list_to_tree(sptx,source=[0,])
                
spty = ghpythonremote.obtain(spt[0:,1].tolist())
spty =list_to_tree(spty,source=[0,])
                
sptz = ghpythonremote.obtain(spt[0:,2].tolist())
sptz =list_to_tree(sptz,source=[0,])
                
eptx = ghpythonremote.obtain(ept[0:,0].tolist())
eptx =list_to_tree(eptx,source=[0,])
                
epty = ghpythonremote.obtain(ept[0:,1].tolist())
epty =list_to_tree(epty,source=[0,])
                
eptz = ghpythonremote.obtain(ept[0:,2].tolist())
eptz =list_to_tree(eptz,source=[0,])
# ---------- end python_3 ----------
pt_7 = ConstructPoint(XCoordinate=flatten(python_3.sptx), YCoordinate=flatten(python_3.spty), ZCoordinate=flatten(python_3.sptz))
pt_8 = ConstructPoint(XCoordinate=flatten(python_3.eptx), YCoordinate=flatten(python_3.epty), ZCoordinate=flatten(python_3.eptz))
ln_5 = Line(StartPoint=pt_7, EndPoint=pt_8)

# ----
move_2 = Move(Geometry=[fixed_points, line_4], Motion=Y)  # -> Geometry, Transform
end_2 = EndPoints(Curve=ln_5)  # -> Start, End
duppt_2 = RemoveDuplicatePts(Points=[end_2.Start, end_2.End], Tolerance=0.01)
hilonums = HighestLowestNumbers(Numbers=flatten([python_3.eptz, python_3.sptz]))  # -> Highest, Lowest

# ---- group: DISPLAY FINAL STRUCTURE WITH STRESSES
num_4 = Number(flatten(python_3.eptz))
num_5 = Number(flatten(python_3.sptz))
len = Length(Curve=ln_5)
python_4 = GhPythonScript(x=num_5, y=num_4, z=len)  # -> out, a
# ---------- python_4: Python ----------
print(x , y, z)
if x == 0 and y == 0 :
    a = 0.1 
else:
    a= z
# ---------- end python_4 ----------
multiplication_4 = Multiplication(FD=num_2, B=python_4.a)
abs = Absolute(Value=multiplication_4)
division_2 = Division(A=abs, B=Slider(750, range=0..1000))
pipe = Pipe(Curve=ln_5, Radius=division_2, Caps=0)
X_2 = UnitX(Factor=Slider(25, range=0..100))
expression = Expression(
    x=flatten(multiplication_4),
    y=ColourSwatch(SwatchColor=RGB(224, 31, 31)),
    z=ColourSwatch(SwatchColor=RGB(49, 67, 204)),
    Expression="if(x≥0,y,z)")
move_3 = Move(Geometry=pipe, Motion=X_2)  # -> Geometry, Transform
preview = CustomPreview(Geometry=flatten(move_3.Geometry), Material=expression)

# ----
selpv = SelectablePreview(Geometry=duppt_2, lock=False, maintain=False, order=False, selectedobject="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")  # -> Geometry, Path, Index
panel_21 = Panel(hilonums.Highest)
duppt_3 = RemoveDuplicatePts(Points=selpv.Geometry, Tolerance=0.01)
project = Project(Geometry=duppt_3, Plane=PlaneXY(0, 0, 0))  # -> Geometry, Transform
pt_9 = Point(project.Geometry)
len_2 = Length(Curve=ln_5)
wbweave_2 = WeaverbirdsMeshFromLinesWeaveBack(Lines=ln_5, MaximumValence=4)
multiplication_5 = Multiplication(A=len_2, B=abs)
neg_5 = Negative(Value=X_2)
msh2psrf = MeshToPolysurface(Mesh=wbweave_2, Triangles=False, FaceMerge=False)
ma = MassAddition(Input=multiplication_5)  # -> Result, PartialResults
panel_22 = Panel(ma.Result)
brep = Brep(msh2psrf)
cap = CapHoles(Brep=brep)
move_4 = Move(Geometry=cap, Motion=neg_5)  # -> Geometry, Transform

# ---- group: STRESS CALCULATION
airy_stress_function = Brep(cap)
python_5 = GhPythonScript(x=airy_stress_function)  # -> out, a; inputs x: Brep
# ---------- python_5: Python ----------
x.Repair(0.000001)
print x.IsSolid
print x.IsManifold
print x.IsValid
a=x
# ---------- end python_5 ----------
preview_2 = CustomPreview(
    Geometry=python_5.a,
    Material={diffuse=RGB(221, 160, 221), emission=RGB(66, 48, 66), shine=0.5, specular=RGB(255, 255, 255), transparency=0})
topology = BrepTopology(Brep=python_5.a, PerspectiveOnly=False)  # -> FaceFaceAdjacency, FaceEdgeAdjacency, EdgeFaceAdjacency
debrep = DeconstructBrep(Brep=python_5.a)  # -> Faces, simplify(graft(Edges)), Vertices
item = ListItem(List=debrep.Faces, Index=topology.EdgeFaceAdjacency, Wrap=True)  # -> simplify(Item)
md_slider = MDSlider(SliderMode=0, slider_value=Point(0.5, 0.5, 0.5), x_domain=Domain(0, 1), y_domain=Domain(0, 1), z_domain=Domain(0, 1))
area_2 = Area(Geometry=item)  # -> Area, Centroid
srf = Surface(reparameterize(item))
project_2 = Project(Geometry=debrep.Edges, Plane=PlaneXY(0, 0, 0))  # -> Geometry, Transform
project_3 = Project(Geometry=area_2.Centroid, Plane=PlaneXY(0, 0, 0))  # -> Geometry, Transform
evalsrf = EvaluateSurface(Surface=srf, Point=md_slider)  # -> Point, Normal, UDirection, VDirection, Frame
python_6 = PythonScript(x=evalsrf.Normal, y=project_2.Geometry, z=project_3.Geometry, u=area_2.Area)  # -> out, flatten(FD), edge, d; inputs x: list of Vector3d, y: Line, z: list of Point3d, u: list
# ---------- python_6: Python ----------
import Rhino.Geometry as rg
import math
a=[]
M=(y.From+y.To)/2
c=[]
forcediagramC=[]
forcediagramT=[]
d=[]
if len(x)==2:
    N1=x[0]
    N2=x[1]
    
    N1=N1/N1.Z
    N2=N2/N2.Z
    P=rg.Point3d(N1.X,N1.Y,0)
    Q=rg.Point3d(N2.X,N2.Y,0)
    c.append(P)
    c.append(Q)
    V=P-Q
    if(V.Length<0.0001):
        print P,Q
    d.append(rg.Line(P,Q))
    p=y.From
    q=y.To
    edge=rg.Line(p,q)
    p=rg.Point3d(p.X,p.Y,0)
    q=rg.Point3d(q.X,q.Y,0)
    v=p-q
    #V.Unitize()
    #v.Unitize()
    #print V*v
    pp=z[0]
    qq=z[1]
    X=rg.Transform.Rotation(rg.Vector3d(1,0,0),rg.Vector3d(0,1,0),p)
    p.Transform(X)
    q.Transform(X)
    v=p-q
    if v*(pp-qq)<0:
        v.Reverse()

    if v*V>0:
        FD=-V.Length/v.Length #tension, negative because of inverted vertical loads
    else:
        FD=V.Length/v.Length #compression
        
    if(x[0]*x[1]<0):
        FD=-FD
else:
    FD=1
    p=y.From
    q=y.To
    edge=rg.Line(p,q)
# ---------- end python_6 ----------

# ----
move_5 = Move(Geometry=fixed_points, Motion=X)  # -> Geometry, Transform

# ----
# KARAMBA MODEL
support = Point(fixed_points)
multiplication_6 = Multiplication(A=X_2, B=2)
move_6 = Move(Geometry=ln_5, Motion=multiplication_6)  # -> Geometry, Transform
move_7 = Move(Geometry=support, Motion=multiplication_6)  # -> Geometry, Transform
end_3 = EndPoints(Curve=move_6.Geometry)  # -> Start, End
duppt_4 = RemoveDuplicatePts(Points=[end_3.Start, end_3.End], Tolerance=0.01)
number_slider_10 = Slider(3.5, range=0..10)
difference = SetDifference(SetA=duppt_4, SetB=move_7.Geometry)
upperchord_crv = Curve(move_6.Geometry)
supports_pt = Point(move_7.Geometry)
nodesq_pt = Point(difference)
q_num = Number(division)
matselect = MaterialSelectionKaramba3D(menu=[dropdown(1), dropdown(2)])
Z = UnitZ(Factor=q_num)
crosecrselect = CrossSectionRangeSelectorKaramba3D(MaximumHeight_cm=-1, MaximumWidth_cm=-1, Material=matselect, menu=[dropdown(1), dropdown(1), dropdown(4)])
rev_5 = Reverse(Vector=Z)
supp = SupportKaramba3D(PosInd=supports_pt, menu=[buttons(on, on, on, off, off, off)])
loads = LoadsKaramba3D(ForceVector=rev_5, Local=False, PosInd=nodesq_pt, LCase=0, mode="Point")
Y_2 = UnitY(Factor="0.001")
item_2 = ListItem(List=cross_section, Index=0, Wrap=True)
beam_joints = BeamJointsKaramba3D(
    ElementIdentifiers="Upper Chord",
    CtKNMAtStartingNode=Vector(0, 0, 0),
    CrKNmRadAtStartingNode=Vector(0, 0, 0),
    CtKNMAtEndNode=Vector(0, 0, 0),
    CrKNmRadAtEndNode=Vector(0, 0, 0),
    menu=[buttons(off, off, off, off, off, off), buttons(off, off, off, off, off, off)])
linetobeam = LineToBeamKaramba3D(Line=upperchord_crv, Identifier=graft("Upper Chord"), CrossSection=item_2, New=True, Remove=True, LimitDistance_m=0.005)  # -> Element, Points, Info
assemble = AssembleModelKaramba3D(Elem=flatten(linetobeam.Element), Support=flatten(supp), Load=flatten(loads), Joint=beam_joints, LimitDistance_m=0.005)  # -> Model, Info, Mass_kg, CenterOfGravity
analyze = AnalyzeKaramba3D(Model=assemble.Model)  # -> CalculatedModel, MaximumDisplacement_cm, ResultingForceOfGravity_kN, ElasticEnergy_kNm
modelview = ModelViewKaramba3D(Model=analyze.CalculatedModel, ResultFactors=1, ResultCase=-1)  # -> Model, DeformedMesh, DeformedAxes, DeformedModel
opticrosec = OptimizeCrossSectionKaramba3D(
    Model=assemble.Model,
    CrossSections=cross_section,
    MaximumUtilization=1,
    MaximumDisplacement_cm=-1,
    UltimateLimitStateIterations="1",
    DisplacementIterations=5,
    NumberOfSamplePoints=3,
    ElasticDesign=True,
    GammaM0=1,
    GammaM1=1)  # -> ModelWithOptimizedCrossSections, Info, Mass_kg, MaximumDisplacement_cm, ElasticEnergy_kNm
b_forces = BeamForcesKaramba3D(AnalyzedModel=analyze.CalculatedModel, LCase=-1, MaximumDistanceBetweenResults_m=-1, NumberOfResultsPerBeamElement=2)  # -> AnalyzedModel, NormalForce_kN, ShearForceVz_kN, ShearForceVy_kN, BendingMomentMt_kNm, BendingMomentMy_kNm, BendingMomentMz_kNm
item_3 = ListItem(List=b_forces.NormalForce_kN, Index=0, Wrap=True)  # -> flatten(Item)
beamview = BeamViewKaramba3D(Model=modelview.Model)  # -> Model, MeshesOfRenderedBeams, DeformedBeamAxes, LegendColors, LegendTags
modelview_2 = ModelViewKaramba3D(Model=opticrosec.ModelWithOptimizedCrossSections, ResultFactors=1, ResultCase=-1)  # -> Model, DeformedMesh, DeformedAxes, DeformedModel
modelview_3 = ModelViewKaramba3D(Model=modelview.Model, ResultFactors=1, ResultCase=-1)  # -> Model, DeformedMesh, DeformedAxes, DeformedModel
curvepoint = PointOnCurve(beamview.DeformedBeamAxes, parameter=0.5)
roundd = RoundToDecimalPlace(NumberX=item_3, DecimalPlace=Slider(2, range=0..10), RoundType=0)  # -> Rounded, Difference
nodedisp = NodalDisplacementsKaramba3D(AnalyzedModel=modelview_3.Model, ResultCase=0)  # -> AnalyzedModel, NodalTranslations_m, NodalRotations_rad
tag = TextTag(Location=curvepoint, Text=roundd.Rounded)
devec = DeconstructVector(Vector=nodedisp.NodalTranslations_m)  # -> XComponent, YComponent, ZComponent
abs_2 = Absolute(Value=devec.ZComponent)
abs_3 = Absolute(Value=devec.XComponent)
abs_4 = Absolute(Value=devec.YComponent)
num_6 = Number(opticrosec.Mass_kg)
hilonums_2 = HighestLowestNumbers(Numbers=abs_2)  # -> Highest, Lowest
hilonums_3 = HighestLowestNumbers(Numbers=abs_3)  # -> Highest, Lowest
hilonums_4 = HighestLowestNumbers(Numbers=abs_4)  # -> Highest, Lowest
deflection_max = Panel(hilonums_2.Highest)
deflection_max_2 = Panel(hilonums_3.Highest)
deflection_max_3 = Panel(hilonums_4.Highest)

neg_6 = Negative(Value=python_6.FD)
multiplication_7 = Multiplication(A=python_6.FD, B=Slider(350, range=0..1000))
pt_10 = Point(fixed_points)
num_7 = Number(division)

line_5 = Line(python_6.edge)
end_4 = EndPoints(Curve=line_5)  # -> Start, End
num_8 = Number(num_7)
fixed_points_2 = Point(duppt)
num_9 = Number(multiplication_7)
python_7 = GhPythonScript(x=end_4.Start, y=end_4.End)  # -> flatten(array); inputs x: Point3d, y: Point3d; same code as python
loading_2 = Negative(Value=num_8)
python_8 = GhPythonScript(x=fixed_points_2)  # -> aa; inputs x: list of Point3d; same code as python_2
solver_2 = GhPythonScript(fxpt=flatten(python_8), x=flatten(python_7), q=num_9, load=loading_2)  # -> Cr, Cf, x_ound, y_ound, z_found, fxpt, CON, fxpt_indx, rpt_indx, u; inputs fxpt: list, x: list, q: list; same code as solver
python_9 = GhPythonScript(
    Cr=solver_2.Cr,
    Cf=solver_2.Cf,
    x=solver_2.x_ound,
    y=solver_2.y_ound,
    z=solver_2.z_found,
    fxpt=solver_2.fxpt,
    CON=solver_2.CON,
    fxpt_indx=solver_2.fxpt_indx,
    rpt_indx=solver_2.rpt_indx,
    u=solver_2.u)  # -> a, sptx, spty, sptz, eptx, epty, eptz; same code as python_3
pt_11 = ConstructPoint(XCoordinate=flatten(python_9.sptx), YCoordinate=flatten(python_9.spty), ZCoordinate=flatten(python_9.sptz))
pt_12 = ConstructPoint(XCoordinate=flatten(python_9.eptx), YCoordinate=flatten(python_9.epty), ZCoordinate=flatten(python_9.eptz))
ln_6 = Line(StartPoint=pt_11, EndPoint=pt_12)

nvibes = NaturalVibrationsKaramba3D(Model=modelview_2.Model, FromIndex=1, NumberOfModes=Slider(10, range=0..10), MaximumNumberOfIterations=30, Epsilon=1e-05)  # -> ModelWithVibrationModesAsLoadCaseResults, NaturalFrequencies_Hz, ModalMass_kg, ParticipationFactorInGlobalXYAndZDirection
duppt_5 = RemoveDuplicatePts(Points=flatten([end_4.Start, end_4.End]), Tolerance=0.01)
panel_23 = Panel(nvibes.NaturalFrequencies_Hz)
panel_24 = Panel(nvibes.ParticipationFactorInGlobalXYAndZDirection)
item_4 = ListItem(List=flatten(duppt_5), Index=panel_15, Wrap=True)
panel_25 = Panel(num_6)
panel_26 = Panel(nvibes.ModalMass_kg)
division_3 = Division(A=Slider(1, range=0..1), B=nvibes.NaturalFrequencies_Hz)
hilonums_5 = HighestLowestNumbers(Numbers=flatten([python_9.sptz, python_9.eptz]))  # -> Highest, Lowest
panel_27 = Panel(division_3)
panel_28 = Panel(hilonums_5.Highest)
abs_5 = Absolute(Value=roundd.Rounded)
hilonums_6 = HighestLowestNumbers(Numbers=roundd.Rounded)  # -> Highest, Lowest
panel_29 = Panel(hilonums_6.Highest)
panel_30 = Panel(hilonums_6.Lowest)
hilonums_7 = HighestLowestNumbers(Numbers=abs_5)  # -> Highest, Lowest
panel_31 = Panel(hilonums_7.Highest)
panel_32 = Panel(hilonums_7.Lowest)
len_3 = Length(Curve=ln_6)
midpt = CurveMiddle(Curve=ln_6)

num_10 = Number(flatten(python_9.eptz))
num_11 = Number(flatten(python_9.sptz))
len_4 = Length(Curve=ln_6)
python_10 = GhPythonScript(x=num_11, y=num_10, z=len_4)  # -> out, a; same code as python_4
multiplication_8 = Multiplication(FD=num_9, B=python_10.a)
abs_6 = Absolute(Value=multiplication_8)
Y_3 = UnitY(Factor=Slider(25, range=0..100))
expression_2 = Expression(
    x=flatten(multiplication_8),
    y=ColourSwatch(SwatchColor=RGB(224, 31, 31)),
    z=ColourSwatch(SwatchColor=RGB(49, 67, 204)),
    Expression="if(x≥0,y,z)")

multiplication_9 = Multiplication(A=Slider(5, range=0..1000), B=1000)

division_4 = Division(A=abs_6, B=multiplication_9)
pipe_2 = Pipe(Curve=ln_6, Radius=division_4, Caps=0)
move_8 = Move(Geometry=pipe_2, Motion=Y_3)  # -> Geometry, Transform
preview_3 = CustomPreview(Geometry=flatten(move_8.Geometry), Material=expression_2)

multiplication_10 = Multiplication(A=len_3, B=abs_6)
ma_2 = MassAddition(Input=multiplication_10)  # -> Result, PartialResults
self_supported = Panel(ma_2.Result)
vec = VectorXYZ(XComponent=Y_3, YComponent=Y_3, ZComponent=0)  # -> Vector, Length
move_9 = Move(Geometry=fixed_points_2, Motion=vec.Vector)  # -> Geometry, Transform
move_10 = Move(Geometry=ln_6, Motion=vec.Vector)  # -> Geometry, Transform
move_11 = Move(Geometry=midpt, Motion=Y_3)  # -> Geometry, Transform
move_12 = Move(Geometry=fixed_points_2, Motion=Y_3)  # -> Geometry, Transform
end_5 = EndPoints(Curve=move_10.Geometry)  # -> Start, End
roundd_2 = RoundToDecimalPlace(NumberX=abs_6, DecimalPlace=Slider(2, range=0..10), RoundType=0)  # -> Rounded, Difference
duppt_6 = RemoveDuplicatePts(Points=[end_5.Start, end_5.End], Tolerance=0.01)
tag_2 = TextTag(Location=move_11.Geometry, Text=roundd_2.Rounded)
difference_2 = SetDifference(SetA=duppt_6, SetB=fixed_points_2)

# ----
# KARAMBA MODEL
# KARAMBA OPTIMIZATION
upperchord_crv_2 = Curve(move_10.Geometry)
supports_pt_2 = Point(move_9.Geometry)
nodesq_pt_2 = Point(difference_2)
q_num_2 = Number(num_7)
Z_2 = UnitZ(Factor=q_num_2)
rev_6 = Reverse(Vector=Z_2)
supp_2 = SupportKaramba3D(PosInd=supports_pt_2, menu=[buttons(off, off, on, off, off, off)])
item_5 = ListItem(List=cross_section_2, Index=0, Wrap=True)
Y_4 = UnitY(Factor="0.001")
beam_joints_2 = BeamJointsKaramba3D(
    ElementIdentifiers="Upper Chord",
    CtKNMAtStartingNode=Vector(0, 0, 0),
    CrKNmRadAtStartingNode=Vector(0, 0, 0),
    CtKNMAtEndNode=Vector(0, 0, 0),
    CrKNmRadAtEndNode=Vector(0, 0, 0),
    menu=[buttons(off, off, off, off, off, off), buttons(off, off, off, off, off, off)])

# ---- group: Loads (Karamba3D)
loads_2 = LoadsKaramba3D(ForceVector=rev_6, Local=False, PosInd=nodesq_pt_2, LCase=0, mode="Point")

# ---- group: Line to Beam (Karamba3D)
linetobeam_2 = LineToBeamKaramba3D(
    Line=upperchord_crv_2,
    Identifier=graft("Upper Chord"),
    CrossSection=item_5,
    New=True,
    Remove=True,
    LimitDistance_m=0.005)  # -> Element, Points, Info

# ---- group: Assemble Model (Karamba3D)
assemble_2 = AssembleModelKaramba3D(
    Elem=flatten(linetobeam_2.Element),
    Support=flatten(supp_2),
    Load=flatten(loads_2),
    Joint=beam_joints_2,
    LimitDistance_m=0.005)  # -> Model, Info, Mass_kg, CenterOfGravity

# ---- group: Analyze (Karamba3D)
analyze_2 = AnalyzeKaramba3D(Model=assemble_2.Model)  # -> CalculatedModel, MaximumDisplacement_cm, ResultingForceOfGravity_kN, ElasticEnergy_kNm

# ---- group: Model View (Karamba3D)
modelview_4 = ModelViewKaramba3D(Model=analyze_2.CalculatedModel, ResultFactors=1, ResultCase=-1)  # -> Model, DeformedMesh, DeformedAxes, DeformedModel

# ---- group: Optimize Cross Section (Karamba3D)
opticrosec_2 = OptimizeCrossSectionKaramba3D(
    Model=assemble_2.Model,
    CrossSections=cross_section_2,
    MaximumUtilization=1,
    MaximumDisplacement_cm=-1,
    UltimateLimitStateIterations="1",
    DisplacementIterations=5,
    NumberOfSamplePoints=3,
    ElasticDesign=True,
    GammaM0=1,
    GammaM1=1)  # -> ModelWithOptimizedCrossSections, Info, Mass_kg, MaximumDisplacement_cm, ElasticEnergy_kNm

# ---- group: Beam View (Karamba3D)
beamview_2 = BeamViewKaramba3D(Model=modelview_4.Model)  # -> Model, MeshesOfRenderedBeams, DeformedBeamAxes, LegendColors, LegendTags

# ----
b_forces_2 = BeamForcesKaramba3D(AnalyzedModel=analyze_2.CalculatedModel, LCase=-1, MaximumDistanceBetweenResults_m=-1, NumberOfResultsPerBeamElement=2)  # -> AnalyzedModel, NormalForce_kN, ShearForceVz_kN, ShearForceVy_kN, BendingMomentMt_kNm, BendingMomentMy_kNm, BendingMomentMz_kNm
item_6 = ListItem(List=b_forces_2.NormalForce_kN, Index=0, Wrap=True)  # -> flatten(Item)
num_12 = Number(opticrosec_2.Mass_kg)
nodedisp_2 = NodalDisplacementsKaramba3D(AnalyzedModel=modelview_4.Model, ResultCase=0)  # -> AnalyzedModel, NodalTranslations_m, NodalRotations_rad
curvepoint_2 = PointOnCurve(beamview_2.DeformedBeamAxes, parameter=0.5)
roundd_3 = RoundToDecimalPlace(NumberX=item_6, DecimalPlace=Slider(2, range=0..10), RoundType=0)  # -> Rounded, Difference
tag_3 = TextTag(Location=curvepoint_2, Text=roundd_3.Rounded)
devec_2 = DeconstructVector(Vector=nodedisp_2.NodalTranslations_m)  # -> XComponent, YComponent, ZComponent
abs_7 = Absolute(Value=devec_2.ZComponent)
abs_8 = Absolute(Value=devec_2.XComponent)
abs_9 = Absolute(Value=devec_2.YComponent)
hilonums_8 = HighestLowestNumbers(Numbers=abs_7)  # -> Highest, Lowest
hilonums_9 = HighestLowestNumbers(Numbers=abs_8)  # -> Highest, Lowest
hilonums_10 = HighestLowestNumbers(Numbers=abs_9)  # -> Highest, Lowest
deflection_max_4 = Panel(hilonums_8.Highest)
deflection_max_5 = Panel(hilonums_9.Highest)
deflection_max_6 = Panel(hilonums_10.Highest)

panel_33 = Panel(num_12)

# ---- group: Model View (Karamba3D)
modelview_5 = ModelViewKaramba3D(Model=opticrosec_2.ModelWithOptimizedCrossSections, ResultFactors=1, ResultCase=-1)  # -> Model, DeformedMesh, DeformedAxes, DeformedModel

# ----
utilization = UtilizationOfElementsKaramba3D(
    AnalyzedModel=modelview_5.Model,
    ResultCase=-1,
    NumberOfSamplePoints=3,
    ElasticDesign=True,
    GammaM0=1,
    GammaM1=1,
    WithDetails=False,
    mode="Beams")  # -> AnalyzedModel, Utilization, SigMax_kN_cm2, SigMin_kN_cm2, TauMax_kN_cm2, UtilN, UtilVy, UtilVz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
nvibes_2 = NaturalVibrationsKaramba3D(Model=modelview_5.Model, FromIndex=1, NumberOfModes=Slider(5, range=0..10), MaximumNumberOfIterations=30, Epsilon=1e-05)  # -> ModelWithVibrationModesAsLoadCaseResults, NaturalFrequencies_Hz, ModalMass_kg, ParticipationFactorInGlobalXYAndZDirection
panel_34 = Panel(utilization.UtilN)
division_5 = Division(A=Slider(1, range=0..1), B=nvibes_2.NaturalFrequencies_Hz)
emodes = EigenModesKaramba3D(Model=modelview_5.Model, FromIndex=1, NumberOfModes=number_slider_8, MaximumNumberOfIterations=300, Epsilon=1e-07)  # -> ModelWithEigenModesAsLoadCaseResults, Eigenvalues
abs_10 = Absolute(Value=roundd_3.Rounded)
hilonums_11 = HighestLowestNumbers(Numbers=roundd_3.Rounded)  # -> Highest, Lowest
nvibes_3 = NaturalVibrationsKaramba3D(Model=modelview_5.Model, FromIndex=1, NumberOfModes=number_slider_8, MaximumNumberOfIterations=30, Epsilon=1e-05)  # -> ModelWithVibrationModesAsLoadCaseResults, NaturalFrequencies_Hz, ModalMass_kg, ParticipationFactorInGlobalXYAndZDirection
panel_35 = Panel(division_5)
panel_36 = Panel(hilonums_11.Highest)
panel_37 = Panel(hilonums_11.Lowest)
hilonums_12 = HighestLowestNumbers(Numbers=abs_10)  # -> Highest, Lowest
panel_38 = Panel(nvibes_3.NaturalFrequencies_Hz)
panel_39 = Panel(nvibes_3.ParticipationFactorInGlobalXYAndZDirection)
panel_40 = Panel(hilonums_12.Highest)
panel_41 = Panel(hilonums_12.Lowest)

# ==== cluster GHPythonRemote: Connects the Grasshopper Python component to an external Python instance.
python = PythonScript()  # -> gh_parent_doc_dir
# ---------- python: Python ----------
from os import path

gh_parent_doc_dir = path.abspath(path.dirname(ghenv.Component.OnPingDocument().Owner.OnPingDocument().FilePath))
# ---------- end python ----------
# GH to python remote example.
# Pierre Cuvilliers, 2017-2018
# Released under the MIT license
# github.com/pilcru/ghpythonremote
# Runs and connects to an external python engine, and
# assigns imported modules to scriptcontext.sticky variables.
# 
# Arguments:
#       code (str): Path to the GH_to_python_sticky.py code file.
#       location (str): Path to a python executable, or to a folder
#             containing `python.exe`, or the name of a conda-created
#             virtual environment prefixed by `conda://` (`conda://env_name`).
#             If empty, finds python from your windows %PATH%.
#       run (boolean): Creates the connection, and imports new
#             modules, when turned to True. Kills the connection,
#             and deletes the references to the imports, when turned
#             to False.
#       modules (str list): List of module names to import in the
#             remote python. They will be added to the
#             scriptcontext.sticky dictionary, allowing them to be
#             reused from other python components in the same
#             Grasshopper document. Submodules (for example
#             `numpy.linalg` have to be added explicitly to this list
#             to be available later.
#       log_level (str from ['NOTSET', 'DEBUG', 'INFO', 'WARNING', 'ERROR', 'CRITICAL']):
#             Logging level to use for the local IronPython and the
#             remote python instance.
#       working_dir (str): Working directory for the remote python
#             instance.
# 
# Returns:
#       out (str): Console output with DEBUG information.
#       linked_modules (str list): list of imported module names.
#       rpy (rpyc connection object): The object representing the
#             remote Python interpreter.
location = ClusterInput()  # location (str): Path to a python executable, or to a folder containing `python.exe`, or the name of a conda-created virtual environment prefixed by `conda://` (`conda://env_name`). If empty, finds python from your windows %PATH%.
run = ClusterInput()  # run (boolean): Creates the connection, and imports new modules, when turned to True. Kills the connection,and deletes the references to the imports, when turned to False.
modules = ClusterInput()  # modules (str list): List of module names to import in the remote python. They will be added to the scriptcontext.sticky dictionary, allowing them to be reused from other python components in the same Grasshopper document. Submodules (for example `numpy.linalg` have to be added explicitly to this list to be available later.
list = ValueList({"CRITICAL", "ERROR", "WARNING", "INFO", "DEBUG", "NOTSET"}, selected="DEBUG")
panel = Panel(python)
ghpythonremote = GHPythonRemote(location=location, run=run, modules=modules, log_level=list, working_dir=panel)  # -> out, linked_modules, rpy; inputs run: Boolean, modules: list
# ---------- ghpythonremote: Python ----------
import inspect
import logging
from os import path
import sys
from time import sleep

import scriptcontext

import ghpythonremote
from ghpythonremote.connectors import GrasshopperToPythonRemote

local_log_level = getattr(logging, log_level, logging.WARNING)
logger = logging.getLogger("ghpythonremote")
logger.setLevel(local_log_level)
ch = logging.StreamHandler()
ch.setLevel(local_log_level)
formatter = logging.Formatter("%(levelname)s: %(name)s:\n%(message)s")
ch.setFormatter(formatter)
logger.handlers = []
logger.addHandler(ch)
logger = logging.getLogger("ghpythonremote.GH_to_python")

ROOT = path.abspath(path.dirname(inspect.getfile(ghpythonremote)))
rpyc_server_py = path.join(ROOT, "pythonservice.py")

# Set connection to CLOSED if this is the first run
# and initialize set of linked modules
try:
    remote_python_status
except NameError:
    remote_python_status = "CLOSED"
    lkd_modules = set()

# Wait for connection to connect or terminate
timer = 0
while remote_python_status == "CONNECTING" or remote_python_status == "CLOSING":
    sleep(1)
    timer += 1
    if timer == 10:
        try:
            gh2py_manager.__exit__(*sys.exc_info())
        except Exception:
            pass
        remote_python_status = "CLOSED"
        lkd_modules = set()
        raise RuntimeError(
            "Connection left in an inconsistent state and not returning. Reset "
            "everything."
        )

if run:
    if not remote_python_status == "OPEN":
        remote_python_status = "CONNECTING"
        gh2py_manager = GrasshopperToPythonRemote(
            rpyc_server_py,
            location=location,
            timeout=10,
            port=None,
            log_level=log_level,
            working_dir=working_dir,
        )
        gh2py = gh2py_manager.__enter__()
        remote_python_status = "OPEN"

    # Stuff that we can reach
    rpymod = gh2py.py_remote_modules  # A getter function for a named python module
    rpy = gh2py.connection  # Represents the remote instance root object
    scriptcontext.sticky["rpy"] = rpy
    # Add modules
    for mod in modules:
        try:
            scriptcontext.sticky[mod] = rpymod(mod)
            lkd_modules.add(mod)
        except ImportError:
            gh2py_manager.__exit__(*sys.exc_info())
            raise

elif not remote_python_status == "CLOSED":
    remote_python_status = "CLOSING"
    # Remove linked modules
    for mod in lkd_modules:
        del scriptcontext.sticky[mod]
    del scriptcontext.sticky["rpy"]
    gh2py_manager.__exit__(*sys.exc_info())
    lkd_modules = set()
    remote_python_status = "CLOSED"

# Change variable name because ghpython resets outputs to None before each run
linked_modules = lkd_modules

logger.info("GH to python connection is {}".format(remote_python_status))
# ---------- end ghpythonremote ----------
out = ClusterOutput(ghpythonremote.out)  # Console output.
linked_modules = ClusterOutput(ghpythonremote.linked_modules)  # Names of modules that were successfully added to the scriptcontext.sticky dictionary.
rpy = ClusterOutput(ghpythonremote.rpy)  # The object representing the remote python instance
python_2 = PythonScript(module_names=ghpythonremote.linked_modules)  # -> import_statements; inputs module_names: list
# ---------- python_2: Python ----------
import_statements = ["import scriptcontext as sc"]
for module_name in module_names:
    import_statements.append("{0} = sc.sticky['{0}']".format(module_name))

if len(module_names) == 0:
    import_statements = []
# ---------- end python_2 ----------
import_statements = ClusterOutput(python_2)  # Useful import statements to use the imported modules in your scripts.
