# Grasshopper definition actual circle with orifice.gh (Grasshopper 1.0.7)
# Copyright: © 2017-2018 Pierre Cuvilliers, Caitlin Mueller, Massachusetts Institute of Technology
# plug-ins: LunchBox, Kangaroo2 Components, Weaverbird, Pufferfish, karambaGH

number_slider = Slider(0.3, range=0..10)

# ---- group: CONSTRUCT AIRY STRESS SURFACE
number_slider_2 = Slider(2, range=0..100)
pi = Pi(Factor=1)
number_slider_3 = Slider(10, range=0..100)
pi_2 = Pi(Factor=1)
yz = YZPlane(Origin=Point(0, 0, 0))
division = Division(A=pi, B=Slider(4, range=0..100))
division_2 = Division(A=pi_2, B=Slider(2.5, range=0..10))
dom = ConstructDomain(DomainStart=Slider(0.5, range=0..1), DomainEnd=division_2)
arc = Arc(Plane=yz, Radius=number_slider_3, Angle=dom)  # -> Arc, Length
pt = ConstructPoint(XCoordinate=0, YCoordinate=0, ZCoordinate=0)
end = EndPoints(Curve=arc.Arc)  # -> Start, End
ln = Line(StartPoint=end.Start, EndPoint=end.End)
line = LineSDL(Start=pt, Direction=Vector(0, 0, 1), Length=Slider(100, range=0..100))
rotate = Rotate(Geometry=arc.Arc, Angle=3.141592654, Plane=ln)  # -> Geometry, Transform
revsrf = Revolution(Curve=rotate.Geometry, Axis=line, Domain=Domain(0, 6.283185307))

# ---- group: AIRY STRESS TAG
multiplication = Multiplication(A=number_slider_3, B=2)
neg = Negative(Value=multiplication)
airy_stress_tag = Panel("""AIRY STRESS FUNCTION :
Constructed by User""")
Y = UnitY(Factor=neg)
move = Move(Geometry=pt, Motion=Y)  # -> Geometry, Transform
tag = TextTag(Location=move.Geometry, Text=airy_stress_tag)

# ---- group: AIRY STRESS SURFACE DISCRETIZATION
number_slider_4 = Slider(10, range=0..100)
number_slider_5 = Slider(20, range=0..100)
diamond = DiamondPanels(Surface=revsrf, UDivisions=number_slider_5, VDivisions=number_slider_4)  # -> DiamondPanels, TriPanels
quads = QuadPanels(Surface=revsrf, UDivisions=number_slider_5, VDivisions=number_slider_4)
# AIRY STRESS FORMULATION
trib = TrianglePanelsB(Surface=revsrf, UDivisions=number_slider_5, VDivisions=number_slider_4)
tric = TrianglePanelsC(Surface=revsrf, UDivisions=number_slider_5, VDivisions=number_slider_4)
join = BrepJoin(Breps=trib)  # -> Breps, Closed
brep = Brep([diamond.DiamondPanels, diamond.TriPanels])
debrep = DeconstructBrep(Brep=join.Breps)  # -> Faces, Edges, Vertices
join_2 = BrepJoin(Breps=debrep.Faces)  # -> Breps, Closed
cap = CapHoles(Brep=join_2.Breps)
debrep_2 = DeconstructBrep(Brep=cap)  # -> Faces, Edges, Vertices
join_3 = BrepJoin(Breps=debrep_2.Faces)  # -> Breps, Closed

# ----
pt_2 = Point(debrep_2.Vertices)
line_2 = Line(debrep_2.Edges)

airy_stress_function = Brep(join_3.Breps)
# CALULATION OF FORCE DENSITIES
python = GhPythonScript(x=airy_stress_function)  # -> out, a; inputs x: Brep
# ---------- python: Python ----------
x.Repair(0.000001)
print x.IsSolid
print x.IsManifold
print x.IsValid
a=x
# ---------- end python ----------
preview = CustomPreview(
    Geometry=python.a,
    Material={diffuse=RGB(221, 160, 221), emission=RGB(66, 48, 66), shine=0.5, specular=RGB(255, 255, 255), transparency=0})
topology = BrepTopology(Brep=python.a, PerspectiveOnly=False)  # -> FaceFaceAdjacency, FaceEdgeAdjacency, EdgeFaceAdjacency
debrep_3 = DeconstructBrep(Brep=python.a)  # -> Faces, simplify(graft(Edges)), Vertices
item = ListItem(List=debrep_3.Faces, Index=topology.EdgeFaceAdjacency, Wrap=True)  # -> simplify(Item)
md_slider = MDSlider(SliderMode=0, slider_value=Point(0.5, 0.5, 0.5), x_domain=Domain(0, 1), y_domain=Domain(0, 1), z_domain=Domain(0, 1))
area = Area(Geometry=item)  # -> Area, Centroid
srf = Surface(reparameterize(item))
project = Project(Geometry=debrep_3.Edges, Plane=PlaneXY(0, 0, 0))  # -> Geometry, Transform
project_2 = Project(Geometry=area.Centroid, Plane=PlaneXY(0, 0, 0))  # -> Geometry, Transform
evalsrf = EvaluateSurface(Surface=srf, Point=md_slider)  # -> Point, Normal, UDirection, VDirection, Frame
python_2 = PythonScript(x=evalsrf.Normal, y=project.Geometry, z=project_2.Geometry, u=area.Area)  # -> out, flatten(FD), edge, d; inputs x: list of Vector3d, y: Line, z: list of Point3d, u: list
# ---------- python_2: Python ----------
import Rhino.Geometry as rg
import math
a=[]
M=(y.From+y.To)/2
c=[]
forcediagramC=[]
forcediagramT=[]
d=[]
if len(x)==2:
    N1=x[0]
    N2=x[1]
    
    N1=N1/N1.Z
    N2=N2/N2.Z
    P=rg.Point3d(N1.X,N1.Y,0)
    Q=rg.Point3d(N2.X,N2.Y,0)
    c.append(P)
    c.append(Q)
    V=P-Q
    if(V.Length<0.0001):
        print P,Q
    d.append(rg.Line(P,Q))
    p=y.From
    q=y.To
    edge=rg.Line(p,q)
    p=rg.Point3d(p.X,p.Y,0)
    q=rg.Point3d(q.X,q.Y,0)
    v=p-q
    #V.Unitize()
    #v.Unitize()
    #print V*v
    pp=z[0]
    qq=z[1]
    X=rg.Transform.Rotation(rg.Vector3d(1,0,0),rg.Vector3d(0,1,0),p)
    p.Transform(X)
    q.Transform(X)
    v=p-q
    if v*(pp-qq)<0:
        v.Reverse()

    if v*V>0:
        FD=-V.Length/v.Length #tension, negative because of inverted vertical loads
    else:
        FD=V.Length/v.Length #compression
        
    if(x[0]*x[1]<0):
        FD=-FD
else:
    FD=1
    p=y.From
    q=y.To
    edge=rg.Line(p,q)
# ---------- end python_2 ----------

# ---- group: GET FIXED POINT
item_2 = ListItem(List=debrep_2.Faces, Index=Slider(0, range=0..10), Wrap=True)
item_3 = ListItem(List=debrep_2.Faces, Index=Slider(1, range=0..10), Wrap=True)
project_3 = Project(Curve=item_3, Brep=item_2, Direction=Vector(0, 0, 1))
debrep_4 = DeconstructBrep(Brep=item_2)  # -> Faces, Edges, Vertices
debrep_5 = DeconstructBrep(Brep=project_3)  # -> Faces, Edges, Vertices
pt_3 = Point(debrep_4.Vertices)
pt_4 = Point(debrep_5.Vertices)
project_4 = Project(Geometry=[pt_3, pt_4], Plane=PlaneXY(0, 0, 0))  # -> flatten(Geometry), Transform

# ---- group: 2D SELF STRESSED TRUSS TAG
X = UnitX(Factor=Slider(30, range=0..1000))
panel = Panel("""2D SELF STRESSED TRUSS STRUCTURE -
GRIDSHELL IN PLAN""")
move_2 = Move(Geometry=move.Geometry, Motion=X)  # -> Geometry, Transform
line_3 = Line(python_2.edge)
move_3 = Move(Geometry=project_4.Geometry, Motion=X)  # -> Geometry, Transform
move_4 = Move(Geometry=line_3, Motion=X)  # -> Geometry, Transform
tag_2 = TextTag(Location=move_2.Geometry, Text=panel)
expression = Expression(
    FD=flatten(python_2.FD),
    y=ColourSwatch(SwatchColor=RGB(224, 31, 31)),
    z=ColourSwatch(SwatchColor=RGB(49, 67, 204)),
    Expression="if(FD≥0,y,z)")
preview_2 = CustomPreview(Geometry=flatten(move_4.Geometry), Material=expression)

# ----
number_slider_6 = Slider(100, range=0..1000)
multiplication_2 = Multiplication(A=python_2.FD, B=number_slider_6)
avr = Average(Input=multiplication_2)
multiplication_3 = Multiplication(A=python_2.FD, B=number_slider_6)
avr_2 = Average(Input=multiplication_3)
multiplication_4 = Multiplication(A=avr, B=0.9)
Y_2 = UnitY(Factor=Slider(30, range=0..100))
# FORCE DENSITY METHOD
move_5 = Move(Geometry=project_4.Geometry, Motion=Y_2)  # -> Geometry, Transform
move_6 = Move(Geometry=python_2.edge, Motion=Y_2)  # -> Geometry, Transform
line_4 = Line(move_6.Geometry)
wbweave = WeaverbirdsMeshFromLinesWeaveBack(Lines=flatten(line_4), MaximumValence=4)
end_2 = EndPoints(Curve=line_4)  # -> Start, End
duppt = RemoveDuplicatePts(Points=flatten([end_2.Start, end_2.End]), Tolerance=0.01)

sort_pt = SortPoints(Points=duppt)  # -> Points, Indices
item_4 = ListItem(List=sort_pt.Points, Index=Slider(32, range=0..100), Wrap=True)
item_5 = ListItem(List=sort_pt.Points, Index=Slider(97, range=0..100), Wrap=True)
item_6 = ListItem(List=sort_pt.Points, Index=0, Wrap=True)
item_7 = ListItem(List=sort_pt.Points, Index=-1, Wrap=True)

area_2 = Area(Geometry=wbweave)  # -> Area, Centroid
pt_5 = Point(duppt)
lng = ListLength(List=pt_5)
multiplication_5 = Multiplication(A=Slider(4, range=0..10), B=area_2.Area)
num = Number("3.5")

# ---- group: Dimension
neg_2 = Negative(Value=Slider(0, range=0..1))
aligndim = AlignedDimension(
    Plane=PlaneXY(0, 0, 0),
    PointA=item_7,
    PointB=item_6,
    Offset=Slider(10, range=0..10),
    Text="{0:0.00}",
    Size=Slider(0.6, range=0..1))
aligndim_2 = AlignedDimension(Plane=PlaneXY(0, 0, 0), PointA=item_4, PointB=item_5, Offset=neg_2, Text="{0:0.00}", Size=Slider(0.6, range=0..1))

# ---- group: IMPORT GHPYTHON
panel_2 = Panel("""numpy
scipy
networkx
scipy.sparse""")
# FORCE DENSITY METHOD
panel_3 = Panel("C:\Users\nisha\anaconda3\envs\rhino_remote\python.exe")
pythonremote = GHPythonRemote(location=panel_3, run=Toggle(True), modules=panel_2)  # -> out, linked_modules, rpy, import_statements

# ---- group: TAG AND POINT FOR FINAL STRUCTURE
number_slider_7 = Slider(60, range=0..1000)
X_2 = UnitX(Factor=number_slider_7)
panel_4 = Panel("""FINAL GRIDSHELL FORM
Note: Red - Tension
Blue- Compression""")
move_7 = Move(FixPoints=project_4.Geometry, Motion=X_2)  # -> Geometry, Transform
move_8 = Move(Geometry=move.Geometry, Motion=X_2)  # -> Geometry, Transform
tag_3 = TextTag(Location=move_8.Geometry, Text=panel_4)

# ----
# MEMBER SIZING
X_3 = UnitX(Factor=Slider(450, range=0..1000))
X_4 = UnitX(Factor=Slider(590, range=0..1000))
X_5 = UnitX(Factor=Slider(60, range=0..100))
X_6 = UnitX(Factor=Slider(60, range=0..100))
X_7 = UnitX(Factor=Slider(80, range=0..100))
X_8 = UnitX(Factor=Slider(80, range=0..100))
matprops = MaterialPropertiesKaramba3D(
    FamilyOfMaterial="Mild Steel",
    Name="Fe250",
    YoungsModulus_kN_cm2="21000",
    InPlaneShearModulus_kN_cm2=8076,
    TransverseShearModulus_kN_cm2=8076,
    SpecificWeight_kN_m3="78.5",
    CoefficientOfThermalExpansion_1_C=1e-05,
    YieldStrength_kN_cm2="25",
    mode="Isotrop")
matprops_2 = MaterialPropertiesKaramba3D(
    FamilyOfMaterial="Mild Steel",
    Name="Fe250",
    YoungsModulus_kN_cm2="21000",
    InPlaneShearModulus_kN_cm2=8076,
    TransverseShearModulus_kN_cm2=8076,
    SpecificWeight_kN_m3="78.5",
    CoefficientOfThermalExpansion_1_C=1e-05,
    YieldStrength_kN_cm2="25",
    mode="Isotrop")
panel_5 = Panel("""ISNB40M
ISNB50M
ISNB65M
ISNB80M
ISNB90M
ISNB100M
ISNB110M""")
panel_6 = Panel("""ISNB50M
ISNB50M
ISNB65M
ISNB80M
ISNB90M
ISNB100M
ISNB110M""")
panel_7 = Panel("""0.32
0.36
0.36
0.4
0.4
0.45
0.48""")
panel_8 = Panel("""4.83
6.03
7.61
8.89
10.16
11.43
12.7""")
cross_section = CrossSectionKaramba3D(
    FamilyNameOfCrossSection="ISNB",
    NameOfCrossSection=panel_5,
    ElementIdentifier=panel_6,
    Material=matprops,
    Diameter_cm=panel_8,
    WallThickness_cm=panel_7,
    mode="Circular Hollow")
panel_9 = Panel("""ISNB40M
ISNB50M
ISNB65M
ISNB80M
ISNB90M
ISNB100M
ISNB110M""")
panel_10 = Panel("""ISNB50M
ISNB50M
ISNB65M
ISNB80M
ISNB90M
ISNB100M
ISNB110M""")
panel_11 = Panel("""0.32
0.36
0.36
0.4
0.4
0.45
0.48""")
panel_12 = Panel("""4.83
6.03
7.61
8.89
10.16
11.43
12.7""")
cross_section_2 = CrossSectionKaramba3D(
    FamilyNameOfCrossSection="ISNB",
    NameOfCrossSection=panel_9,
    ElementIdentifier=panel_10,
    Material=matprops_2,
    Diameter_cm=panel_12,
    WallThickness_cm=panel_11,
    mode="Circular Hollow")
gencstable = GenerateCrossSectionTableKaramba3D(CrossSections=cross_section)
gencstable_2 = GenerateCrossSectionTableKaramba3D(CrossSections=cross_section_2)
panel_13 = Panel(gencstable)
readcstable = ReadCrossSectionTableFromFileKaramba3D()  # -> CrossSection, Info
panel_14 = Panel(gencstable_2)
readcstable_2 = ReadCrossSectionTableFromFileKaramba3D()  # -> CrossSection, Info
b_forces = BeamForcesKaramba3D(LCase=-1, MaximumDistanceBetweenResults_m=-1, NumberOfResultsPerBeamElement=2)  # -> AnalyzedModel, NormalForce_kN, ShearForceVz_kN, ShearForceVy_kN, BendingMomentMt_kNm, BendingMomentMy_kNm, BendingMomentMz_kNm
number_slider_8 = Slider(5, range=0..10)

line_5 = Line(python_2.edge)
wbweave_2 = WeaverbirdsMeshFromLinesWeaveBack(Lines=flatten(line_5), MaximumValence=4)
end_3 = EndPoints(Curve=line_5)  # -> Start, End
duppt_2 = RemoveDuplicatePts(Points=flatten([end_3.Start, end_3.End]), Tolerance=0.01)
area_3 = Area(Geometry=wbweave_2)  # -> Area, Centroid
pt_6 = Point(duppt_2)
lng_2 = ListLength(List=pt_6)
multiplication_6 = Multiplication(A=Slider(4, range=0..10), B=area_3.Area)
num_2 = Number("3.5")

# ---- group: FORCE DENSITY METHOD SOLVER
neg_3 = Negative(Value=Slider(0.1, range=0..0.1))
end_4 = EndPoints(Curve=python_2.edge)  # -> Start, End
lng_3 = ListLength(List=multiplication_3)
fixed_points = Point(project_4.Geometry)
repeat = RepeatData(Data=avr_2, Length=lng_3)
python_3 = GhPythonScript(x=end_4.Start, y=end_4.End)  # -> flatten(array); inputs x: Point3d, y: Point3d
# ---------- python_3: Python ----------
import rhinoscriptsyntax as rs


array  = [ ((x[0],x[1]) , (y[0],y[1])) ]


print(array)
# ---------- end python_3 ----------
neg_4 = Negative(Value=Slider(0.4, range=0..1))
python_4 = GhPythonScript(x=fixed_points)  # -> aa; inputs x: list of Point3d
# ---------- python_4: Python ----------
import rhinoscriptsyntax as rs

#CONVERT GUID DATA TO RS POINT3D
a = []
for item in x:
    a.append(rs.coerce3dpoint(item))

# MAKE ARRAYS OF POINTS
aa=[]
for item in a:
    aa.append((item[0],item[1]))
# ---------- end python_4 ----------

# ----
lng_4 = ListLength(List=fixed_points)
subtraction = Subtraction(A=lng_2, B=lng_4)
division_3 = Division(A=multiplication_6, B=subtraction)

neg_5 = Negative(Value=division_3)

# ---- group: FORCE DENSITY METHOD SOLVER (continued)
solver = GhPythonScript(fxpt=flatten(python_4), x=flatten(python_3), q=multiplication_3, load=neg_5)  # -> Cr, Cf, x_ound, y_ound, z_found, fxpt, CON, fxpt_indx, rpt_indx, u; inputs fxpt: list, x: list, q: list
# ---------- solver: Python ----------
import ghpythonremote
import scriptcontext as sc
from ghpythonlib.treehelpers import list_to_tree
ssa = sc.sticky['scipy.sparse']
sci = sc.sticky['scipy']
np =sc.sticky['numpy']

lines = np.array(x)
lines = np.around(lines,decimals =4)
no_lines = len(lines)  # no_lines means no. of lines 

#get unique sets of points save them in matrix u and get indices in indices
lines = np.reshape(lines,(no_lines*2,2))
u,indices = np.unique(lines,return_inverse = True,axis = 0)
unqpt= np.unique(indices,return_inverse = False)
u_pt_len = len(indices)
#print ("length of u is",len(u))


# CREATE CONNNECTIVITY MATRIX.
row = np.repeat(np.arange(no_lines),repeats =2 )
col = indices
data = np.tile([1,-1],no_lines)
cols = len(u)
C = ssa.csc_matrix( (data,(row,col)), shape = (no_lines,cols) ).todense()
CON = C.copy()

#GET FIXED POINT INDEX FROM LIST OF UNIQUE POINTS
fxpt = np.array(fxpt)
fxpt = np.around(fxpt,decimals =4)
fxpt_id = np.lexsort((fxpt[:,1],fxpt[:,0]))
fxpt = fxpt[fxpt_id]
res = (u[:, None] == fxpt).all(-1).any(-1)
fxpt_indx = np.where(res)
rpt_indx = np.where(np.invert(res))


#print('FXPT_INDX' , fxpt_indx)
#print(fxpt)

#create Q and Qf matrix for fixed point and free point - connectivity matrices. 
Qf = C[:,fxpt_indx]
Cf = np.reshape(Qf,(Qf.shape[0],Qf.shape[2]))
Qr = C[:,rpt_indx]
Cr = np.reshape(Qr,(Qr.shape[0],Qr.shape[2]))
#Cr = np.delete(C, fxpt_indx, axis=1)
#print(Cr.shape)

#CREATE DIAGONAL FORCE DENSITY MATRIX
q=np.array(q)
q = np.around(q,decimals =4)
Q=np.diag(q)
#print('Q shape',Q.shape)

#CREATE POINT LOAD VECTORS 
p_x = np.zeros((len(u)-len(fxpt),1))
p_y = np.zeros((len(u)-len(fxpt),1))
p_z = np.full((len(u)-len(fxpt),1),load)
#np.tile(load,len(u)-len(fxpt))
#p_z = np.reshape(p_z,(p_z.shape[0],1))

#CREATE FIXED POINT CO-ORDINATE VECTORS
x_f = fxpt[:,0]
x_f = np.reshape(x_f,(x_f.shape[0],))
y_f = fxpt[:,1]
y_f = np.reshape(y_f,(y_f.shape[0],))
z_f=  np.full((x_f.shape[0],), 0)

print(C.shape)

#CREATE D AND D_F
D = Cr.T.dot(Q).dot(Cr)
D_f = Cr.T.dot(Q).dot(Cf)


#GET THE CO-ORDINATES
#print("OK TILL NOW2")

print(np.linalg.inv(D).dot(p_x))
x_ound = np.linalg.inv(D).dot(p_x - np.reshape(D_f.dot(x_f),(D_f.dot(x_f).shape[1],1)))
y_ound = np.linalg.inv(D).dot(p_y - np.reshape(D_f.dot(y_f),(D_f.dot(y_f).shape[1],1)))
z_found = np.linalg.inv(D).dot(p_z - np.reshape(D_f.dot(z_f),(D_f.dot(z_f).shape[1],1)))



print("ok")
# ---------- end solver ----------
python_5 = GhPythonScript(
    Cr=solver.Cr,
    Cf=solver.Cf,
    x=solver.x_ound,
    y=solver.y_ound,
    z=solver.z_found,
    fxpt=solver.fxpt,
    CON=solver.CON,
    fxpt_indx=solver.fxpt_indx,
    rpt_indx=solver.rpt_indx,
    u=solver.u)  # -> a, sptx, spty, sptz, eptx, epty, eptz
# ---------- python_5: Python ----------
import rhinoscriptsyntax as rs
import ghpythonremote
import scriptcontext as sc
from ghpythonlib.treehelpers import list_to_tree
ssa = sc.sticky['scipy.sparse']
sci = sc.sticky['scipy']
np =sc.sticky['numpy']
                
xx =np.array(x)
x=np.reshape(x,(len(x),1))
y = np.array(y)
y=np.reshape(y,(len(y),1))
z = np.array(z)
z = np.around(z,decimals=4)
z=np.reshape(z,(len(z),1))
        
xedo = np.zeros((len(fxpt),1))
fxpt = np.hstack((fxpt,xedo))
fxpt_id = np.lexsort((fxpt[:,1],fxpt[:,0]))
fxpt = fxpt[fxpt_id]
        
xyz=np.concatenate((x,y,z),axis=1)
#xyz= np.vstack((fxpt,xyz))
        
pt_num = len(fxpt)+len(x)
allpt = np.zeros((pt_num,3))
allpt[fxpt_indx] = fxpt
allpt[rpt_indx]=xyz

print(u)
xedo = np.zeros((len(u),1))
u = np.hstack((u,xedo))
print(fxpt)
print(fxpt_indx)
#print(allpt)
                
                
        
con =CON.copy()
#con = np.concatenate((Cf,Cr),axis =1)
cone =CON.copy()
                
con[con==1] =0
con[con==-1] = 1
spt = np.dot(con,allpt)
                
cone[cone==-1] =0
ept = np.dot(cone,allpt)
                
#PUSH DATA TO GRASSHOPPER TREE
sptx = ghpythonremote.obtain(spt[0:,0].tolist())
sptx =list_to_tree(sptx,source=[0,])
                
spty = ghpythonremote.obtain(spt[0:,1].tolist())
spty =list_to_tree(spty,source=[0,])
                
sptz = ghpythonremote.obtain(spt[0:,2].tolist())
sptz =list_to_tree(sptz,source=[0,])
                
eptx = ghpythonremote.obtain(ept[0:,0].tolist())
eptx =list_to_tree(eptx,source=[0,])
                
epty = ghpythonremote.obtain(ept[0:,1].tolist())
epty =list_to_tree(epty,source=[0,])
                
eptz = ghpythonremote.obtain(ept[0:,2].tolist())
eptz =list_to_tree(eptz,source=[0,])
# ---------- end python_5 ----------
pt_7 = ConstructPoint(XCoordinate=flatten(python_5.sptx), YCoordinate=flatten(python_5.spty), ZCoordinate=flatten(python_5.sptz))
pt_8 = ConstructPoint(XCoordinate=flatten(python_5.eptx), YCoordinate=flatten(python_5.epty), ZCoordinate=flatten(python_5.eptz))
ln_2 = Line(StartPoint=pt_7, EndPoint=pt_8)

# ----
hilonums = HighestLowestNumbers(Numbers=flatten([python_5.sptz, python_5.eptz]))  # -> Highest, Lowest
panel_15 = Panel(hilonums.Highest)

# ---- group: DISPLAY FINAL STRUCTURE WITH STRESSES
len = Length(Curve=ln_2)
multiplication_7 = Multiplication(A=multiplication_3, B=len)
number_slider_9 = Slider(100, range=0..100)
abs = Absolute(Value=multiplication_7)
division_4 = Division(A=abs, B=Slider(1000, range=0..1000))
pipe = Pipe(Curve=ln_2, Radius=division_4, Caps=0)
X_9 = UnitX(Factor=number_slider_7)
expression_2 = Expression(
    x=flatten(multiplication_7),
    y=ColourSwatch(SwatchColor=RGB(224, 31, 31)),
    z=ColourSwatch(SwatchColor=RGB(49, 67, 204)),
    Expression="if(x≥0,y,z)")
move_9 = Move(Geometry=pipe, Motion=X_9)  # -> Geometry, Transform
preview_3 = CustomPreview(Geometry=flatten(move_9.Geometry), Material=expression_2)

# ---- group: SHOW MEMBER CENTERLINE
# MEMBER SIZING
X_10 = UnitX(Factor=Slider(450, range=0..1000))
move_10 = Move(Geometry=ln_2, Motion=X_10)  # -> Geometry, Transform

# ---- group: SHOW FINAL POINTS
X_11 = UnitX(Factor=Slider(590, range=0..1000))
move_11 = Move(Geometry=[pt_7, pt_8], Motion=X_11)  # -> Geometry, Transform

# ----
midpt = CurveMiddle(Curve=ln_2)
len_2 = Length(Curve=ln_2)
move_12 = Move(Geometry=midpt, Motion=X_6)  # -> Geometry, Transform
multiplication_8 = Multiplication(A=len_2, B=abs)
roundd = RoundToDecimalPlace(NumberX=multiplication_7, DecimalPlace=Slider(2, range=0..10), RoundType=0)  # -> Rounded, Difference
ma = MassAddition(Input=multiplication_8)  # -> Result, PartialResults
panel_16 = Panel(ma.Result)
tag_4 = TextTag(Location=move_12.Geometry, Text=roundd.Rounded)
move_13 = Move(Geometry=ln_2, Motion=X_8)  # -> Geometry, Transform
end_5 = EndPoints(Curve=move_13.Geometry)  # -> Start, End
move_14 = Move(Geometry=fixed_points, Motion=X_8)  # -> Geometry, Transform
duppt_3 = RemoveDuplicatePts(Points=[end_5.Start, end_5.End], Tolerance=0.01)

end_6 = EndPoints(Curve=move_6.Geometry)  # -> Start, End
lng_5 = ListLength(List=multiplication_2)
fixed_points_2 = Point(move_5.Geometry)
repeat_2 = RepeatData(Data=multiplication_4, Length=lng_5)
python_6 = GhPythonScript(x=end_6.Start, y=end_6.End)  # -> flatten(array); inputs x: Point3d, y: Point3d; same code as python_3
python_7 = GhPythonScript(x=fixed_points_2)  # -> aa; inputs x: list of Point3d; same code as python_4

lng_6 = ListLength(List=fixed_points_2)
subtraction_2 = Subtraction(A=lng, B=lng_6)
division_5 = Division(A=multiplication_5, B=subtraction_2)
neg_6 = Negative(Value=division_5)

solver_2 = GhPythonScript(fxpt=flatten(python_7), x=flatten(python_6), q=repeat_2, load=neg_6)  # -> Cr, Cf, x_ound, y_ound, z_found, fxpt, CON, fxpt_indx, rpt_indx, u; inputs fxpt: list, x: list, q: list; same code as solver
python_8 = GhPythonScript(
    Cr=solver_2.Cr,
    Cf=solver_2.Cf,
    x=solver_2.x_ound,
    y=solver_2.y_ound,
    z=solver_2.z_found,
    fxpt=solver_2.fxpt,
    CON=solver_2.CON,
    fxpt_indx=solver_2.fxpt_indx,
    rpt_indx=solver_2.rpt_indx,
    u=solver_2.u)  # -> a, sptx, spty, sptz, eptx, epty, eptz; same code as python_5
pt_9 = ConstructPoint(XCoordinate=flatten(python_8.sptx), YCoordinate=flatten(python_8.spty), ZCoordinate=flatten(python_8.sptz))
pt_10 = ConstructPoint(XCoordinate=flatten(python_8.eptx), YCoordinate=flatten(python_8.epty), ZCoordinate=flatten(python_8.eptz))
ln_3 = Line(StartPoint=pt_9, EndPoint=pt_10)

hilonums_2 = HighestLowestNumbers(Numbers=flatten([python_8.sptz, python_8.eptz]))  # -> Highest, Lowest
panel_17 = Panel(hilonums_2.Highest)

len_3 = Length(Curve=ln_3)
multiplication_9 = Multiplication(A=repeat_2, B=len_3)
number_slider_10 = Slider(100, range=0..100)
abs_2 = Absolute(Value=multiplication_9)
division_6 = Division(A=abs_2, B=Slider(1000, range=0..1000))
pipe_2 = Pipe(Curve=ln_3, Radius=division_6, Caps=0)
X_12 = UnitX(Factor=number_slider_7)
expression_3 = Expression(
    x=flatten(multiplication_9),
    y=ColourSwatch(SwatchColor=RGB(224, 31, 31)),
    z=ColourSwatch(SwatchColor=RGB(49, 67, 204)),
    Expression="if(x≥0,y,z)")
move_15 = Move(Geometry=pipe_2, Motion=X_12)  # -> Geometry, Transform
preview_4 = CustomPreview(Geometry=flatten(move_15.Geometry), Material=expression_3)

move_16 = Move(Geometry=ln_3, Motion=X_3)  # -> Geometry, Transform
move_17 = Move(Geometry=[pt_9, pt_10], Motion=X_4)  # -> Geometry, Transform
midpt_2 = CurveMiddle(Curve=ln_3)
len_4 = Length(Curve=ln_3)
move_18 = Move(Geometry=fixed_points_2, Motion=X_12)  # -> Geometry, Transform
move_19 = Move(Geometry=midpt_2, Motion=X_5)  # -> Geometry, Transform
multiplication_10 = Multiplication(A=len_4, B=abs_2)
roundd_2 = RoundToDecimalPlace(NumberX=multiplication_9, DecimalPlace=Slider(2, range=0..10), RoundType=0)  # -> Rounded, Difference
ma_2 = MassAddition(Input=multiplication_10)  # -> Result, PartialResults
panel_18 = Panel(ma_2.Result)
tag_5 = TextTag(Location=move_19.Geometry, Text=roundd_2.Rounded)
move_20 = Move(Geometry=ln_3, Motion=X_7)  # -> Geometry, Transform
end_7 = EndPoints(Curve=move_20.Geometry)  # -> Start, End
move_21 = Move(Geometry=fixed_points_2, Motion=X_7)  # -> Geometry, Transform
duppt_4 = RemoveDuplicatePts(Points=[end_7.Start, end_7.End], Tolerance=0.01)

# ----
# KARAMBA MODEL
# KARAMBA OPTIMIZATION
upperchord_crv = Curve(move_20.Geometry)
supports_pt = Point(move_21.Geometry)
nodesq_pt = Point(duppt_4)
q_num = Number(division_5)
matselect = MaterialSelectionKaramba3D(menu=[dropdown(1), dropdown(2)])
Z = UnitZ(Factor=q_num)
crosecrselect = CrossSectionRangeSelectorKaramba3D(MaximumHeight_cm=-1, MaximumWidth_cm=-1, Material=matselect, menu=[dropdown(1), dropdown(2), dropdown(1)])
rev = Reverse(Vector=Z)
supp = SupportKaramba3D(PosInd=supports_pt, menu=[buttons(on, on, on, off, off, off)])
loads = LoadsKaramba3D(ForceVector=rev, Local=False, PosInd=nodesq_pt, LCase=0, mode="Point")
item_8 = ListItem(List=cross_section, Index=0, Wrap=True)
Y_3 = UnitY(Factor="0.001")
beam_joints = BeamJointsKaramba3D(
    ElementIdentifiers="Upper Chord",
    CtKNMAtStartingNode=Vector(0, 0, 0),
    CrKNmRadAtStartingNode=Y_3,
    CtKNMAtEndNode=Vector(0, 0, 0),
    CrKNmRadAtEndNode=Y_3,
    menu=[buttons(off, off, off, on, on, on), buttons(off, off, off, on, on, on)])
linetobeam = LineToBeamKaramba3D(Line=upperchord_crv, Identifier=graft("Upper Chord"), CrossSection=item_8, New=True, Remove=True, LimitDistance_m=0.005)  # -> Element, Points, Info
assemble = AssembleModelKaramba3D(Elem=flatten(linetobeam.Element), Support=flatten(supp), Load=flatten(loads), Joint=beam_joints, LimitDistance_m=0.005)  # -> Model, Info, Mass_kg, CenterOfGravity
analyze = AnalyzeKaramba3D(Model=assemble.Model)  # -> CalculatedModel, MaximumDisplacement_cm, ResultingForceOfGravity_kN, ElasticEnergy_kNm
modelview = ModelViewKaramba3D(Model=analyze.CalculatedModel, ResultFactors=1, ResultCase=-1)  # -> Model, DeformedMesh, DeformedAxes, DeformedModel
b_forces_2 = BeamForcesKaramba3D(AnalyzedModel=analyze.CalculatedModel, LCase=-1, MaximumDistanceBetweenResults_m=-1, NumberOfResultsPerBeamElement=2)  # -> AnalyzedModel, NormalForce_kN, ShearForceVz_kN, ShearForceVy_kN, BendingMomentMt_kNm, BendingMomentMy_kNm, BendingMomentMz_kNm
opticrosec = OptimizeCrossSectionKaramba3D(
    Model=assemble.Model,
    CrossSections=cross_section,
    MaximumUtilization=1,
    MaximumDisplacement_cm=-1,
    UltimateLimitStateIterations="1",
    DisplacementIterations=5,
    NumberOfSamplePoints=3,
    ElasticDesign=True,
    GammaM0=1,
    GammaM1=1)  # -> ModelWithOptimizedCrossSections, Info, Mass_kg, MaximumDisplacement_cm, ElasticEnergy_kNm
item_9 = ListItem(List=b_forces_2.NormalForce_kN, Index=0, Wrap=True)  # -> flatten(Item)
beamview = BeamViewKaramba3D(Model=modelview.Model)  # -> Model, MeshesOfRenderedBeams, DeformedBeamAxes, LegendColors, LegendTags
num_3 = Number(opticrosec.Mass_kg)
nodedisp = NodalDisplacementsKaramba3D(AnalyzedModel=modelview.Model, ResultCase=0)  # -> AnalyzedModel, NodalTranslations_m, NodalRotations_rad
modelview_2 = ModelViewKaramba3D(Model=opticrosec.ModelWithOptimizedCrossSections, ResultFactors=1, ResultCase=-1)  # -> Model, DeformedMesh, DeformedAxes, DeformedModel
curvepoint = PointOnCurve(beamview.DeformedBeamAxes, parameter=0.5)
roundd_3 = RoundToDecimalPlace(NumberX=item_9, DecimalPlace=Slider(2, range=0..10), RoundType=0)  # -> Rounded, Difference
tag_6 = TextTag(Location=curvepoint, Text=roundd_3.Rounded)
item_10 = ListItem(List=nodedisp.NodalTranslations_m, Index=Slider(41, range=0..100), Wrap=True)
panel_19 = Panel(item_10)

panel_20 = Panel(num_3)
b_res_force = BeamResultantForcesKaramba3D(AnalyzedModel=modelview_2.Model, LoadCase=-1, MaximumProbingDistance_m=-1, NumberOfProbingPointsPerElement=3)  # -> AnalyzedModel, NormalForce_kN, ResultantBendingMoment_kNm, ResultantShearForce_kN
b_forces_3 = BeamForcesKaramba3D(AnalyzedModel=modelview_2.Model, LCase=-1, MaximumDistanceBetweenResults_m=-1, NumberOfResultsPerBeamElement=2)  # -> AnalyzedModel, flatten(NormalForce_kN), ShearForceVz_kN, ShearForceVy_kN, BendingMomentMt_kNm, BendingMomentMy_kNm, BendingMomentMz_kNm
abs_3 = Absolute(Value=b_forces_3.NormalForce_kN)
devec = DeconstructVector(Vector=nodedisp.NodalTranslations_m)  # -> XComponent, YComponent, ZComponent
hilonums_3 = HighestLowestNumbers(Numbers=b_forces_3.NormalForce_kN)  # -> Highest, Lowest
hilonums_4 = HighestLowestNumbers(Numbers=abs_3)  # -> Highest, Lowest
hilonums_5 = HighestLowestNumbers(Numbers=devec.ZComponent)  # -> Highest, Lowest
emodes = EigenModesKaramba3D(Model=modelview_2.Model, FromIndex=1, NumberOfModes=number_slider_8, MaximumNumberOfIterations=300, Epsilon=1e-07)  # -> ModelWithEigenModesAsLoadCaseResults, Eigenvalues
nvibes = NaturalVibrationsKaramba3D(Model=modelview_2.Model, FromIndex=1, NumberOfModes=number_slider_8, MaximumNumberOfIterations=30, Epsilon=1e-05)  # -> ModelWithVibrationModesAsLoadCaseResults, NaturalFrequencies_Hz, ModalMass_kg, ParticipationFactorInGlobalXYAndZDirection
panel_21 = Panel([hilonums_3.Lowest, hilonums_3.Highest])
panel_22 = Panel([hilonums_4.Highest, hilonums_4.Lowest])
panel_23 = Panel(hilonums_5.Lowest)
panel_24 = Panel(nvibes.NaturalFrequencies_Hz)
panel_25 = Panel(nvibes.ParticipationFactorInGlobalXYAndZDirection)
division_7 = Division(A=Slider(1, range=0..1), B=panel_24)
panel_26 = Panel(division_7)

# ----
# KARAMBA MODEL
# KARAMBA OPTIMIZATION
upperchord_crv_2 = Curve(move_13.Geometry)
supports_pt_2 = Point(move_14.Geometry)
nodesq_pt_2 = Point(duppt_3)
q_num_2 = Number(division_3)
matselect_2 = MaterialSelectionKaramba3D(menu=[dropdown(1), dropdown(2)])
Z_2 = UnitZ(Factor=q_num_2)
rev_2 = Reverse(Vector=Z_2)
supp_2 = SupportKaramba3D(PosInd=supports_pt_2, menu=[buttons(off, off, on, off, off, off)])
item_11 = ListItem(List=cross_section_2, Index=0, Wrap=True)
Y_4 = UnitY(Factor="0.001")
beam_joints_2 = BeamJointsKaramba3D(
    ElementIdentifiers="Upper Chord",
    CtKNMAtStartingNode=Vector(0, 0, 0),
    CrKNmRadAtStartingNode=Y_4,
    CtKNMAtEndNode=Vector(0, 0, 0),
    CrKNmRadAtEndNode=Y_4,
    menu=[buttons(off, off, off, on, on, on), buttons(off, off, off, on, on, on)])

# ---- group: Cross Section Range Selector (Karamba3D)
crosecrselect_2 = CrossSectionRangeSelectorKaramba3D(MaximumHeight_cm=-1, MaximumWidth_cm=-1, Material=matselect_2, menu=[dropdown(1), dropdown(2), dropdown(1)])

# ---- group: Loads (Karamba3D)
loads_2 = LoadsKaramba3D(ForceVector=rev_2, Local=False, PosInd=nodesq_pt_2, LCase=0, mode="Point")

# ---- group: Line to Beam (Karamba3D)
linetobeam_2 = LineToBeamKaramba3D(
    Line=upperchord_crv_2,
    Identifier=graft("Upper Chord"),
    CrossSection=item_11,
    New=True,
    Remove=True,
    LimitDistance_m=0.005)  # -> Element, Points, Info

# ---- group: Assemble Model (Karamba3D)
assemble_2 = AssembleModelKaramba3D(
    Elem=flatten(linetobeam_2.Element),
    Support=flatten(supp_2),
    Load=flatten(loads_2),
    Joint=beam_joints_2,
    LimitDistance_m=0.005)  # -> Model, Info, Mass_kg, CenterOfGravity

# ---- group: Analyze (Karamba3D)
analyze_2 = AnalyzeKaramba3D(Model=assemble_2.Model)  # -> CalculatedModel, MaximumDisplacement_cm, ResultingForceOfGravity_kN, ElasticEnergy_kNm

# ---- group: Model View (Karamba3D)
modelview_3 = ModelViewKaramba3D(Model=analyze_2.CalculatedModel, ResultFactors=1, ResultCase=-1)  # -> Model, DeformedMesh, DeformedAxes, DeformedModel

# ---- group: Optimize Cross Section (Karamba3D)
opticrosec_2 = OptimizeCrossSectionKaramba3D(
    Model=assemble_2.Model,
    CrossSections=cross_section_2,
    MaximumUtilization=1,
    MaximumDisplacement_cm=-1,
    UltimateLimitStateIterations="1",
    DisplacementIterations=5,
    NumberOfSamplePoints=3,
    ElasticDesign=True,
    GammaM0=1,
    GammaM1=1)  # -> ModelWithOptimizedCrossSections, Info, Mass_kg, MaximumDisplacement_cm, ElasticEnergy_kNm

# ---- group: Beam View (Karamba3D)
beamview_2 = BeamViewKaramba3D(Model=modelview_3.Model)  # -> Model, MeshesOfRenderedBeams, DeformedBeamAxes, LegendColors, LegendTags

# ----
b_forces_4 = BeamForcesKaramba3D(AnalyzedModel=analyze_2.CalculatedModel, LCase=-1, MaximumDistanceBetweenResults_m=-1, NumberOfResultsPerBeamElement=2)  # -> AnalyzedModel, NormalForce_kN, ShearForceVz_kN, ShearForceVy_kN, BendingMomentMt_kNm, BendingMomentMy_kNm, BendingMomentMz_kNm
item_12 = ListItem(List=b_forces_4.NormalForce_kN, Index=0, Wrap=True)  # -> flatten(Item)
num_4 = Number(opticrosec_2.Mass_kg)
nodedisp_2 = NodalDisplacementsKaramba3D(AnalyzedModel=modelview_3.Model, ResultCase=0)  # -> AnalyzedModel, NodalTranslations_m, NodalRotations_rad
curvepoint_2 = PointOnCurve(beamview_2.DeformedBeamAxes, parameter=0.5)
roundd_4 = RoundToDecimalPlace(NumberX=item_12, DecimalPlace=Slider(2, range=0..10), RoundType=0)  # -> Rounded, Difference
tag_7 = TextTag(Location=curvepoint_2, Text=roundd_4.Rounded)
item_13 = ListItem(List=nodedisp_2.NodalTranslations_m, Index=Slider(41, range=0..100), Wrap=True)
panel_27 = Panel(item_13)

# ---- group: Model View (Karamba3D)
modelview_4 = ModelViewKaramba3D(Model=opticrosec_2.ModelWithOptimizedCrossSections, ResultFactors=1, ResultCase=-1)  # -> Model, DeformedMesh, DeformedAxes, DeformedModel

# ----
panel_28 = Panel(num_4)
b_res_force_2 = BeamResultantForcesKaramba3D(AnalyzedModel=modelview_4.Model, LoadCase=-1, MaximumProbingDistance_m=-1, NumberOfProbingPointsPerElement=3)  # -> AnalyzedModel, NormalForce_kN, ResultantBendingMoment_kNm, ResultantShearForce_kN
abs_4 = Absolute(Value=b_res_force_2.NormalForce_kN)
devec_2 = DeconstructVector(Vector=nodedisp_2.NodalTranslations_m)  # -> XComponent, YComponent, ZComponent
hilonums_6 = HighestLowestNumbers(Numbers=b_res_force_2.NormalForce_kN)  # -> Highest, Lowest
hilonums_7 = HighestLowestNumbers(Numbers=abs_4)  # -> Highest, Lowest
hilonums_8 = HighestLowestNumbers(Numbers=devec_2.ZComponent)  # -> Highest, Lowest
nvibes_2 = NaturalVibrationsKaramba3D(Model=modelview_4.Model, FromIndex=1, NumberOfModes=Slider(5, range=0..10), MaximumNumberOfIterations=30, Epsilon=1e-05)  # -> ModelWithVibrationModesAsLoadCaseResults, NaturalFrequencies_Hz, ModalMass_kg, ParticipationFactorInGlobalXYAndZDirection
panel_29 = Panel([hilonums_6.Lowest, hilonums_6.Highest])
panel_30 = Panel([hilonums_7.Highest, hilonums_7.Lowest])
panel_31 = Panel(hilonums_8.Lowest)
panel_32 = Panel(nvibes_2.NaturalFrequencies_Hz)
panel_33 = Panel(nvibes_2.ParticipationFactorInGlobalXYAndZDirection)
division_8 = Division(A=Slider(1, range=0..1), B=panel_32)
panel_34 = Panel(division_8)

# ==== cluster GHPythonRemote: Connects the Grasshopper Python component to an external Python instance.
python = PythonScript()  # -> gh_parent_doc_dir
# ---------- python: Python ----------
from os import path

gh_parent_doc_dir = path.abspath(path.dirname(ghenv.Component.OnPingDocument().Owner.OnPingDocument().FilePath))
# ---------- end python ----------
# GH to python remote example.
# Pierre Cuvilliers, 2017-2018
# Released under the MIT license
# github.com/pilcru/ghpythonremote
# Runs and connects to an external python engine, and
# assigns imported modules to scriptcontext.sticky variables.
# 
# Arguments:
#       code (str): Path to the GH_to_python_sticky.py code file.
#       location (str): Path to a python executable, or to a folder
#             containing `python.exe`, or the name of a conda-created
#             virtual environment prefixed by `conda://` (`conda://env_name`).
#             If empty, finds python from your windows %PATH%.
#       run (boolean): Creates the connection, and imports new
#             modules, when turned to True. Kills the connection,
#             and deletes the references to the imports, when turned
#             to False.
#       modules (str list): List of module names to import in the
#             remote python. They will be added to the
#             scriptcontext.sticky dictionary, allowing them to be
#             reused from other python components in the same
#             Grasshopper document. Submodules (for example
#             `numpy.linalg` have to be added explicitly to this list
#             to be available later.
#       log_level (str from ['NOTSET', 'DEBUG', 'INFO', 'WARNING', 'ERROR', 'CRITICAL']):
#             Logging level to use for the local IronPython and the
#             remote python instance.
#       working_dir (str): Working directory for the remote python
#             instance.
# 
# Returns:
#       out (str): Console output with DEBUG information.
#       linked_modules (str list): list of imported module names.
#       rpy (rpyc connection object): The object representing the
#             remote Python interpreter.
location = ClusterInput()  # location (str): Path to a python executable, or to a folder containing `python.exe`, or the name of a conda-created virtual environment prefixed by `conda://` (`conda://env_name`). If empty, finds python from your windows %PATH%.
run = ClusterInput()  # run (boolean): Creates the connection, and imports new modules, when turned to True. Kills the connection,and deletes the references to the imports, when turned to False.
modules = ClusterInput()  # modules (str list): List of module names to import in the remote python. They will be added to the scriptcontext.sticky dictionary, allowing them to be reused from other python components in the same Grasshopper document. Submodules (for example `numpy.linalg` have to be added explicitly to this list to be available later.
list = ValueList({"CRITICAL", "ERROR", "WARNING", "INFO", "DEBUG", "NOTSET"}, selected="DEBUG")
panel = Panel(python)
ghpythonremote = GHPythonRemote(location=location, run=run, modules=modules, log_level=list, working_dir=panel)  # -> out, linked_modules, rpy; inputs run: Boolean, modules: list
# ---------- ghpythonremote: Python ----------
import inspect
import logging
from os import path
import sys
from time import sleep

import scriptcontext

import ghpythonremote
from ghpythonremote.connectors import GrasshopperToPythonRemote

local_log_level = getattr(logging, log_level, logging.WARNING)
logger = logging.getLogger("ghpythonremote")
logger.setLevel(local_log_level)
ch = logging.StreamHandler()
ch.setLevel(local_log_level)
formatter = logging.Formatter("%(levelname)s: %(name)s:\n%(message)s")
ch.setFormatter(formatter)
logger.handlers = []
logger.addHandler(ch)
logger = logging.getLogger("ghpythonremote.GH_to_python")

ROOT = path.abspath(path.dirname(inspect.getfile(ghpythonremote)))
rpyc_server_py = path.join(ROOT, "pythonservice.py")

# Set connection to CLOSED if this is the first run
# and initialize set of linked modules
try:
    remote_python_status
except NameError:
    remote_python_status = "CLOSED"
    lkd_modules = set()

# Wait for connection to connect or terminate
timer = 0
while remote_python_status == "CONNECTING" or remote_python_status == "CLOSING":
    sleep(1)
    timer += 1
    if timer == 10:
        try:
            gh2py_manager.__exit__(*sys.exc_info())
        except Exception:
            pass
        remote_python_status = "CLOSED"
        lkd_modules = set()
        raise RuntimeError(
            "Connection left in an inconsistent state and not returning. Reset "
            "everything."
        )

if run:
    if not remote_python_status == "OPEN":
        remote_python_status = "CONNECTING"
        gh2py_manager = GrasshopperToPythonRemote(
            rpyc_server_py,
            location=location,
            timeout=10,
            port=None,
            log_level=log_level,
            working_dir=working_dir,
        )
        gh2py = gh2py_manager.__enter__()
        remote_python_status = "OPEN"

    # Stuff that we can reach
    rpymod = gh2py.py_remote_modules  # A getter function for a named python module
    rpy = gh2py.connection  # Represents the remote instance root object
    scriptcontext.sticky["rpy"] = rpy
    # Add modules
    for mod in modules:
        try:
            scriptcontext.sticky[mod] = rpymod(mod)
            lkd_modules.add(mod)
        except ImportError:
            gh2py_manager.__exit__(*sys.exc_info())
            raise

elif not remote_python_status == "CLOSED":
    remote_python_status = "CLOSING"
    # Remove linked modules
    for mod in lkd_modules:
        del scriptcontext.sticky[mod]
    del scriptcontext.sticky["rpy"]
    gh2py_manager.__exit__(*sys.exc_info())
    lkd_modules = set()
    remote_python_status = "CLOSED"

# Change variable name because ghpython resets outputs to None before each run
linked_modules = lkd_modules

logger.info("GH to python connection is {}".format(remote_python_status))
# ---------- end ghpythonremote ----------
out = ClusterOutput(ghpythonremote.out)  # Console output.
linked_modules = ClusterOutput(ghpythonremote.linked_modules)  # Names of modules that were successfully added to the scriptcontext.sticky dictionary.
rpy = ClusterOutput(ghpythonremote.rpy)  # The object representing the remote python instance
python_2 = PythonScript(module_names=ghpythonremote.linked_modules)  # -> import_statements; inputs module_names: list
# ---------- python_2: Python ----------
import_statements = ["import scriptcontext as sc"]
for module_name in module_names:
    import_statements.append("{0} = sc.sticky['{0}']".format(module_name))

if len(module_names) == 0:
    import_statements = []
# ---------- end python_2 ----------
import_statements = ClusterOutput(python_2)  # Useful import statements to use the imported modules in your scripts.
