# Grasshopper definition circle with orifice.gh (Grasshopper 1.0.7)
# Copyright: © 2017-2018 Pierre Cuvilliers, Caitlin Mueller, Massachusetts Institute of Technology
# plug-ins: LunchBox

# ---- group: CONSTRUCT AIRY STRESS SURFACE
pi = Pi(Factor=1)
number_slider = Slider(40, range=0..100)
pi_2 = Pi(Factor=1)
yz = YZPlane(Origin=Point(0, 0, 0))
division = Division(A=pi, B=Slider(4, range=0..100))
division_2 = Division(A=pi_2, B=Slider(2.5, range=0..10))
dom = ConstructDomain(DomainStart=Slider(0, range=0..100), DomainEnd=division_2)
arc = Arc(Plane=yz, Radius=number_slider, Angle=dom)  # -> Arc, Length
pt = ConstructPoint(XCoordinate=0, YCoordinate=0, ZCoordinate=0)
end = EndPoints(Curve=arc.Arc)  # -> Start, End
ln = Line(StartPoint=end.Start, EndPoint=end.End)
line = LineSDL(Start=pt, Direction=Vector(0, 0, 1), Length=Slider(100, range=0..100))
rotate = Rotate(Geometry=arc.Arc, Angle=3.141592654, Plane=ln)  # -> Geometry, Transform
revsrf = Revolution(Curve=rotate.Geometry, Axis=line, Domain=Domain(0, 6.283185307))

# ---- group: AIRY STRESS TAG
multiplication = Multiplication(A=number_slider, B=2)
neg = Negative(Value=multiplication)
airy_stress_tag = Panel("""AIRY STRESS FUNCTION :
Constructed by User""")
Y = UnitY(Factor=neg)
move = Move(Geometry=pt, Motion=Y)  # -> Geometry, Transform
tag = TextTag(Location=move.Geometry, Text=airy_stress_tag)

# ---- group: AIRY STRESS SURFACE DISCRETIZATION
number_slider_2 = Slider(10, range=0..100)
number_slider_3 = Slider(20, range=0..100)
diamond = DiamondPanels(Surface=revsrf, UDivisions=number_slider_3, VDivisions=number_slider_2)  # -> DiamondPanels, TriPanels
quads = QuadPanels(Surface=revsrf, UDivisions=number_slider_3, VDivisions=number_slider_2)
# AIRY STRESS FORMULATION
trib = TrianglePanelsB(Surface=revsrf, UDivisions=number_slider_3, VDivisions=number_slider_2)
tric = TrianglePanelsC(Surface=revsrf, UDivisions=number_slider_3, VDivisions=number_slider_2)
join = BrepJoin(Breps=quads)  # -> Breps, Closed
brep = Brep([diamond.DiamondPanels, diamond.TriPanels])
debrep = DeconstructBrep(Brep=join.Breps)  # -> Faces, Edges, Vertices
join_2 = BrepJoin(Breps=debrep.Faces)  # -> Breps, Closed
cap = CapHoles(Brep=join_2.Breps)
debrep_2 = DeconstructBrep(Brep=cap)  # -> Faces, Edges, Vertices
join_3 = BrepJoin(Breps=debrep_2.Faces)  # -> Breps, Closed

# ----
airy_stress_function = Brep(join_3.Breps)
# CALULATION OF FORCE DENSITIES
python = GhPythonScript(x=airy_stress_function)  # -> out, a; inputs x: Brep
# ---------- python: Python ----------
x.Repair(0.000001)
print x.IsSolid
print x.IsManifold
print x.IsValid
a=x
# ---------- end python ----------
preview = CustomPreview(
    Geometry=python.a,
    Material={diffuse=RGB(221, 160, 221), emission=RGB(66, 48, 66), shine=0.5, specular=RGB(255, 255, 255), transparency=0})
topology = BrepTopology(Brep=python.a, PerspectiveOnly=False)  # -> FaceFaceAdjacency, FaceEdgeAdjacency, EdgeFaceAdjacency
debrep_3 = DeconstructBrep(Brep=python.a)  # -> Faces, simplify(graft(Edges)), Vertices
item = ListItem(List=debrep_3.Faces, Index=topology.EdgeFaceAdjacency, Wrap=True)  # -> simplify(Item)
md_slider = MDSlider(SliderMode=0, slider_value=Point(0.5, 0.5, 0.5), x_domain=Domain(0, 1), y_domain=Domain(0, 1), z_domain=Domain(0, 1))
area = Area(Geometry=item)  # -> Area, Centroid
srf = Surface(reparameterize(item))
project = Project(Geometry=debrep_3.Edges, Plane=PlaneXY(0, 0, 0))  # -> Geometry, Transform
project_2 = Project(Geometry=area.Centroid, Plane=PlaneXY(0, 0, 0))  # -> Geometry, Transform
evalsrf = EvaluateSurface(Surface=srf, Point=md_slider)  # -> Point, Normal, UDirection, VDirection, Frame
python_2 = PythonScript(x=evalsrf.Normal, y=project.Geometry, z=project_2.Geometry, u=area.Area)  # -> out, flatten(FD), edge, d; inputs x: list of Vector3d, y: Line, z: list of Point3d, u: list
# ---------- python_2: Python ----------
import Rhino.Geometry as rg
import math
a=[]
M=(y.From+y.To)/2
c=[]
forcediagramC=[]
forcediagramT=[]
d=[]
if len(x)==2:
    N1=x[0]
    N2=x[1]
    
    N1=N1/N1.Z
    N2=N2/N2.Z
    P=rg.Point3d(N1.X,N1.Y,0)
    Q=rg.Point3d(N2.X,N2.Y,0)
    c.append(P)
    c.append(Q)
    V=P-Q
    if(V.Length<0.0001):
        print P,Q
    d.append(rg.Line(P,Q))
    p=y.From
    q=y.To
    edge=rg.Line(p,q)
    p=rg.Point3d(p.X,p.Y,0)
    q=rg.Point3d(q.X,q.Y,0)
    v=p-q
    #V.Unitize()
    #v.Unitize()
    #print V*v
    pp=z[0]
    qq=z[1]
    X=rg.Transform.Rotation(rg.Vector3d(1,0,0),rg.Vector3d(0,1,0),p)
    p.Transform(X)
    q.Transform(X)
    v=p-q
    if v*(pp-qq)<0:
        v.Reverse()

    if v*V>0:
        FD=-V.Length/v.Length #tension, negative because of inverted vertical loads
    else:
        FD=V.Length/v.Length #compression
        
    if(x[0]*x[1]<0):
        FD=-FD
else:
    FD=1
    p=y.From
    q=y.To
    edge=rg.Line(p,q)
# ---------- end python_2 ----------

# ---- group: GET FIXED POINT
item_2 = ListItem(List=debrep_2.Faces, Index=Slider(0, range=0..10), Wrap=True)
item_3 = ListItem(List=debrep_2.Faces, Index=Slider(1, range=0..10), Wrap=True)
project_3 = Project(Curve=item_3, Brep=item_2, Direction=Vector(0, 0, 1))
debrep_4 = DeconstructBrep(Brep=item_2)  # -> Faces, Edges, Vertices
debrep_5 = DeconstructBrep(Brep=project_3)  # -> Faces, Edges, Vertices
pt_2 = Point(debrep_4.Vertices)
pt_3 = Point(debrep_5.Vertices)
project_4 = Project(Geometry=[pt_2, pt_3], Plane=PlaneXY(0, 0, 0))  # -> flatten(Geometry), Transform

# ----
line_2 = Line(python_2.edge)

# ---- group: 2D SELF STRESSED TRUSS TAG
X = UnitX(Factor=Slider(100, range=0..1000))
panel = Panel("""2D SELF STRESSED TRUSS STRUCTURE -
GRIDSHELL IN PLAN""")
move_2 = Move(Geometry=move.Geometry, Motion=X)  # -> Geometry, Transform
move_3 = Move(Geometry=project_4.Geometry, Motion=X)  # -> Geometry, Transform
move_4 = Move(Geometry=line_2, Motion=X)  # -> Geometry, Transform
tag_2 = TextTag(Location=move_2.Geometry, Text=panel)
expression = Expression(
    FD=flatten(python_2.FD),
    y=ColourSwatch(SwatchColor=RGB(224, 31, 31)),
    z=ColourSwatch(SwatchColor=RGB(49, 67, 204)),
    Expression="if(FD≥0,y,z)")
preview_2 = CustomPreview(Geometry=flatten(move_4.Geometry), Material=expression)

# ---- group: FORCE DENSITY METHOD SOLVER
neg_2 = Negative(Value=Slider(0.1, range=0..0.1))
lng = ListLength(List=python_2.FD)
end_2 = EndPoints(Curve=python_2.edge)  # -> Start, End
fixed_points = Point(project_4.Geometry)
multiplication_2 = Multiplication(A=python_2.FD, B=Slider(4, range=0..10))
python_3 = GhPythonScript(x=end_2.Start, y=end_2.End)  # -> flatten(array); inputs x: Point3d, y: Point3d
# ---------- python_3: Python ----------
import rhinoscriptsyntax as rs


array  = [ ((x[0],x[1]) , (y[0],y[1])) ]


print(array)
# ---------- end python_3 ----------
repeat = RepeatData(Data=neg_2, Length=lng)
neg_3 = Negative(Value=Slider(0.4, range=0..1))
python_4 = GhPythonScript(x=fixed_points)  # -> aa; inputs x: list of Point3d
# ---------- python_4: Python ----------
import rhinoscriptsyntax as rs

#CONVERT GUID DATA TO RS POINT3D
a = []
for item in x:
    a.append(rs.coerce3dpoint(item))

# MAKE ARRAYS OF POINTS
aa=[]
for item in a:
    aa.append((item[0],item[1]))
# ---------- end python_4 ----------
solver = GhPythonScript(fxpt=flatten(python_4), x=flatten(python_3), q=multiplication_2, load=neg_3)  # -> Cr, Cf, x_ound, y_ound, z_found, fxpt, CON, fxpt_indx, rpt_indx, u; inputs fxpt: list, x: list, q: list
# ---------- solver: Python ----------
import ghpythonremote
import scriptcontext as sc
from ghpythonlib.treehelpers import list_to_tree
ssa = sc.sticky['scipy.sparse']
sci = sc.sticky['scipy']
np =sc.sticky['numpy']

lines = np.array(x)
lines = np.around(lines,decimals =4)
no_lines = len(lines)  # no_lines means no. of lines 

#get unique sets of points save them in matrix u and get indices in indices
lines = np.reshape(lines,(no_lines*2,2))
u,indices = np.unique(lines,return_inverse = True,axis = 0)
unqpt= np.unique(indices,return_inverse = False)
u_pt_len = len(indices)
#print ("length of u is",len(u))


# CREATE CONNNECTIVITY MATRIX.
row = np.repeat(np.arange(no_lines),repeats =2 )
col = indices
data = np.tile([1,-1],no_lines)
cols = len(u)
C = ssa.csc_matrix( (data,(row,col)), shape = (no_lines,cols) ).todense()
CON = C.copy()

#GET FIXED POINT INDEX FROM LIST OF UNIQUE POINTS
fxpt = np.array(fxpt)
fxpt = np.around(fxpt,decimals =4)
fxpt_id = np.lexsort((fxpt[:,1],fxpt[:,0]))
fxpt = fxpt[fxpt_id]
res = (u[:, None] == fxpt).all(-1).any(-1)
fxpt_indx = np.where(res)
rpt_indx = np.where(np.invert(res))


#print('FXPT_INDX' , fxpt_indx)
#print(fxpt)

#create Q and Qf matrix for fixed point and free point - connectivity matrices. 
Qf = C[:,fxpt_indx]
Cf = np.reshape(Qf,(Qf.shape[0],Qf.shape[2]))
Qr = C[:,rpt_indx]
Cr = np.reshape(Qr,(Qr.shape[0],Qr.shape[2]))
#Cr = np.delete(C, fxpt_indx, axis=1)
#print(Cr.shape)

#CREATE DIAGONAL FORCE DENSITY MATRIX
q=np.array(q)
q = np.around(q,decimals =4)
Q=np.diag(q)
#print('Q shape',Q.shape)

#CREATE POINT LOAD VECTORS 
p_x = np.zeros((len(u)-len(fxpt),1))
p_y = np.zeros((len(u)-len(fxpt),1))
p_z = np.full((len(u)-len(fxpt),1),load)
#np.tile(load,len(u)-len(fxpt))
#p_z = np.reshape(p_z,(p_z.shape[0],1))

#CREATE FIXED POINT CO-ORDINATE VECTORS
x_f = fxpt[:,0]
x_f = np.reshape(x_f,(x_f.shape[0],))
y_f = fxpt[:,1]
y_f = np.reshape(y_f,(y_f.shape[0],))
z_f=  np.full((x_f.shape[0],), 0)

print(C.shape)

#CREATE D AND D_F
D = Cr.T.dot(Q).dot(Cr)
D_f = Cr.T.dot(Q).dot(Cf)


#GET THE CO-ORDINATES
#print("OK TILL NOW2")

print(np.linalg.inv(D).dot(p_x))
x_ound = np.linalg.inv(D).dot(p_x - np.reshape(D_f.dot(x_f),(D_f.dot(x_f).shape[1],1)))
y_ound = np.linalg.inv(D).dot(p_y - np.reshape(D_f.dot(y_f),(D_f.dot(y_f).shape[1],1)))
z_found = np.linalg.inv(D).dot(p_z - np.reshape(D_f.dot(z_f),(D_f.dot(z_f).shape[1],1)))



print("ok")
# ---------- end solver ----------
python_5 = GhPythonScript(
    Cr=solver.Cr,
    Cf=solver.Cf,
    x=solver.x_ound,
    y=solver.y_ound,
    z=solver.z_found,
    fxpt=solver.fxpt,
    CON=solver.CON,
    fxpt_indx=solver.fxpt_indx,
    rpt_indx=solver.rpt_indx,
    u=solver.u)  # -> a, sptx, spty, sptz, eptx, epty, eptz
# ---------- python_5: Python ----------
import rhinoscriptsyntax as rs
import ghpythonremote
import scriptcontext as sc
from ghpythonlib.treehelpers import list_to_tree
ssa = sc.sticky['scipy.sparse']
sci = sc.sticky['scipy']
np =sc.sticky['numpy']
                
xx =np.array(x)
x=np.reshape(x,(len(x),1))
y = np.array(y)
y=np.reshape(y,(len(y),1))
z = np.array(z)
z = np.around(z,decimals=4)
z=np.reshape(z,(len(z),1))
        
xedo = np.zeros((len(fxpt),1))
fxpt = np.hstack((fxpt,xedo))
fxpt_id = np.lexsort((fxpt[:,1],fxpt[:,0]))
fxpt = fxpt[fxpt_id]
        
xyz=np.concatenate((x,y,z),axis=1)
#xyz= np.vstack((fxpt,xyz))
        
pt_num = len(fxpt)+len(x)
allpt = np.zeros((pt_num,3))
allpt[fxpt_indx] = fxpt
allpt[rpt_indx]=xyz

print(u)
xedo = np.zeros((len(u),1))
u = np.hstack((u,xedo))
print(fxpt)
print(fxpt_indx)
#print(allpt)
                
                
        
con =CON.copy()
#con = np.concatenate((Cf,Cr),axis =1)
cone =CON.copy()
                
con[con==1] =0
con[con==-1] = 1
spt = np.dot(con,allpt)
                
cone[cone==-1] =0
ept = np.dot(cone,allpt)
                
#PUSH DATA TO GRASSHOPPER TREE
sptx = ghpythonremote.obtain(spt[0:,0].tolist())
sptx =list_to_tree(sptx,source=[0,])
                
spty = ghpythonremote.obtain(spt[0:,1].tolist())
spty =list_to_tree(spty,source=[0,])
                
sptz = ghpythonremote.obtain(spt[0:,2].tolist())
sptz =list_to_tree(sptz,source=[0,])
                
eptx = ghpythonremote.obtain(ept[0:,0].tolist())
eptx =list_to_tree(eptx,source=[0,])
                
epty = ghpythonremote.obtain(ept[0:,1].tolist())
epty =list_to_tree(epty,source=[0,])
                
eptz = ghpythonremote.obtain(ept[0:,2].tolist())
eptz =list_to_tree(eptz,source=[0,])
# ---------- end python_5 ----------
pt_4 = ConstructPoint(XCoordinate=flatten(python_5.sptx), YCoordinate=flatten(python_5.spty), ZCoordinate=flatten(python_5.sptz))
pt_5 = ConstructPoint(XCoordinate=flatten(python_5.eptx), YCoordinate=flatten(python_5.epty), ZCoordinate=flatten(python_5.eptz))
ln_2 = Line(StartPoint=pt_4, EndPoint=pt_5)

# ---- group: IMPORT GHPYTHON
panel_2 = Panel("""numpy
scipy
networkx
scipy.sparse""")
# FORCE DENSITY METHOD
panel_3 = Panel("C:\Users\nisha\anaconda3\envs\rhino_remote\python.exe")
pythonremote = GHPythonRemote(location=panel_3, run=Toggle(True), modules=panel_2)  # -> out, linked_modules, rpy, import_statements

# ---- group: TAG AND POINT FOR FINAL STRUCTURE
number_slider_4 = Slider(200, range=0..1000)
X_2 = UnitX(Factor=number_slider_4)
panel_4 = Panel("""FINAL GRIDSHELL FORM
Note: Red - Tension
Blue- Compression""")
move_5 = Move(FixPoints=project_4.Geometry, Motion=X_2)  # -> Geometry, Transform
move_6 = Move(Geometry=move.Geometry, Motion=X_2)  # -> Geometry, Transform
tag_3 = TextTag(Location=move_6.Geometry, Text=panel_4)

# ---- group: DISPLAY FINAL STRUCTURE WITH STRESSES
len = Length(Curve=ln_2)
multiplication_3 = Multiplication(A=multiplication_2, B=len)
abs = Absolute(Value=multiplication_3)
division_3 = Division(A=abs, B=Slider(100, range=0..100))
pipe = Pipe(Curve=ln_2, Radius=division_3, Caps=0)
X_3 = UnitX(Factor=number_slider_4)
expression_2 = Expression(
    x=flatten(multiplication_3),
    y=ColourSwatch(SwatchColor=RGB(224, 31, 31)),
    z=ColourSwatch(SwatchColor=RGB(49, 67, 204)),
    Expression="if(x≥0,y,z)")
move_7 = Move(Geometry=pipe, Motion=X_3)  # -> Geometry, Transform
preview_3 = CustomPreview(Geometry=flatten(move_7.Geometry), Material=expression_2)

# ---- group: SHOW MEMBER CENTERLINE
# MEMBER SIZING
number_slider_5 = Slider(450, range=0..1000)
X_4 = UnitX(Factor=number_slider_5)
move_8 = Move(Geometry=ln_2, Motion=X_4)  # -> Geometry, Transform

# ---- group: SHOW FINAL POINTS
X_5 = UnitX(Factor=Slider(590, range=0..1000))
move_9 = Move(Geometry=[pt_4, pt_5], Motion=X_5)  # -> Geometry, Transform

# ==== cluster GHPythonRemote: Connects the Grasshopper Python component to an external Python instance.
python = PythonScript()  # -> gh_parent_doc_dir
# ---------- python: Python ----------
from os import path

gh_parent_doc_dir = path.abspath(path.dirname(ghenv.Component.OnPingDocument().Owner.OnPingDocument().FilePath))
# ---------- end python ----------
# GH to python remote example.
# Pierre Cuvilliers, 2017-2018
# Released under the MIT license
# github.com/pilcru/ghpythonremote
# Runs and connects to an external python engine, and
# assigns imported modules to scriptcontext.sticky variables.
# 
# Arguments:
#       code (str): Path to the GH_to_python_sticky.py code file.
#       location (str): Path to a python executable, or to a folder
#             containing `python.exe`, or the name of a conda-created
#             virtual environment prefixed by `conda://` (`conda://env_name`).
#             If empty, finds python from your windows %PATH%.
#       run (boolean): Creates the connection, and imports new
#             modules, when turned to True. Kills the connection,
#             and deletes the references to the imports, when turned
#             to False.
#       modules (str list): List of module names to import in the
#             remote python. They will be added to the
#             scriptcontext.sticky dictionary, allowing them to be
#             reused from other python components in the same
#             Grasshopper document. Submodules (for example
#             `numpy.linalg` have to be added explicitly to this list
#             to be available later.
#       log_level (str from ['NOTSET', 'DEBUG', 'INFO', 'WARNING', 'ERROR', 'CRITICAL']):
#             Logging level to use for the local IronPython and the
#             remote python instance.
#       working_dir (str): Working directory for the remote python
#             instance.
# 
# Returns:
#       out (str): Console output with DEBUG information.
#       linked_modules (str list): list of imported module names.
#       rpy (rpyc connection object): The object representing the
#             remote Python interpreter.
location = ClusterInput()  # location (str): Path to a python executable, or to a folder containing `python.exe`, or the name of a conda-created virtual environment prefixed by `conda://` (`conda://env_name`). If empty, finds python from your windows %PATH%.
run = ClusterInput()  # run (boolean): Creates the connection, and imports new modules, when turned to True. Kills the connection,and deletes the references to the imports, when turned to False.
modules = ClusterInput()  # modules (str list): List of module names to import in the remote python. They will be added to the scriptcontext.sticky dictionary, allowing them to be reused from other python components in the same Grasshopper document. Submodules (for example `numpy.linalg` have to be added explicitly to this list to be available later.
list = ValueList({"CRITICAL", "ERROR", "WARNING", "INFO", "DEBUG", "NOTSET"}, selected="DEBUG")
panel = Panel(python)
ghpythonremote = GHPythonRemote(location=location, run=run, modules=modules, log_level=list, working_dir=panel)  # -> out, linked_modules, rpy; inputs run: Boolean, modules: list
# ---------- ghpythonremote: Python ----------
import inspect
import logging
from os import path
import sys
from time import sleep

import scriptcontext

import ghpythonremote
from ghpythonremote.connectors import GrasshopperToPythonRemote

local_log_level = getattr(logging, log_level, logging.WARNING)
logger = logging.getLogger("ghpythonremote")
logger.setLevel(local_log_level)
ch = logging.StreamHandler()
ch.setLevel(local_log_level)
formatter = logging.Formatter("%(levelname)s: %(name)s:\n%(message)s")
ch.setFormatter(formatter)
logger.handlers = []
logger.addHandler(ch)
logger = logging.getLogger("ghpythonremote.GH_to_python")

ROOT = path.abspath(path.dirname(inspect.getfile(ghpythonremote)))
rpyc_server_py = path.join(ROOT, "pythonservice.py")

# Set connection to CLOSED if this is the first run
# and initialize set of linked modules
try:
    remote_python_status
except NameError:
    remote_python_status = "CLOSED"
    lkd_modules = set()

# Wait for connection to connect or terminate
timer = 0
while remote_python_status == "CONNECTING" or remote_python_status == "CLOSING":
    sleep(1)
    timer += 1
    if timer == 10:
        try:
            gh2py_manager.__exit__(*sys.exc_info())
        except Exception:
            pass
        remote_python_status = "CLOSED"
        lkd_modules = set()
        raise RuntimeError(
            "Connection left in an inconsistent state and not returning. Reset "
            "everything."
        )

if run:
    if not remote_python_status == "OPEN":
        remote_python_status = "CONNECTING"
        gh2py_manager = GrasshopperToPythonRemote(
            rpyc_server_py,
            location=location,
            timeout=10,
            port=None,
            log_level=log_level,
            working_dir=working_dir,
        )
        gh2py = gh2py_manager.__enter__()
        remote_python_status = "OPEN"

    # Stuff that we can reach
    rpymod = gh2py.py_remote_modules  # A getter function for a named python module
    rpy = gh2py.connection  # Represents the remote instance root object
    scriptcontext.sticky["rpy"] = rpy
    # Add modules
    for mod in modules:
        try:
            scriptcontext.sticky[mod] = rpymod(mod)
            lkd_modules.add(mod)
        except ImportError:
            gh2py_manager.__exit__(*sys.exc_info())
            raise

elif not remote_python_status == "CLOSED":
    remote_python_status = "CLOSING"
    # Remove linked modules
    for mod in lkd_modules:
        del scriptcontext.sticky[mod]
    del scriptcontext.sticky["rpy"]
    gh2py_manager.__exit__(*sys.exc_info())
    lkd_modules = set()
    remote_python_status = "CLOSED"

# Change variable name because ghpython resets outputs to None before each run
linked_modules = lkd_modules

logger.info("GH to python connection is {}".format(remote_python_status))
# ---------- end ghpythonremote ----------
out = ClusterOutput(ghpythonremote.out)  # Console output.
linked_modules = ClusterOutput(ghpythonremote.linked_modules)  # Names of modules that were successfully added to the scriptcontext.sticky dictionary.
rpy = ClusterOutput(ghpythonremote.rpy)  # The object representing the remote python instance
python_2 = PythonScript(module_names=ghpythonremote.linked_modules)  # -> import_statements; inputs module_names: list
# ---------- python_2: Python ----------
import_statements = ["import scriptcontext as sc"]
for module_name in module_names:
    import_statements.append("{0} = sc.sticky['{0}']".format(module_name))

if len(module_names) == 0:
    import_statements = []
# ---------- end python_2 ----------
import_statements = ClusterOutput(python_2)  # Useful import statements to use the imported modules in your scripts.
