# Grasshopper definition obj1 design tool.gh (Grasshopper 1.0.7)
# Copyright: © 2017-2018 Pierre Cuvilliers, Caitlin Mueller, Massachusetts Institute of Technology
# plug-ins: Pufferfish, Anemone, Weaverbird, Kangaroo2 Components

# ---- group: RECTANGLE
number_slider = Slider(6, range=0..100)
number_slider_2 = Slider(6, range=0..100)
# BASE GEOMETRY
pt = ConstructPoint(XCoordinate=0, YCoordinate=0, ZCoordinate=0)
neg = Negative(Value=number_slider)
neg_2 = Negative(Value=number_slider_2)
vec = VectorXYZ(XComponent=number_slider, YComponent=number_slider_2, ZComponent=0)  # -> Vector, Length
vec_2 = VectorXYZ(XComponent=neg, YComponent=neg_2, ZComponent=0)  # -> Vector, Length
move = Move(Geometry=pt, Motion=vec_2.Vector)  # -> Geometry, Transform
move_2 = Move(Geometry=pt, Motion=vec.Vector)  # -> Geometry, Transform
rec_2pt = Rectangle2Pt(Plane=PlaneXY(0, 0, 0), PointA=move_2.Geometry, PointB=move.Geometry, Radius=0)  # -> Rectangle, Length
srf = Surface(rec_2pt.Rectangle)

# ---- group: CIRCLE
pt_2 = ConstructPoint(XCoordinate=0, YCoordinate=0, ZCoordinate=0)
circle = CircleCNR(Center=pt_2, Normal=Vector(0, 0, 1), Radius=Slider(30, range=0..100))
srf_2 = Surface(circle)

# ----
pt_3 = Point(pt_2)
geo = Geometry(<curve referenced from the Rhino model>)
srf_3 = Surface(geo)

# ---- group: IMPORT GHPYTHON
# CONTROL PANEL
panel = Panel("""numpy
scipy
networkx
scipy.sparse""")
pythonremote = GHPythonRemote(location="C:\Users\nisha\anaconda3\envs\rhino_remote\python.exe", run=Toggle(True), modules=panel)  # -> out, linked_modules, rpy, import_statements

# ----
force_density = Slider(12, range=4..12)
number_slider_3 = Slider(2, range=0..10)
mesh_uv = MeshSurface(Surface=srf_3, UCount=Slider(40, range=0..100), VCount=Slider(20, range=0..100), Overhang=True, Equalize=False)
tri = Triangulate(Mesh=mesh_uv)  # -> Mesh, Count
nv = NakedVertices(Mesh=mesh_uv)  # -> ClothedIndex, NakedIndex, ClothedPts, NakedPts
wbedges = WeaverbirdsMeshEdges(MeshOrPolylines=mesh_uv)

# ---- group: FORCE DENSITY
multiplication = Multiplication(A=force_density, B=5)
panel_2 = Panel(multiplication)
lng = ListLength(Edges=wbedges)
neg_3 = Negative(Value=panel_2)
repeat = RepeatData(Data=neg_3, Length=lng)
multiplication_2 = Multiplication(A=repeat, B=Slider(1, range=0..10))

# ---- group: Dimension
multiplication_3 = Multiplication(A=number_slider_2, B=2)
Y = UnitY(Factor=multiplication_3)
X = UnitX(Factor=multiplication_3)
neg_4 = Negative(Value=Y)
pt_4 = Point(move_2.Geometry)
move_3 = Move(Geometry=move.Geometry, Motion=X)  # -> Geometry, Transform
move_4 = Move(Geometry=pt_4, Motion=neg_4)  # -> Geometry, Transform
neg_5 = Negative(Value=Slider(1, range=0..1))
aligndim = AlignedDimension(
    Plane=PlaneXY(0, 0, 0),
    PointA=move_3.Geometry,
    PointB=move.Geometry,
    Offset=1,
    Text="{0:0.00}",
    Size=Slider(0.2, range=0..1))
aligndim_2 = AlignedDimension(Plane=PlaneXY(0, 0, 0), PointA=move_4.Geometry, PointB=pt_4, Offset=neg_5, Text="{0:0.00}", Size=Slider(0.2, range=0..1))

# ----
pt_5 = Point([nv.NakedPts, nv.ClothedPts])
fastloopstart = FastLoopStart(I=Slider(0, range=0..10), surface=srf_3, line=wbedges)  # -> port, Counter, Surface, Data, Data_2, Data_3

area = Area(Geometry=fastloopstart.Surface)  # -> Area, Centroid
pt_6 = Point(pt_5)
lng_2 = ListLength(List=pt_6)
multiplication_4 = Multiplication(A=Slider(5, range=0..10), B=area.Area)
lng_3 = ListLength(List=nv.NakedPts)
subtraction = Subtraction(A=lng_2, B=lng_3)
division = Division(A=multiplication_4, B=subtraction)

# ---- group: FORCE DENSITY METHOD SOLVER
line = Line(fastloopstart.Data)
end = EndPoints(Curve=line)  # -> Start, End
fixed_points = Point(nv.NakedPts)
num = Number(division)
python = GhPythonScript(x=end.Start, y=end.End)  # -> flatten(array); inputs x: Point3d, y: Point3d
# ---------- python: Python ----------
import rhinoscriptsyntax as rs


array  = [ ((x[0],x[1]) , (y[0],y[1])) ]


print(array)
# ---------- end python ----------
num_2 = Number(multiplication_2)
loading = Negative(Value=num)
python_2 = GhPythonScript(x=fixed_points)  # -> aa; inputs x: list of Point3d
# ---------- python_2: Python ----------
import rhinoscriptsyntax as rs

#CONVERT GUID DATA TO RS POINT3D
a = []
for item in x:
    a.append(rs.coerce3dpoint(item))

# MAKE ARRAYS OF POINTS
aa=[]
for item in a:
    aa.append((item[0],item[1]))
# ---------- end python_2 ----------
solver = GhPythonScript(fxpt=flatten(python_2), x=flatten(python), q=num_2, load=loading)  # -> Cr, Cf, x_ound, y_ound, z_found, fxpt, CON, fxpt_indx, rpt_indx, u; inputs fxpt: list, x: list, q: list
# ---------- solver: Python ----------
import ghpythonremote
import scriptcontext as sc
from ghpythonlib.treehelpers import list_to_tree
ssa = sc.sticky['scipy.sparse']
sci = sc.sticky['scipy']
np =sc.sticky['numpy']

lines = np.array(x)
lines = np.around(lines,decimals =4)
no_lines = len(lines)  # no_lines means no. of lines 

#get unique sets of points save them in matrix u and get indices in indices
lines = np.reshape(lines,(no_lines*2,2))
u,indices = np.unique(lines,return_inverse = True,axis = 0)
unqpt= np.unique(indices,return_inverse = False)
u_pt_len = len(indices)
#print ("length of u is",len(u))


# CREATE CONNNECTIVITY MATRIX.
row = np.repeat(np.arange(no_lines),repeats =2 )
col = indices
data = np.tile([1,-1],no_lines)
cols = len(u)
C = ssa.csc_matrix( (data,(row,col)), shape = (no_lines,cols) ).todense()
CON = C.copy()

#GET FIXED POINT INDEX FROM LIST OF UNIQUE POINTS
fxpt = np.array(fxpt)
fxpt = np.around(fxpt,decimals =4)
fxpt_id = np.lexsort((fxpt[:,1],fxpt[:,0]))
fxpt = fxpt[fxpt_id]
res = (u[:, None] == fxpt).all(-1).any(-1)
fxpt_indx = np.where(res)
rpt_indx = np.where(np.invert(res))


#print('FXPT_INDX' , fxpt_indx)
#print(fxpt)

#create Q and Qf matrix for fixed point and free point - connectivity matrices. 
Qf = C[:,fxpt_indx]
Cf = np.reshape(Qf,(Qf.shape[0],Qf.shape[2]))
Qr = C[:,rpt_indx]
Cr = np.reshape(Qr,(Qr.shape[0],Qr.shape[2]))
#Cr = np.delete(C, fxpt_indx, axis=1)
#print(Cr.shape)

#CREATE DIAGONAL FORCE DENSITY MATRIX
q=np.array(q)
q = np.around(q,decimals =4)
Q=np.diag(q)
#print('Q shape',Q.shape)

#CREATE POINT LOAD VECTORS 
p_x = np.zeros((len(u)-len(fxpt),1))
p_y = np.zeros((len(u)-len(fxpt),1))
p_z = np.full((len(u)-len(fxpt),1),load)
#np.tile(load,len(u)-len(fxpt))
#p_z = np.reshape(p_z,(p_z.shape[0],1))

#CREATE FIXED POINT CO-ORDINATE VECTORS
x_f = fxpt[:,0]
x_f = np.reshape(x_f,(x_f.shape[0],))
y_f = fxpt[:,1]
y_f = np.reshape(y_f,(y_f.shape[0],))
z_f=  np.full((x_f.shape[0],), 0)

print(C.shape)

#CREATE D AND D_F
D = Cr.T.dot(Q).dot(Cr)
D_f = Cr.T.dot(Q).dot(Cf)


#GET THE CO-ORDINATES
#print("OK TILL NOW2")

print(np.linalg.inv(D).dot(p_x))
x_ound = np.linalg.inv(D).dot(p_x - np.reshape(D_f.dot(x_f),(D_f.dot(x_f).shape[1],1)))
y_ound = np.linalg.inv(D).dot(p_y - np.reshape(D_f.dot(y_f),(D_f.dot(y_f).shape[1],1)))
z_found = np.linalg.inv(D).dot(p_z - np.reshape(D_f.dot(z_f),(D_f.dot(z_f).shape[1],1)))



print("ok")
# ---------- end solver ----------
python_3 = GhPythonScript(
    Cr=solver.Cr,
    Cf=solver.Cf,
    x=solver.x_ound,
    y=solver.y_ound,
    z=solver.z_found,
    fxpt=solver.fxpt,
    CON=solver.CON,
    fxpt_indx=solver.fxpt_indx,
    rpt_indx=solver.rpt_indx,
    u=solver.u)  # -> a, sptx, spty, sptz, eptx, epty, eptz
# ---------- python_3: Python ----------
import rhinoscriptsyntax as rs
import ghpythonremote
import scriptcontext as sc
from ghpythonlib.treehelpers import list_to_tree
ssa = sc.sticky['scipy.sparse']
sci = sc.sticky['scipy']
np =sc.sticky['numpy']
                
xx =np.array(x)
x=np.reshape(x,(len(x),1))
y = np.array(y)
y=np.reshape(y,(len(y),1))
z = np.array(z)
z = np.around(z,decimals=4)
z=np.reshape(z,(len(z),1))
        
xedo = np.zeros((len(fxpt),1))
fxpt = np.hstack((fxpt,xedo))
fxpt_id = np.lexsort((fxpt[:,1],fxpt[:,0]))
fxpt = fxpt[fxpt_id]
        
xyz=np.concatenate((x,y,z),axis=1)
#xyz= np.vstack((fxpt,xyz))
        
pt_num = len(fxpt)+len(x)
allpt = np.zeros((pt_num,3))
allpt[fxpt_indx] = fxpt
allpt[rpt_indx]=xyz

print(u)
xedo = np.zeros((len(u),1))
u = np.hstack((u,xedo))
print(fxpt)
print(fxpt_indx)
#print(allpt)
                
                
        
con =CON.copy()
#con = np.concatenate((Cf,Cr),axis =1)
cone =CON.copy()
                
con[con==1] =0
con[con==-1] = 1
spt = np.dot(con,allpt)
                
cone[cone==-1] =0
ept = np.dot(cone,allpt)
                
#PUSH DATA TO GRASSHOPPER TREE
sptx = ghpythonremote.obtain(spt[0:,0].tolist())
sptx =list_to_tree(sptx,source=[0,])
                
spty = ghpythonremote.obtain(spt[0:,1].tolist())
spty =list_to_tree(spty,source=[0,])
                
sptz = ghpythonremote.obtain(spt[0:,2].tolist())
sptz =list_to_tree(sptz,source=[0,])
                
eptx = ghpythonremote.obtain(ept[0:,0].tolist())
eptx =list_to_tree(eptx,source=[0,])
                
epty = ghpythonremote.obtain(ept[0:,1].tolist())
epty =list_to_tree(epty,source=[0,])
                
eptz = ghpythonremote.obtain(ept[0:,2].tolist())
eptz =list_to_tree(eptz,source=[0,])
# ---------- end python_3 ----------
pt_7 = ConstructPoint(XCoordinate=flatten(python_3.sptx), YCoordinate=flatten(python_3.spty), ZCoordinate=flatten(python_3.sptz))
pt_8 = ConstructPoint(XCoordinate=flatten(python_3.eptx), YCoordinate=flatten(python_3.epty), ZCoordinate=flatten(python_3.eptz))
ln = Line(StartPoint=pt_7, EndPoint=pt_8)

# ----
del = DelaunayMesh(Points=pt_7, Plane=PlaneXY(0, 0, 0))
fastloopend = FastLoopEnd(
    port=fastloopstart.port,
    Exit=False,
    Surface=del,
    Data=ln,
    Data_2=python_3.sptz,
    Data_3=python_3.eptz,
    RecordData=False,
    TimeOutVal=0)  # -> D0, line, z1, z2
line_2 = Line(fastloopend.line)

# ---- group: TAG AND POINT FOR FINAL STRUCTURE
number_slider_4 = Slider(60, range=0..1000)
X_2 = UnitX(Factor=number_slider_4)
division_2 = Division(A=number_slider_4, B=2)
move_5 = Move(FixPoints=fixed_points, Motion=X_2)  # -> Geometry, Transform
area_2 = Area(Geometry=srf_3)  # -> Area, Centroid
neg_6 = Negative(Value=division_2)
panel_3 = Panel("""FINAL GRIDSHELL FORM
Note: Red - Tension
Blue- Compression""")
vec_3 = VectorXYZ(XComponent=number_slider_4, YComponent=neg_6, ZComponent=0)  # -> Vector, Length
move_6 = Move(Geometry=area_2.Centroid, Motion=vec_3.Vector)  # -> Geometry, Transform
tag = TextTag(Location=move_6.Geometry, Text=panel_3)

# ---- group: DISPLAY FINAL STRUCTURE WITH STRESSES
num_3 = Number(flatten(fastloopend.z2))
num_4 = Number(flatten(fastloopend.z1))
len = Length(Curve=fastloopend.line)
python_4 = GhPythonScript(x=num_4, y=num_3, z=len)  # -> out, a
# ---------- python_4: Python ----------
print(x , y, z)
if x == 0 and y == 0 :
    a = 0.1 
else:
    a= z
# ---------- end python_4 ----------
# MEMBER SIZING
multiplication_5 = Multiplication(FD=num_2, B=python_4.a)
abs = Absolute(Value=multiplication_5)
division_3 = Division(A=abs, B=Slider(750, range=0..1000))
pipe = Pipe(Curve=fastloopend.line, Radius=division_3, Caps=0)
X_3 = UnitX(Factor=number_slider_4)
expression = Expression(
    x=flatten(multiplication_5),
    y=ColourSwatch(SwatchColor=RGB(224, 31, 31)),
    z=ColourSwatch(SwatchColor=RGB(49, 67, 204)),
    Expression="if(x≥0,y,z)")
move_7 = Move(Geometry=pipe, Motion=X_3)  # -> Geometry, Transform
preview = CustomPreview(Geometry=flatten(move_7.Geometry), Material=expression)

# ---- group: BASE GEOMETRY
number_slider_5 = Slider(250, range=0..1000)
# ANNOTATIONS
division_4 = Division(A=number_slider_4, B=2)
neg_7 = Negative(Value=division_4)
area_3 = Area(Geometry=srf_3)  # -> Area, Centroid
vec_4 = VectorXYZ(XComponent=pt_3, YComponent=neg_7, ZComponent=0)  # -> Vector, Length
move_8 = Move(Geometry=area_3.Centroid, Motion=vec_4.Vector)  # -> Geometry, Transform
tag_2 = TextTag(Location=move_8.Geometry, Text="BASE GEOMETRY WITH MESH")

# ----
move_9 = Move(Geometry=geo, Motion=X_3)  # -> Geometry, Transform

# ---- group: TOTAL LOAD PATH
multiplication_6 = Multiplication(FORCE=abs, LENGTH=python_4.a)
ma = MassAddition(Input=multiplication_6)  # -> Result, PartialResults
total_load_path = Panel(ma.Result)

# ----
bnd = Bounds(Numbers=flatten([fastloopend.z1, fastloopend.z2]))
dedomain = DeconstructDomain(Domain=bnd)  # -> Start, End
panel_4 = Panel(dedomain.End)

# ---- group: FORCE VALUES TAG
number_slider_6 = Slider(120, range=0..1000)
X_4 = UnitX(Factor=number_slider_6)
division_5 = Division(A=number_slider_6, B=Slider(7, range=0..10))
move_10 = Move(Motion=X_4)  # -> Geometry, Transform
area_4 = Area(Geometry=srf_3)  # -> Area, Centroid
neg_8 = Negative(Value=division_5)
vec_5 = VectorXYZ(XComponent=number_slider_6, YComponent=neg_8, ZComponent=0)  # -> Vector, Length
move_11 = Move(Geometry=area_4.Centroid, Motion=vec_5.Vector)  # -> Geometry, Transform
tag_3 = TextTag(Location=move_11.Geometry, Text="Diamond Panels")

# ---- group: SHOW MEMBER CENTERLINE
number_slider_7 = Slider(120, range=0..1000)
X_5 = UnitX(Factor=number_slider_6)
move_12 = Move(Geometry=fastloopend.line, Motion=X_5)  # -> Geometry, Transform

# ---- group: SHOW FORCES
midpt = CurveMiddle(Curve=move_12.Geometry)
roundd = RoundToDecimalPlace(NumberX=multiplication_5, DecimalPlace=Slider(2, range=0..10), RoundType=0)  # -> Rounded, Difference
tag_4 = TextTag(Location=midpt, Text=roundd.Rounded)

# ----
python_5 = GhPythonScript(x=total_load_path, y=panel_4, lh=Slider(2, range=0..10), hh=Slider(3, range=0..10))  # -> out, graft(a)
# ---------- python_5: Python ----------
a = x

if y < lh :
    a = x * 5

if y > hh :
    a = x * 5
# ---------- end python_5 ----------
num_5 = Number(python_5.a)
panel_5 = Panel(num_5)

# ==== cluster GHPythonRemote: Connects the Grasshopper Python component to an external Python instance.
python = PythonScript()  # -> gh_parent_doc_dir
# ---------- python: Python ----------
from os import path

gh_parent_doc_dir = path.abspath(path.dirname(ghenv.Component.OnPingDocument().Owner.OnPingDocument().FilePath))
# ---------- end python ----------
# GH to python remote example.
# Pierre Cuvilliers, 2017-2018
# Released under the MIT license
# github.com/pilcru/ghpythonremote
# Runs and connects to an external python engine, and
# assigns imported modules to scriptcontext.sticky variables.
# 
# Arguments:
#       code (str): Path to the GH_to_python_sticky.py code file.
#       location (str): Path to a python executable, or to a folder
#             containing `python.exe`, or the name of a conda-created
#             virtual environment prefixed by `conda://` (`conda://env_name`).
#             If empty, finds python from your windows %PATH%.
#       run (boolean): Creates the connection, and imports new
#             modules, when turned to True. Kills the connection,
#             and deletes the references to the imports, when turned
#             to False.
#       modules (str list): List of module names to import in the
#             remote python. They will be added to the
#             scriptcontext.sticky dictionary, allowing them to be
#             reused from other python components in the same
#             Grasshopper document. Submodules (for example
#             `numpy.linalg` have to be added explicitly to this list
#             to be available later.
#       log_level (str from ['NOTSET', 'DEBUG', 'INFO', 'WARNING', 'ERROR', 'CRITICAL']):
#             Logging level to use for the local IronPython and the
#             remote python instance.
#       working_dir (str): Working directory for the remote python
#             instance.
# 
# Returns:
#       out (str): Console output with DEBUG information.
#       linked_modules (str list): list of imported module names.
#       rpy (rpyc connection object): The object representing the
#             remote Python interpreter.
location = ClusterInput()  # location (str): Path to a python executable, or to a folder containing `python.exe`, or the name of a conda-created virtual environment prefixed by `conda://` (`conda://env_name`). If empty, finds python from your windows %PATH%.
run = ClusterInput()  # run (boolean): Creates the connection, and imports new modules, when turned to True. Kills the connection,and deletes the references to the imports, when turned to False.
modules = ClusterInput()  # modules (str list): List of module names to import in the remote python. They will be added to the scriptcontext.sticky dictionary, allowing them to be reused from other python components in the same Grasshopper document. Submodules (for example `numpy.linalg` have to be added explicitly to this list to be available later.
list = ValueList({"CRITICAL", "ERROR", "WARNING", "INFO", "DEBUG", "NOTSET"}, selected="DEBUG")
panel = Panel(python)
ghpythonremote = GHPythonRemote(location=location, run=run, modules=modules, log_level=list, working_dir=panel)  # -> out, linked_modules, rpy; inputs run: Boolean, modules: list
# ---------- ghpythonremote: Python ----------
import inspect
import logging
from os import path
import sys
from time import sleep

import scriptcontext

import ghpythonremote
from ghpythonremote.connectors import GrasshopperToPythonRemote

local_log_level = getattr(logging, log_level, logging.WARNING)
logger = logging.getLogger("ghpythonremote")
logger.setLevel(local_log_level)
ch = logging.StreamHandler()
ch.setLevel(local_log_level)
formatter = logging.Formatter("%(levelname)s: %(name)s:\n%(message)s")
ch.setFormatter(formatter)
logger.handlers = []
logger.addHandler(ch)
logger = logging.getLogger("ghpythonremote.GH_to_python")

ROOT = path.abspath(path.dirname(inspect.getfile(ghpythonremote)))
rpyc_server_py = path.join(ROOT, "pythonservice.py")

# Set connection to CLOSED if this is the first run
# and initialize set of linked modules
try:
    remote_python_status
except NameError:
    remote_python_status = "CLOSED"
    lkd_modules = set()

# Wait for connection to connect or terminate
timer = 0
while remote_python_status == "CONNECTING" or remote_python_status == "CLOSING":
    sleep(1)
    timer += 1
    if timer == 10:
        try:
            gh2py_manager.__exit__(*sys.exc_info())
        except Exception:
            pass
        remote_python_status = "CLOSED"
        lkd_modules = set()
        raise RuntimeError(
            "Connection left in an inconsistent state and not returning. Reset "
            "everything."
        )

if run:
    if not remote_python_status == "OPEN":
        remote_python_status = "CONNECTING"
        gh2py_manager = GrasshopperToPythonRemote(
            rpyc_server_py,
            location=location,
            timeout=10,
            port=None,
            log_level=log_level,
            working_dir=working_dir,
        )
        gh2py = gh2py_manager.__enter__()
        remote_python_status = "OPEN"

    # Stuff that we can reach
    rpymod = gh2py.py_remote_modules  # A getter function for a named python module
    rpy = gh2py.connection  # Represents the remote instance root object
    scriptcontext.sticky["rpy"] = rpy
    # Add modules
    for mod in modules:
        try:
            scriptcontext.sticky[mod] = rpymod(mod)
            lkd_modules.add(mod)
        except ImportError:
            gh2py_manager.__exit__(*sys.exc_info())
            raise

elif not remote_python_status == "CLOSED":
    remote_python_status = "CLOSING"
    # Remove linked modules
    for mod in lkd_modules:
        del scriptcontext.sticky[mod]
    del scriptcontext.sticky["rpy"]
    gh2py_manager.__exit__(*sys.exc_info())
    lkd_modules = set()
    remote_python_status = "CLOSED"

# Change variable name because ghpython resets outputs to None before each run
linked_modules = lkd_modules

logger.info("GH to python connection is {}".format(remote_python_status))
# ---------- end ghpythonremote ----------
out = ClusterOutput(ghpythonremote.out)  # Console output.
linked_modules = ClusterOutput(ghpythonremote.linked_modules)  # Names of modules that were successfully added to the scriptcontext.sticky dictionary.
rpy = ClusterOutput(ghpythonremote.rpy)  # The object representing the remote python instance
python_2 = PythonScript(module_names=ghpythonremote.linked_modules)  # -> import_statements; inputs module_names: list
# ---------- python_2: Python ----------
import_statements = ["import scriptcontext as sc"]
for module_name in module_names:
    import_statements.append("{0} = sc.sticky['{0}']".format(module_name))

if len(module_names) == 0:
    import_statements = []
# ---------- end python_2 ----------
import_statements = ClusterOutput(python_2)  # Useful import statements to use the imported modules in your scripts.
