# Grasshopper definition REC 10 10 3LOOPS karamba [Sep-05 '21, 0929].gh (Grasshopper 1.0.7)
# Copyright: © 2017-2018 Pierre Cuvilliers, Caitlin Mueller, Massachusetts Institute of Technology
# plug-ins: Pufferfish, LunchBox, Kangaroo2 Components, karambaGH

# ---- group: RECTANGLE
number_slider = Slider(6, range=0..100)
number_slider_2 = Slider(6, range=0..100)
# BASE GEOMETRY
pt = ConstructPoint(XCoordinate=0, YCoordinate=0, ZCoordinate=0)
neg = Negative(Value=number_slider)
neg_2 = Negative(Value=number_slider_2)
vec = VectorXYZ(XComponent=number_slider, YComponent=number_slider_2, ZComponent=0)  # -> Vector, Length
vec_2 = VectorXYZ(XComponent=neg, YComponent=neg_2, ZComponent=0)  # -> Vector, Length
move = Move(Geometry=pt, Motion=vec_2.Vector)  # -> Geometry, Transform
move_2 = Move(Geometry=pt, Motion=vec.Vector)  # -> Geometry, Transform
rec_2pt = Rectangle2Pt(Plane=PlaneXY(0, 0, 0), PointA=move_2.Geometry, PointB=move.Geometry, Radius=0)  # -> Rectangle, Length
srf = Surface(rec_2pt.Rectangle)

# ---- group: CIRCLE
pt_2 = ConstructPoint(XCoordinate=0, YCoordinate=0, ZCoordinate=0)
circle = CircleCNR(Center=pt_2, Normal=Vector(0, 0, 1), Radius=Slider(30, range=0..100))
srf_2 = Surface(circle)

# ----
pt_3 = Point(pt_2)
srf_3 = Surface(srf)
geo = Geometry(rec_2pt.Rectangle)

# ---- group: IMPORT GHPYTHON
panel = Panel("""numpy
scipy
networkx
scipy.sparse""")
pythonremote = GHPythonRemote(location="C:\Users\nisha\anaconda3\envs\rhino_remote\python.exe", run=Toggle(True), modules=panel)  # -> out, linked_modules, rpy, import_statements

# ----
topo_choose = Slider(0, range=0..4)
force_density = Slider(4, range=4..12)
galapagos = Galapagos(fitness=num_10, gene=[topo_choose, subdivision, force_density])

# ---- group: Dimension
multiplication = Multiplication(A=number_slider_2, B=2)
Y = UnitY(Factor=multiplication)
X = UnitX(Factor=multiplication)
neg_3 = Negative(Value=Y)
pt_4 = Point(move_2.Geometry)
move_3 = Move(Geometry=move.Geometry, Motion=X)  # -> Geometry, Transform
move_4 = Move(Geometry=pt_4, Motion=neg_3)  # -> Geometry, Transform
neg_4 = Negative(Value=Slider(1, range=0..1))
aligndim = AlignedDimension(
    Plane=PlaneXY(0, 0, 0),
    PointA=move_3.Geometry,
    PointB=move.Geometry,
    Offset=1,
    Text="{0:0.00}",
    Size=Slider(0.2, range=0..1))
aligndim_2 = AlignedDimension(Plane=PlaneXY(0, 0, 0), PointA=move_4.Geometry, PointB=pt_4, Offset=neg_4, Text="{0:0.00}", Size=Slider(0.2, range=0..1))

# ---- group: FORCE VALUES TAG
number_slider_3 = Slider(60, range=0..1000)
X_2 = UnitX(Factor=number_slider_3)
division = Division(A=number_slider_3, B=Slider(7, range=0..10))
move_5 = Move(Motion=X_2)  # -> Geometry, Transform
area = Area(Geometry=srf_3)  # -> Area, Centroid
neg_5 = Negative(Value=division)
vec_3 = VectorXYZ(XComponent=number_slider_3, YComponent=neg_5, ZComponent=0)  # -> Vector, Length
move_6 = Move(Geometry=area.Centroid, Motion=vec_3.Vector)  # -> Geometry, Transform
tag = TextTag(Location=move_6.Geometry, Text="Diamond Panels")

# ----
Y_2 = UnitY(Factor=Slider(20, range=0..100))
matprops = MaterialPropertiesKaramba3D(
    FamilyOfMaterial="Mild Steel",
    Name="Fe250",
    YoungsModulus_kN_cm2="21000",
    InPlaneShearModulus_kN_cm2=8076,
    TransverseShearModulus_kN_cm2=8076,
    SpecificWeight_kN_m3="78.5",
    CoefficientOfThermalExpansion_1_C=1e-05,
    YieldStrength_kN_cm2="25",
    mode="Isotrop")
panel_2 = Panel("""ISNB40M
ISNB50M
ISNB65M
ISNB80M
ISNB90M
ISNB100M
ISNB110M""")
panel_3 = Panel("""ISNB50M
ISNB50M
ISNB65M
ISNB80M
ISNB90M
ISNB100M
ISNB110M""")
panel_4 = Panel("""0.32
0.36
0.36
0.4
0.4
0.45
0.48""")
panel_5 = Panel("""4.83
6.03
7.61
8.89
10.16
11.43
12.7""")
cross_section = CrossSectionKaramba3D(
    FamilyNameOfCrossSection="ISNB",
    NameOfCrossSection=panel_2,
    ElementIdentifier=panel_3,
    Material=matprops,
    Diameter_cm=panel_5,
    WallThickness_cm=panel_4,
    mode="Circular Hollow")
gencstable = GenerateCrossSectionTableKaramba3D(CrossSections=cross_section)
panel_6 = Panel(gencstable)
readcstable = ReadCrossSectionTableFromFileKaramba3D()  # -> CrossSection, Info

# ---- group: MESHING
subdivision = Slider(10, range=6..24)
# CONTROL PANEL
diamond = DiamondPanels(Surface=srf_3, UDivisions=subdivision, VDivisions=subdivision)  # -> DiamondPanels, TriPanels
trib = TrianglePanelsB(Surface=srf_3, UDivisions=subdivision, VDivisions=subdivision)
quads = QuadPanels(Surface=srf_3, UDivisions=subdivision, VDivisions=subdivision)
tric = TrianglePanelsC(Surface=srf_3, UDivisions=subdivision, VDivisions=subdivision)
tria = TriangularPanelsA(Surface=srf_3, UDivisions=subdivision, VDivisions=subdivision)

# ----
panel_7 = Panel(subdivision)
brep = Brep(flatten([diamond.DiamondPanels, diamond.TriPanels]))
python = GhPythonScript(x=brep, y=tria, z=trib, u=tric, v=quads, i=topo_choose)  # -> out, a; inputs x: list, y: list, z: list, u: list, v: list
# ---------- python: Python ----------
if i==0 :
    a = x
if i==1:
    a = y
if i==2:
    a = z
if i==3:
    a = u
if i==4:
    a = v
# ---------- end python ----------

# ---- group: MESHING (continued)
join = BrepJoin(Breps=python.a)  # -> Breps, Closed
debrep = DeconstructBrep(Brep=join.Breps)  # -> Faces, Edges, Vertices
join_2 = BrepJoin(Breps=debrep.Faces)  # -> Breps, Closed
edges = BrepEdges(Brep=join_2.Breps)  # -> Naked, Interior, NonManifold
line = Line([edges.Naked, edges.Interior])

# ---- group: FORCE DENSITY
multiplication_2 = Multiplication(A=force_density, B=5)
panel_8 = Panel(multiplication_2)
lng = ListLength(Edges=line)
neg_6 = Negative(Value=panel_8)
repeat = RepeatData(Data=neg_6, Length=lng)
multiplication_3 = Multiplication(A=repeat, B=Slider(1, range=0..10))

# ---- group: FIXED POINTS
end = EndPoints(Curve=edges.Naked)  # -> Start, End
pt_5 = Point([end.End, end.Start])
duppt = RemoveDuplicatePts(Points=pt_5, Tolerance=0.01)

# ---- group: LOADING
area_2 = Area(Geometry=srf_3)  # -> Area, Centroid
pt_6 = Point(debrep.Vertices)
lng_2 = ListLength(List=pt_6)
# FORCE DENSITY METHOD LOOPS
multiplication_4 = Multiplication(A=Slider(5, range=0..10), B=area_2.Area)
lng_3 = ListLength(List=duppt)
subtraction = Subtraction(A=lng_2, B=lng_3)
division_2 = Division(A=multiplication_4, B=subtraction)

# ----
line_2 = Line(line)
end_2 = EndPoints(Curve=line_2)  # -> Start, End
num = Number(division_2)
fixed_points = Point(duppt)
python_2 = GhPythonScript(x=end_2.Start, y=end_2.End)  # -> flatten(array); inputs x: Point3d, y: Point3d
# ---------- python_2: Python ----------
import rhinoscriptsyntax as rs


array  = [ ((x[0],x[1]) , (y[0],y[1])) ]


print(array)
# ---------- end python_2 ----------
loading = Negative(Value=num)
python_3 = GhPythonScript(x=fixed_points)  # -> aa; inputs x: list of Point3d
# ---------- python_3: Python ----------
import rhinoscriptsyntax as rs

#CONVERT GUID DATA TO RS POINT3D
a = []
for item in x:
    a.append(rs.coerce3dpoint(item))

# MAKE ARRAYS OF POINTS
aa=[]
for item in a:
    aa.append((item[0],item[1]))
# ---------- end python_3 ----------
num_2 = Number(multiplication_3)
solver = GhPythonScript(fxpt=flatten(python_3), x=flatten(python_2), q=num_2, load=loading)  # -> Cr, Cf, x_ound, y_ound, z_found, fxpt, CON, fxpt_indx, rpt_indx, u; inputs fxpt: list, x: list, q: list
# ---------- solver: Python ----------
import ghpythonremote
import scriptcontext as sc
from ghpythonlib.treehelpers import list_to_tree
ssa = sc.sticky['scipy.sparse']
sci = sc.sticky['scipy']
np =sc.sticky['numpy']

lines = np.array(x)
lines = np.around(lines,decimals =4)
no_lines = len(lines)  # no_lines means no. of lines 

#get unique sets of points save them in matrix u and get indices in indices
lines = np.reshape(lines,(no_lines*2,2))
u,indices = np.unique(lines,return_inverse = True,axis = 0)
unqpt= np.unique(indices,return_inverse = False)
u_pt_len = len(indices)
#print ("length of u is",len(u))


# CREATE CONNNECTIVITY MATRIX.
row = np.repeat(np.arange(no_lines),repeats =2 )
col = indices
data = np.tile([1,-1],no_lines)
cols = len(u)
C = ssa.csc_matrix( (data,(row,col)), shape = (no_lines,cols) ).todense()
CON = C.copy()

#GET FIXED POINT INDEX FROM LIST OF UNIQUE POINTS
fxpt = np.array(fxpt)
fxpt = np.around(fxpt,decimals =4)
fxpt_id = np.lexsort((fxpt[:,1],fxpt[:,0]))
fxpt = fxpt[fxpt_id]
res = (u[:, None] == fxpt).all(-1).any(-1)
fxpt_indx = np.where(res)
rpt_indx = np.where(np.invert(res))


#print('FXPT_INDX' , fxpt_indx)
#print(fxpt)

#create Q and Qf matrix for fixed point and free point - connectivity matrices. 
Qf = C[:,fxpt_indx]
Cf = np.reshape(Qf,(Qf.shape[0],Qf.shape[2]))
Qr = C[:,rpt_indx]
Cr = np.reshape(Qr,(Qr.shape[0],Qr.shape[2]))
#Cr = np.delete(C, fxpt_indx, axis=1)
#print(Cr.shape)

#CREATE DIAGONAL FORCE DENSITY MATRIX
q=np.array(q)
q = np.around(q,decimals =4)
Q=np.diag(q)
#print('Q shape',Q.shape)

#CREATE POINT LOAD VECTORS 
p_x = np.zeros((len(u)-len(fxpt),1))
p_y = np.zeros((len(u)-len(fxpt),1))
p_z = np.full((len(u)-len(fxpt),1),load)
#np.tile(load,len(u)-len(fxpt))
#p_z = np.reshape(p_z,(p_z.shape[0],1))

#CREATE FIXED POINT CO-ORDINATE VECTORS
x_f = fxpt[:,0]
x_f = np.reshape(x_f,(x_f.shape[0],))
y_f = fxpt[:,1]
y_f = np.reshape(y_f,(y_f.shape[0],))
z_f=  np.full((x_f.shape[0],), 0)

print(C.shape)

#CREATE D AND D_F
D = Cr.T.dot(Q).dot(Cr)
D_f = Cr.T.dot(Q).dot(Cf)


#GET THE CO-ORDINATES
#print("OK TILL NOW2")

print(np.linalg.inv(D).dot(p_x))
x_ound = np.linalg.inv(D).dot(p_x - np.reshape(D_f.dot(x_f),(D_f.dot(x_f).shape[1],1)))
y_ound = np.linalg.inv(D).dot(p_y - np.reshape(D_f.dot(y_f),(D_f.dot(y_f).shape[1],1)))
z_found = np.linalg.inv(D).dot(p_z - np.reshape(D_f.dot(z_f),(D_f.dot(z_f).shape[1],1)))



print("ok")
# ---------- end solver ----------
python_4 = GhPythonScript(
    Cr=solver.Cr,
    Cf=solver.Cf,
    x=solver.x_ound,
    y=solver.y_ound,
    z=solver.z_found,
    fxpt=solver.fxpt,
    CON=solver.CON,
    fxpt_indx=solver.fxpt_indx,
    rpt_indx=solver.rpt_indx,
    u=solver.u)  # -> a, sptx, spty, sptz, eptx, epty, eptz
# ---------- python_4: Python ----------
import rhinoscriptsyntax as rs
import ghpythonremote
import scriptcontext as sc
from ghpythonlib.treehelpers import list_to_tree
ssa = sc.sticky['scipy.sparse']
sci = sc.sticky['scipy']
np =sc.sticky['numpy']
                
xx =np.array(x)
x=np.reshape(x,(len(x),1))
y = np.array(y)
y=np.reshape(y,(len(y),1))
z = np.array(z)
z = np.around(z,decimals=4)
z=np.reshape(z,(len(z),1))
        
xedo = np.zeros((len(fxpt),1))
fxpt = np.hstack((fxpt,xedo))
fxpt_id = np.lexsort((fxpt[:,1],fxpt[:,0]))
fxpt = fxpt[fxpt_id]
        
xyz=np.concatenate((x,y,z),axis=1)
#xyz= np.vstack((fxpt,xyz))
        
pt_num = len(fxpt)+len(x)
allpt = np.zeros((pt_num,3))
allpt[fxpt_indx] = fxpt
allpt[rpt_indx]=xyz

print(u)
xedo = np.zeros((len(u),1))
u = np.hstack((u,xedo))
print(fxpt)
print(fxpt_indx)
#print(allpt)
                
                
        
con =CON.copy()
#con = np.concatenate((Cf,Cr),axis =1)
cone =CON.copy()
                
con[con==1] =0
con[con==-1] = 1
spt = np.dot(con,allpt)
                
cone[cone==-1] =0
ept = np.dot(cone,allpt)
                
#PUSH DATA TO GRASSHOPPER TREE
sptx = ghpythonremote.obtain(spt[0:,0].tolist())
sptx =list_to_tree(sptx,source=[0,])
                
spty = ghpythonremote.obtain(spt[0:,1].tolist())
spty =list_to_tree(spty,source=[0,])
                
sptz = ghpythonremote.obtain(spt[0:,2].tolist())
sptz =list_to_tree(sptz,source=[0,])
                
eptx = ghpythonremote.obtain(ept[0:,0].tolist())
eptx =list_to_tree(eptx,source=[0,])
                
epty = ghpythonremote.obtain(ept[0:,1].tolist())
epty =list_to_tree(epty,source=[0,])
                
eptz = ghpythonremote.obtain(ept[0:,2].tolist())
eptz =list_to_tree(eptz,source=[0,])
# ---------- end python_4 ----------
pt_7 = ConstructPoint(XCoordinate=flatten(python_4.sptx), YCoordinate=flatten(python_4.spty), ZCoordinate=flatten(python_4.sptz))

del = DelaunayMesh(Points=pt_7, Plane=PlaneXY(0, 0, 0))

area_3 = Area(Geometry=del)  # -> Area, Centroid
pt_8 = Point(debrep.Vertices)
lng_4 = ListLength(List=pt_8)
multiplication_5 = Multiplication(A=Slider(5, range=0..10), B=area_3.Area)
lng_5 = ListLength(List=duppt)
subtraction_2 = Subtraction(A=lng_4, B=lng_5)
division_3 = Division(A=multiplication_5, B=subtraction_2)

line_3 = Line(line)
end_3 = EndPoints(Curve=line_3)  # -> Start, End
num_3 = Number(division_3)
fixed_points_2 = Point(duppt)
python_5 = GhPythonScript(x=end_3.Start, y=end_3.End)  # -> flatten(array); inputs x: Point3d, y: Point3d; same code as python_2
num_4 = Number(multiplication_3)
loading_2 = Negative(Value=num_3)
python_6 = GhPythonScript(x=fixed_points_2)  # -> aa; inputs x: list of Point3d; same code as python_3
solver_2 = GhPythonScript(fxpt=flatten(python_6), x=flatten(python_5), q=num_4, load=loading_2)  # -> Cr, Cf, x_ound, y_ound, z_found, fxpt, CON, fxpt_indx, rpt_indx, u; inputs fxpt: list, x: list, q: list; same code as solver
python_7 = GhPythonScript(
    Cr=solver_2.Cr,
    Cf=solver_2.Cf,
    x=solver_2.x_ound,
    y=solver_2.y_ound,
    z=solver_2.z_found,
    fxpt=solver_2.fxpt,
    CON=solver_2.CON,
    fxpt_indx=solver_2.fxpt_indx,
    rpt_indx=solver_2.rpt_indx,
    u=solver_2.u)  # -> a, sptx, spty, sptz, eptx, epty, eptz; same code as python_4
pt_9 = ConstructPoint(XCoordinate=flatten(python_7.sptx), YCoordinate=flatten(python_7.spty), ZCoordinate=flatten(python_7.sptz))

del_2 = DelaunayMesh(Points=pt_9, Plane=PlaneXY(0, 0, 0))

area_4 = Area(Geometry=del_2)  # -> Area, Centroid
pt_10 = Point(debrep.Vertices)
lng_6 = ListLength(List=pt_10)
multiplication_6 = Multiplication(A=Slider(5, range=0..10), B=area_4.Area)
lng_7 = ListLength(List=duppt)
subtraction_3 = Subtraction(A=lng_6, B=lng_7)
division_4 = Division(A=multiplication_6, B=subtraction_3)

# ---- group: FORCE DENSITY METHOD SOLVER
line_4 = Line(line)
end_4 = EndPoints(Curve=line_4)  # -> Start, End
num_5 = Number(division_4)
fixed_points_3 = Point(duppt)
python_8 = GhPythonScript(x=end_4.Start, y=end_4.End)  # -> flatten(array); inputs x: Point3d, y: Point3d; same code as python_2
num_6 = Number(multiplication_3)
loading_3 = Negative(Value=num_5)
python_9 = GhPythonScript(x=fixed_points_3)  # -> aa; inputs x: list of Point3d; same code as python_3
solver_3 = GhPythonScript(fxpt=flatten(python_9), x=flatten(python_8), q=num_6, load=loading_3)  # -> Cr, Cf, x_ound, y_ound, z_found, fxpt, CON, fxpt_indx, rpt_indx, u; inputs fxpt: list, x: list, q: list; same code as solver
python_10 = GhPythonScript(
    Cr=solver_3.Cr,
    Cf=solver_3.Cf,
    x=solver_3.x_ound,
    y=solver_3.y_ound,
    z=solver_3.z_found,
    fxpt=solver_3.fxpt,
    CON=solver_3.CON,
    fxpt_indx=solver_3.fxpt_indx,
    rpt_indx=solver_3.rpt_indx,
    u=solver_3.u)  # -> a, sptx, spty, sptz, eptx, epty, eptz; same code as python_4
pt_11 = ConstructPoint(XCoordinate=flatten(python_10.sptx), YCoordinate=flatten(python_10.spty), ZCoordinate=flatten(python_10.sptz))
pt_12 = ConstructPoint(XCoordinate=flatten(python_10.eptx), YCoordinate=flatten(python_10.epty), ZCoordinate=flatten(python_10.eptz))
ln = Line(StartPoint=pt_11, EndPoint=pt_12)

# ----
del_3 = DelaunayMesh(Points=pt_11, Plane=PlaneXY(0, 0, 0))

# ---- group: TAG AND POINT FOR FINAL STRUCTURE
number_slider_4 = Slider(30, range=0..1000)
X_3 = UnitX(Factor=number_slider_4)
division_5 = Division(A=number_slider_4, B=2)
move_7 = Move(FixPoints=fixed_points_3, Motion=X_3)  # -> Geometry, Transform
area_5 = Area(Geometry=srf_3)  # -> Area, Centroid
neg_7 = Negative(Value=division_5)
panel_9 = Panel("""FINAL GRIDSHELL FORM
Note: Red - Tension
Blue- Compression""")
vec_4 = VectorXYZ(XComponent=number_slider_4, YComponent=neg_7, ZComponent=0)  # -> Vector, Length
move_8 = Move(Geometry=area_5.Centroid, Motion=vec_4.Vector)  # -> Geometry, Transform
tag_2 = TextTag(Location=move_8.Geometry, Text=panel_9)

# ----
area_6 = Area(Geometry=[del, del_2, del_3])  # -> Area, Centroid
panel_10 = Panel(area_6.Area)
area_variation = Panel(panel_10)

# ---- group: DISPLAY FINAL STRUCTURE WITH STRESSES
num_7 = Number(flatten(python_10.eptz))
num_8 = Number(flatten(python_10.sptz))
len = Length(Curve=ln)
python_11 = GhPythonScript(x=num_8, y=num_7, z=len)  # -> out, a
# ---------- python_11: Python ----------
print(x , y, z)
if x == 0 and y == 0 :
    a = 0.1 
else:
    a= z
# ---------- end python_11 ----------
multiplication_7 = Multiplication(FD=num_6, B=python_11.a)
abs = Absolute(Value=multiplication_7)
division_6 = Division(A=abs, B=Slider(750, range=0..1000))
pipe = Pipe(Curve=ln, Radius=division_6, Caps=0)
X_4 = UnitX(Factor=number_slider_4)
expression = Expression(
    x=flatten(multiplication_7),
    y=ColourSwatch(SwatchColor=RGB(224, 31, 31)),
    z=ColourSwatch(SwatchColor=RGB(49, 67, 204)),
    Expression="if(x≥0,y,z)")
move_9 = Move(Geometry=pipe, Motion=X_4)  # -> Geometry, Transform
preview = CustomPreview(Geometry=flatten(move_9.Geometry), Material=expression)

# ----
shift = ShiftList(List=panel_10, Shift=-1, Wrap=False)
shift_2 = ShiftList(List=panel_10, Shift=1, Wrap=False)
expression_2 = Expression(x=shift_2, y=shift, Expression="(x-y)/y*100")
percentage_error_in_loading = Panel(expression_2)

# ---- group: SHOW MEMBER CENTERLINE
number_slider_5 = Slider(30, range=0..1000)
# MEMBER SIZING
X_5 = UnitX(Factor=number_slider_3)
move_10 = Move(Geometry=ln, Motion=X_5)  # -> Geometry, Transform

# ---- group: BASE GEOMETRY
number_slider_6 = Slider(250, range=0..1000)
# ANNOTATIONS
division_7 = Division(A=number_slider_4, B=2)
neg_8 = Negative(Value=division_7)
area_7 = Area(Geometry=srf_3)  # -> Area, Centroid
vec_5 = VectorXYZ(XComponent=pt_3, YComponent=neg_8, ZComponent=0)  # -> Vector, Length
move_11 = Move(Geometry=area_7.Centroid, Motion=vec_5.Vector)  # -> Geometry, Transform
tag_3 = TextTag(Location=move_11.Geometry, Text="BASE GEOMETRY WITH MESH")

# ---- group: SHOW FORCES
midpt = CurveMiddle(Curve=move_10.Geometry)
roundd = RoundToDecimalPlace(NumberX=multiplication_7, DecimalPlace=Slider(2, range=0..10), RoundType=0)  # -> Rounded, Difference
tag_4 = TextTag(Location=midpt, Text=roundd.Rounded)

# ---- group: TOTAL LOAD PATH
multiplication_8 = Multiplication(FORCE=abs, LENGTH=python_11.a)
ma = MassAddition(Input=multiplication_8)  # -> Result, PartialResults
total_load_path = Panel(ma.Result)

# ----
num_9 = Number(simplify(total_load_path))
num_10 = Number(ma.Result)

bnd = Bounds(Numbers=flatten([python_10.sptz, python_10.eptz]))
dedomain = DeconstructDomain(Domain=bnd)  # -> Start, End
panel_11 = Panel(dedomain.End)

num_11 = Number(panel_11)
num_12 = Number(graft([topo_choose, subdivision, num_11]))
weight = Panel([num_12, num_9, panel_8])
rec = DataRecorder(weight, DataLimit=-10, RecordData=True)
# MESHING
num_13 = Number(rec)
panel_12 = Panel(num_13)
python_12 = GhPythonScript(x=total_load_path, y=panel_11, lh=Slider(2, range=0..10), hh=Slider(3, range=0..10))  # -> out, graft(a)
# ---------- python_12: Python ----------
a = x

if y < lh :
    a = x * 5

if y > hh :
    a = x * 5
# ---------- end python_12 ----------
num_14 = Number(python_12.a)
panel_13 = Panel(num_14)
move_12 = Move(Geometry=ln, Motion=Y_2)  # -> Geometry, Transform
move_13 = Move(Geometry=fixed_points_3, Motion=Y_2)  # -> Geometry, Transform
duppt_2 = RemoveDuplicatePts(Points=move_13.Geometry, Tolerance=0.01)
end_5 = EndPoints(Curve=move_12.Geometry)  # -> Start, End
duppt_3 = RemoveDuplicatePts(Points=[end_5.Start, end_5.End], Tolerance=0.01)
cp = ClosestPoint(Point=duppt_2, Cloud=duppt_3)  # -> ClosestPoint, CPIndex, Distance
difference = SetDifference(SetA=flatten(duppt_3), SetB=flatten(cp.ClosestPoint))  # -> flatten(Union)

# ----
# KARAMBA MODEL
# KARAMBA OPTIMIZATION
upperchord_crv = Curve(move_12.Geometry)
supports_pt = Point(duppt_2)
nodesq_pt = Point(difference)
q_num = Number(division_4)
matselect = MaterialSelectionKaramba3D(menu=[dropdown(1), dropdown(2)])
Z = UnitZ(Factor=q_num)
rev = Reverse(Vector=Z)
supp = SupportKaramba3D(PosInd=supports_pt, menu=[buttons(on, on, on, off, off, off)])
Y_3 = UnitY(Factor="0.001")
beam_joints = BeamJointsKaramba3D(
    ElementIdentifiers="Upper Chord",
    CtKNMAtStartingNode=Vector(0, 0, 0),
    CrKNmRadAtStartingNode=Y_3,
    CtKNMAtEndNode=Vector(0, 0, 0),
    CrKNmRadAtEndNode=Y_3,
    menu=[buttons(off, off, off, off, on, off), buttons(off, off, off, off, on, off)])

# ---- group: Cross Section Range Selector (Karamba3D)
crosecrselect = CrossSectionRangeSelectorKaramba3D(MaximumHeight_cm=-1, MaximumWidth_cm=-1, Material=matselect, menu=[dropdown(2), dropdown(2), dropdown(2)])

# ---- group: Loads (Karamba3D)
loads = LoadsKaramba3D(ForceVector=rev, Local=False, PosInd=nodesq_pt, LCase=0, mode="Point")  # -> flatten(Load)

# ---- group: Line to Beam (Karamba3D)
linetobeam = LineToBeamKaramba3D(
    Line=upperchord_crv,
    Identifier=graft("Upper Chord"),
    CrossSection=cross_section,
    New=True,
    Remove=True,
    LimitDistance_m=0.005)  # -> Element, Points, Info

# ---- group: Assemble Model (Karamba3D)
assemble = AssembleModelKaramba3D(
    Elem=flatten(linetobeam.Element),
    Support=flatten(supp),
    Load=flatten(loads),
    Joint=flatten(beam_joints),
    LimitDistance_m=0.005)  # -> Model, Info, Mass_kg, CenterOfGravity

# ---- group: Analyze (Karamba3D)
analyze = AnalyzeKaramba3D(Model=assemble.Model)  # -> CalculatedModel, MaximumDisplacement_cm, ResultingForceOfGravity_kN, ElasticEnergy_kNm

# ---- group: Model View (Karamba3D)
modelview = ModelViewKaramba3D(Model=analyze.CalculatedModel, ResultFactors=1, ResultCase=-1)  # -> Model, DeformedMesh, DeformedAxes, DeformedModel

# ---- group: Optimize Cross Section (Karamba3D)
opticrosec = OptimizeCrossSectionKaramba3D(
    Model=assemble.Model,
    CrossSections=cross_section,
    MaximumUtilization=1,
    MaximumDisplacement_cm=-1,
    UltimateLimitStateIterations="1",
    DisplacementIterations=5,
    NumberOfSamplePoints=3,
    ElasticDesign=True,
    GammaM0=1,
    GammaM1=1)  # -> ModelWithOptimizedCrossSections, Info, Mass_kg, MaximumDisplacement_cm, ElasticEnergy_kNm

# ---- group: Beam View (Karamba3D)
beamview = BeamViewKaramba3D(Model=modelview.Model)  # -> Model, MeshesOfRenderedBeams, DeformedBeamAxes, LegendColors, LegendTags

# ----
b_forces = BeamForcesKaramba3D(AnalyzedModel=analyze.CalculatedModel, LCase=-1, MaximumDistanceBetweenResults_m=-1, NumberOfResultsPerBeamElement=2)  # -> AnalyzedModel, NormalForce_kN, ShearForceVz_kN, ShearForceVy_kN, BendingMomentMt_kNm, BendingMomentMy_kNm, BendingMomentMz_kNm
item = ListItem(List=b_forces.NormalForce_kN, Index=0, Wrap=True)  # -> flatten(Item)
num_15 = Number(opticrosec.Mass_kg)
nodedisp = NodalDisplacementsKaramba3D(AnalyzedModel=modelview.Model, ResultCase=0)  # -> AnalyzedModel, NodalTranslations_m, NodalRotations_rad
curvepoint = PointOnCurve(beamview.DeformedBeamAxes, parameter=0.5)
roundd_2 = RoundToDecimalPlace(NumberX=item, DecimalPlace=Slider(2, range=0..10), RoundType=0)  # -> Rounded, Difference
tag_5 = TextTag(Location=curvepoint, Text=roundd_2.Rounded)
item_2 = ListItem(List=nodedisp.NodalTranslations_m, Index=Slider(80, range=0..100), Wrap=True)
panel_14 = Panel(item_2)

# ---- group: Model View (Karamba3D)
modelview_2 = ModelViewKaramba3D(Model=opticrosec.ModelWithOptimizedCrossSections, ResultFactors=1, ResultCase=-1)  # -> Model, DeformedMesh, DeformedAxes, DeformedModel

# ----
devec = DeconstructVector(Vector=nodedisp.NodalTranslations_m)  # -> XComponent, YComponent, ZComponent
abs_2 = Absolute(Value=devec.ZComponent)
hilonums = HighestLowestNumbers(Numbers=devec.ZComponent)  # -> Highest, Lowest
deflection_max = Panel([hilonums.Lowest, hilonums.Highest])
max_deflections = Panel(deflection_max)

# ==== cluster GHPythonRemote: Connects the Grasshopper Python component to an external Python instance.
python = PythonScript()  # -> gh_parent_doc_dir
# ---------- python: Python ----------
from os import path

gh_parent_doc_dir = path.abspath(path.dirname(ghenv.Component.OnPingDocument().Owner.OnPingDocument().FilePath))
# ---------- end python ----------
# GH to python remote example.
# Pierre Cuvilliers, 2017-2018
# Released under the MIT license
# github.com/pilcru/ghpythonremote
# Runs and connects to an external python engine, and
# assigns imported modules to scriptcontext.sticky variables.
# 
# Arguments:
#       code (str): Path to the GH_to_python_sticky.py code file.
#       location (str): Path to a python executable, or to a folder
#             containing `python.exe`, or the name of a conda-created
#             virtual environment prefixed by `conda://` (`conda://env_name`).
#             If empty, finds python from your windows %PATH%.
#       run (boolean): Creates the connection, and imports new
#             modules, when turned to True. Kills the connection,
#             and deletes the references to the imports, when turned
#             to False.
#       modules (str list): List of module names to import in the
#             remote python. They will be added to the
#             scriptcontext.sticky dictionary, allowing them to be
#             reused from other python components in the same
#             Grasshopper document. Submodules (for example
#             `numpy.linalg` have to be added explicitly to this list
#             to be available later.
#       log_level (str from ['NOTSET', 'DEBUG', 'INFO', 'WARNING', 'ERROR', 'CRITICAL']):
#             Logging level to use for the local IronPython and the
#             remote python instance.
#       working_dir (str): Working directory for the remote python
#             instance.
# 
# Returns:
#       out (str): Console output with DEBUG information.
#       linked_modules (str list): list of imported module names.
#       rpy (rpyc connection object): The object representing the
#             remote Python interpreter.
location = ClusterInput()  # location (str): Path to a python executable, or to a folder containing `python.exe`, or the name of a conda-created virtual environment prefixed by `conda://` (`conda://env_name`). If empty, finds python from your windows %PATH%.
run = ClusterInput()  # run (boolean): Creates the connection, and imports new modules, when turned to True. Kills the connection,and deletes the references to the imports, when turned to False.
modules = ClusterInput()  # modules (str list): List of module names to import in the remote python. They will be added to the scriptcontext.sticky dictionary, allowing them to be reused from other python components in the same Grasshopper document. Submodules (for example `numpy.linalg` have to be added explicitly to this list to be available later.
list = ValueList({"CRITICAL", "ERROR", "WARNING", "INFO", "DEBUG", "NOTSET"}, selected="DEBUG")
panel = Panel(python)
ghpythonremote = GHPythonRemote(location=location, run=run, modules=modules, log_level=list, working_dir=panel)  # -> out, linked_modules, rpy; inputs run: Boolean, modules: list
# ---------- ghpythonremote: Python ----------
import inspect
import logging
from os import path
import sys
from time import sleep

import scriptcontext

import ghpythonremote
from ghpythonremote.connectors import GrasshopperToPythonRemote

local_log_level = getattr(logging, log_level, logging.WARNING)
logger = logging.getLogger("ghpythonremote")
logger.setLevel(local_log_level)
ch = logging.StreamHandler()
ch.setLevel(local_log_level)
formatter = logging.Formatter("%(levelname)s: %(name)s:\n%(message)s")
ch.setFormatter(formatter)
logger.handlers = []
logger.addHandler(ch)
logger = logging.getLogger("ghpythonremote.GH_to_python")

ROOT = path.abspath(path.dirname(inspect.getfile(ghpythonremote)))
rpyc_server_py = path.join(ROOT, "pythonservice.py")

# Set connection to CLOSED if this is the first run
# and initialize set of linked modules
try:
    remote_python_status
except NameError:
    remote_python_status = "CLOSED"
    lkd_modules = set()

# Wait for connection to connect or terminate
timer = 0
while remote_python_status == "CONNECTING" or remote_python_status == "CLOSING":
    sleep(1)
    timer += 1
    if timer == 10:
        try:
            gh2py_manager.__exit__(*sys.exc_info())
        except Exception:
            pass
        remote_python_status = "CLOSED"
        lkd_modules = set()
        raise RuntimeError(
            "Connection left in an inconsistent state and not returning. Reset "
            "everything."
        )

if run:
    if not remote_python_status == "OPEN":
        remote_python_status = "CONNECTING"
        gh2py_manager = GrasshopperToPythonRemote(
            rpyc_server_py,
            location=location,
            timeout=10,
            port=None,
            log_level=log_level,
            working_dir=working_dir,
        )
        gh2py = gh2py_manager.__enter__()
        remote_python_status = "OPEN"

    # Stuff that we can reach
    rpymod = gh2py.py_remote_modules  # A getter function for a named python module
    rpy = gh2py.connection  # Represents the remote instance root object
    scriptcontext.sticky["rpy"] = rpy
    # Add modules
    for mod in modules:
        try:
            scriptcontext.sticky[mod] = rpymod(mod)
            lkd_modules.add(mod)
        except ImportError:
            gh2py_manager.__exit__(*sys.exc_info())
            raise

elif not remote_python_status == "CLOSED":
    remote_python_status = "CLOSING"
    # Remove linked modules
    for mod in lkd_modules:
        del scriptcontext.sticky[mod]
    del scriptcontext.sticky["rpy"]
    gh2py_manager.__exit__(*sys.exc_info())
    lkd_modules = set()
    remote_python_status = "CLOSED"

# Change variable name because ghpython resets outputs to None before each run
linked_modules = lkd_modules

logger.info("GH to python connection is {}".format(remote_python_status))
# ---------- end ghpythonremote ----------
out = ClusterOutput(ghpythonremote.out)  # Console output.
linked_modules = ClusterOutput(ghpythonremote.linked_modules)  # Names of modules that were successfully added to the scriptcontext.sticky dictionary.
rpy = ClusterOutput(ghpythonremote.rpy)  # The object representing the remote python instance
python_2 = PythonScript(module_names=ghpythonremote.linked_modules)  # -> import_statements; inputs module_names: list
# ---------- python_2: Python ----------
import_statements = ["import scriptcontext as sc"]
for module_name in module_names:
    import_statements.append("{0} = sc.sticky['{0}']".format(module_name))

if len(module_names) == 0:
    import_statements = []
# ---------- end python_2 ----------
import_statements = ClusterOutput(python_2)  # Useful import statements to use the imported modules in your scripts.
