# Grasshopper definition wind comparision forms.gh (Grasshopper 1.0.7)
# Copyright: © 2017-2018 Pierre Cuvilliers, Caitlin Mueller, Massachusetts Institute of Technology
# plug-ins: Pufferfish, LunchBox, Kangaroo2 Components, karambaGH, Weaverbird, Sandbox Topology

# ---- group: RECTANGLE
number_slider = Slider(6, range=0..100)
number_slider_2 = Slider(6, range=0..100)
# BASE GEOMETRY
pt = ConstructPoint(XCoordinate=0, YCoordinate=0, ZCoordinate=0)
neg = Negative(Value=number_slider)
neg_2 = Negative(Value=number_slider_2)
vec = VectorXYZ(XComponent=number_slider, YComponent=number_slider_2, ZComponent=0)  # -> Vector, Length
vec_2 = VectorXYZ(XComponent=neg, YComponent=neg_2, ZComponent=0)  # -> Vector, Length
move = Move(Geometry=pt, Motion=vec_2.Vector)  # -> Geometry, Transform
move_2 = Move(Geometry=pt, Motion=vec.Vector)  # -> Geometry, Transform
rec_2pt = Rectangle2Pt(Plane=PlaneXY(0, 0, 0), PointA=move_2.Geometry, PointB=move.Geometry, Radius=0)  # -> Rectangle, Length
srf = Surface(rec_2pt.Rectangle)

# ---- group: CIRCLE
pt_2 = ConstructPoint(XCoordinate=0, YCoordinate=0, ZCoordinate=0)
circle = CircleCNR(Center=pt_2, Normal=Vector(0, 0, 1), Radius=Slider(30, range=0..100))
srf_2 = Surface(circle)

# ----
pt_3 = Point(pt_2)
srf_3 = Surface(srf)
geo = Geometry(rec_2pt.Rectangle)
topo_choose = Slider(1, range=0..4)
force_density = Slider(4, range=1..10)
multiplication = Multiplication(A=force_density, B=5)

# ---- group: IMPORT GHPYTHON
panel = Panel("""numpy
scipy
networkx
scipy.sparse""")
pythonremote = GHPythonRemote(location="C:\Users\nisha\anaconda3\envs\rhino_remote\python.exe", run=Toggle(True), modules=panel)  # -> out, linked_modules, rpy, import_statements

# ---- group: Dimension
multiplication_2 = Multiplication(A=number_slider_2, B=2)
Y = UnitY(Factor=multiplication_2)
X = UnitX(Factor=multiplication_2)
neg_3 = Negative(Value=Y)
pt_4 = Point(move_2.Geometry)
move_3 = Move(Geometry=move.Geometry, Motion=X)  # -> Geometry, Transform
move_4 = Move(Geometry=pt_4, Motion=neg_3)  # -> Geometry, Transform
neg_4 = Negative(Value=Slider(1, range=0..1))
aligndim = AlignedDimension(
    Plane=PlaneXY(0, 0, 0),
    PointA=move_3.Geometry,
    PointB=move.Geometry,
    Offset=1,
    Text="{0:0.00}",
    Size=Slider(0.2, range=0..1))
aligndim_2 = AlignedDimension(Plane=PlaneXY(0, 0, 0), PointA=move_4.Geometry, PointB=pt_4, Offset=neg_4, Text="{0:0.00}", Size=Slider(0.2, range=0..1))

# ----
X_2 = UnitX(Factor=Slider(30, range=0..100))
neg_5 = Negative(Value=X_2)

# ---- group: FORCE VALUES TAG
number_slider_3 = Slider(60, range=0..1000)
X_3 = UnitX(Factor=number_slider_3)
division = Division(A=number_slider_3, B=Slider(7, range=0..10))
move_5 = Move(Motion=X_3)  # -> Geometry, Transform
area = Area(Geometry=srf_3)  # -> Area, Centroid
neg_6 = Negative(Value=division)
vec_3 = VectorXYZ(XComponent=number_slider_3, YComponent=neg_6, ZComponent=0)  # -> Vector, Length
move_6 = Move(Geometry=area.Centroid, Motion=vec_3.Vector)  # -> Geometry, Transform
tag = TextTag(Location=move_6.Geometry, Text="Diamond Panels")

# ----
X_4 = UnitX(Factor=Slider(30, range=0..100))
neg_7 = Negative(Value=X_4)
matprops = MaterialPropertiesKaramba3D(
    FamilyOfMaterial="Mild Steel",
    Name="Fe250",
    YoungsModulus_kN_cm2="21000",
    InPlaneShearModulus_kN_cm2=8076,
    TransverseShearModulus_kN_cm2=8076,
    SpecificWeight_kN_m3="78.5",
    CoefficientOfThermalExpansion_1_C=1e-05,
    YieldStrength_kN_cm2="25",
    mode="Isotrop")
panel_2 = Panel("""ISNB40M
ISNB50M
ISNB65M
ISNB80M
ISNB90M
ISNB100M
ISNB110M""")
panel_3 = Panel("""ISNB50M
ISNB50M
ISNB65M
ISNB80M
ISNB90M
ISNB100M
ISNB110M""")
panel_4 = Panel("""0.32
0.36
0.36
0.4
0.4
0.45
0.48""")
panel_5 = Panel("""4.83
6.03
7.61
8.89
10.16
11.43
12.7""")
cross_section = CrossSectionKaramba3D(
    FamilyNameOfCrossSection="ISNB",
    NameOfCrossSection=panel_2,
    ElementIdentifier=panel_3,
    Material=matprops,
    Diameter_cm=panel_5,
    WallThickness_cm=panel_4,
    mode="Circular Hollow")
gencstable = GenerateCrossSectionTableKaramba3D(CrossSections=cross_section)
panel_6 = Panel(gencstable)
readcstable = ReadCrossSectionTableFromFileKaramba3D()  # -> CrossSection, Info
number_slider_4 = Slider(20, range=0..100)
neg_8 = Negative(Value=X_4)
vec_4 = VectorXYZ(XComponent=number_slider_4, YComponent=number_slider_4, ZComponent=0)  # -> Vector, Length

# ---- group: MESHING
subdivision = Slider(12, range=6..24)
# MESHING
diamond = DiamondPanels(Surface=srf_3, UDivisions=subdivision, VDivisions=subdivision)  # -> DiamondPanels, TriPanels
trib = TrianglePanelsB(Surface=srf_3, UDivisions=subdivision, VDivisions=subdivision)
quads = QuadPanels(Surface=srf_3, UDivisions=subdivision, VDivisions=subdivision)
tric = TrianglePanelsC(Surface=srf_3, UDivisions=subdivision, VDivisions=subdivision)
tria = TriangularPanelsA(Surface=srf_3, UDivisions=subdivision, VDivisions=subdivision)

# ----
panel_7 = Panel(subdivision)
brep = Brep(flatten([diamond.DiamondPanels, diamond.TriPanels]))
python = GhPythonScript(x=brep, y=tria, z=trib, u=tric, v=quads, i=topo_choose)  # -> out, a; inputs x: list, y: list, z: list, u: list, v: list
# ---------- python: Python ----------
if i==0 :
    a = x
if i==1:
    a = y
if i==2:
    a = z
if i==3:
    a = u
if i==4:
    a = v
# ---------- end python ----------

# ---- group: MESHING (continued)
join = BrepJoin(Breps=python.a)  # -> Breps, Closed
debrep = DeconstructBrep(Brep=join.Breps)  # -> Faces, Edges, Vertices
join_2 = BrepJoin(Breps=debrep.Faces)  # -> Breps, Closed
edges = BrepEdges(Brep=join_2.Breps)  # -> Naked, Interior, NonManifold
line = Line([edges.Naked, edges.Interior])

# ---- group: FORCE DENSITY
panel_8 = Panel(multiplication)
lng = ListLength(Edges=line)
neg_9 = Negative(Value=panel_8)
repeat = RepeatData(Data=neg_9, Length=lng)
multiplication_3 = Multiplication(A=repeat, B=Slider(1, range=0..10))

# ---- group: FIXED POINTS
end = EndPoints(Curve=edges.Naked)  # -> Start, End
pt_5 = Point([end.End, end.Start])
duppt = RemoveDuplicatePts(Points=pt_5, Tolerance=0.01)

# ----
lng_2 = ListLength(List=duppt)

# ---- group: LOADING
area_2 = Area(Geometry=srf_3)  # -> Area, Centroid
pt_6 = Point(debrep.Vertices)
lng_3 = ListLength(List=pt_6)
num = Number("3.5")
multiplication_4 = Multiplication(A=Slider(5, range=0..10), B=area_2.Area)

# ----
subtraction = Subtraction(A=lng_3, B=lng_2)

# ---- group: LOADING (continued)
division_2 = Division(A=multiplication_4, B=subtraction)

# ---- group: FORCE DENSITY METHOD SOLVER
# FORCE DENSITY METHOD
line_2 = Line(line)
end_2 = EndPoints(Curve=line_2)  # -> Start, End
num_2 = Number(multiplication_3)
num_3 = Number(division_2)
python_2 = GhPythonScript(x=end_2.Start, y=end_2.End)  # -> flatten(array); inputs x: Point3d, y: Point3d
# ---------- python_2: Python ----------
import rhinoscriptsyntax as rs


array  = [ ((x[0],x[1]) , (y[0],y[1])) ]


print(array)
# ---------- end python_2 ----------
fixed_points = Point(duppt)
loading = Negative(Value=num_3)
python_3 = GhPythonScript(x=fixed_points)  # -> aa; inputs x: list of Point3d
# ---------- python_3: Python ----------
import rhinoscriptsyntax as rs

#CONVERT GUID DATA TO RS POINT3D
a = []
for item in x:
    a.append(rs.coerce3dpoint(item))

# MAKE ARRAYS OF POINTS
aa=[]
for item in a:
    aa.append((item[0],item[1]))
# ---------- end python_3 ----------
solver = GhPythonScript(fxpt=flatten(python_3), x=flatten(python_2), q=num_2, load=loading)  # -> Cr, Cf, x_ound, y_ound, z_found, fxpt, CON, fxpt_indx, rpt_indx, u; inputs fxpt: list, x: list, q: list
# ---------- solver: Python ----------
import ghpythonremote
import scriptcontext as sc
from ghpythonlib.treehelpers import list_to_tree
ssa = sc.sticky['scipy.sparse']
sci = sc.sticky['scipy']
np =sc.sticky['numpy']

lines = np.array(x)
lines = np.around(lines,decimals =4)
no_lines = len(lines)  # no_lines means no. of lines 

#get unique sets of points save them in matrix u and get indices in indices
lines = np.reshape(lines,(no_lines*2,2))
u,indices = np.unique(lines,return_inverse = True,axis = 0)
unqpt= np.unique(indices,return_inverse = False)
u_pt_len = len(indices)
#print ("length of u is",len(u))
#print('unique points are',u)

# CREATE CONNNECTIVITY MATRIX.
row = np.repeat(np.arange(no_lines),repeats =2 )
col = indices
data = np.tile([1,-1],no_lines)
cols = len(u)
C = ssa.csc_matrix( (data,(row,col)), shape = (no_lines,cols) ).todense()
CON = C.copy()

#GET FIXED POINT INDEX FROM LIST OF UNIQUE POINTS
fxpt = np.array(fxpt)
fxpt = np.around(fxpt,decimals =4)
fxpt_id = np.lexsort((fxpt[:,1],fxpt[:,0]))
fxpt = fxpt[fxpt_id]
res = (u[:, None] == fxpt).all(-1).any(-1)
fxpt_indx = np.where(res)
rpt_indx = np.where(np.invert(res))


#print('FXPT_INDX' , fxpt_indx)
#print(fxpt)

#create Q and Qf matrix for fixed point and free point - connectivity matrices. 
Qf = C[:,fxpt_indx]
Cf = np.reshape(Qf,(Qf.shape[0],Qf.shape[2]))
Qr = C[:,rpt_indx]
Cr = np.reshape(Qr,(Qr.shape[0],Qr.shape[2]))
#Cr = np.delete(C, fxpt_indx, axis=1)
#print(Cr.shape)

#CREATE DIAGONAL FORCE DENSITY MATRIX
q=np.array(q)
q = np.around(q,decimals =4)
Q=np.diag(q)
#print('Q shape',Q.shape)

#CREATE POINT LOAD VECTORS 
p_x = np.zeros((len(u)-len(fxpt),1))
p_y = np.zeros((len(u)-len(fxpt),1))
p_z = np.full((len(u)-len(fxpt),1),load)
#np.tile(load,len(u)-len(fxpt))
#p_z = np.reshape(p_z,(p_z.shape[0],1))

#CREATE FIXED POINT CO-ORDINATE VECTORS
x_f = fxpt[:,0]
x_f = np.reshape(x_f,(x_f.shape[0],))
y_f = fxpt[:,1]
y_f = np.reshape(y_f,(y_f.shape[0],))
z_f=  np.full((x_f.shape[0],), 0)

print(C.shape)

#CREATE D AND D_F
D = Cr.T.dot(Q).dot(Cr)
D_f = Cr.T.dot(Q).dot(Cf)


#GET THE CO-ORDINATES
#print("OK TILL NOW2")

print(np.linalg.inv(D).dot(p_x))
x_ound = np.linalg.inv(D).dot(p_x - np.reshape(D_f.dot(x_f),(D_f.dot(x_f).shape[1],1)))
y_ound = np.linalg.inv(D).dot(p_y - np.reshape(D_f.dot(y_f),(D_f.dot(y_f).shape[1],1)))
z_found = np.linalg.inv(D).dot(p_z - np.reshape(D_f.dot(z_f),(D_f.dot(z_f).shape[1],1)))



print("ok")
# ---------- end solver ----------
python_4 = GhPythonScript(
    Cr=solver.Cr,
    Cf=solver.Cf,
    x=solver.x_ound,
    y=solver.y_ound,
    z=solver.z_found,
    fxpt=solver.fxpt,
    CON=solver.CON,
    fxpt_indx=solver.fxpt_indx,
    rpt_indx=solver.rpt_indx,
    u=solver.u)  # -> a, sptx, spty, sptz, eptx, epty, eptz
# ---------- python_4: Python ----------
import rhinoscriptsyntax as rs
import ghpythonremote
import scriptcontext as sc
from ghpythonlib.treehelpers import list_to_tree
ssa = sc.sticky['scipy.sparse']
sci = sc.sticky['scipy']
np =sc.sticky['numpy']
                
xx =np.array(x)
x=np.reshape(x,(len(x),1))
y = np.array(y)
y=np.reshape(y,(len(y),1))
z = np.array(z)
z = np.around(z,decimals=4)
z=np.reshape(z,(len(z),1))
        
xedo = np.zeros((len(fxpt),1))
fxpt = np.hstack((fxpt,xedo))
fxpt_id = np.lexsort((fxpt[:,1],fxpt[:,0]))
fxpt = fxpt[fxpt_id]
        
xyz=np.concatenate((x,y,z),axis=1)
#xyz= np.vstack((fxpt,xyz))
        
pt_num = len(fxpt)+len(x)
allpt = np.zeros((pt_num,3))
allpt[fxpt_indx] = fxpt
allpt[rpt_indx]=xyz

print(u)
xedo = np.zeros((len(u),1))
u = np.hstack((u,xedo))
print(fxpt)
print(fxpt_indx)
#print(allpt)
                
                
        
con =CON.copy()
#con = np.concatenate((Cf,Cr),axis =1)
cone =CON.copy()
                
con[con==1] =0
con[con==-1] = 1
spt = np.dot(con,allpt)
                
cone[cone==-1] =0
ept = np.dot(cone,allpt)
                
#PUSH DATA TO GRASSHOPPER TREE
sptx = ghpythonremote.obtain(spt[0:,0].tolist())
sptx =list_to_tree(sptx,source=[0,])
                
spty = ghpythonremote.obtain(spt[0:,1].tolist())
spty =list_to_tree(spty,source=[0,])
                
sptz = ghpythonremote.obtain(spt[0:,2].tolist())
sptz =list_to_tree(sptz,source=[0,])
                
eptx = ghpythonremote.obtain(ept[0:,0].tolist())
eptx =list_to_tree(eptx,source=[0,])
                
epty = ghpythonremote.obtain(ept[0:,1].tolist())
epty =list_to_tree(epty,source=[0,])
                
eptz = ghpythonremote.obtain(ept[0:,2].tolist())
eptz =list_to_tree(eptz,source=[0,])
# ---------- end python_4 ----------
pt_7 = ConstructPoint(XCoordinate=flatten(python_4.sptx), YCoordinate=flatten(python_4.spty), ZCoordinate=flatten(python_4.sptz))
pt_8 = ConstructPoint(XCoordinate=flatten(python_4.eptx), YCoordinate=flatten(python_4.epty), ZCoordinate=flatten(python_4.eptz))
ln = Line(StartPoint=pt_7, EndPoint=pt_8)

# ---- group: TAG AND POINT FOR FINAL STRUCTURE
number_slider_5 = Slider(30, range=0..1000)
X_5 = UnitX(Factor=number_slider_5)
division_3 = Division(A=number_slider_5, B=2)
move_7 = Move(FixPoints=fixed_points, Motion=X_5)  # -> Geometry, Transform
area_3 = Area(Geometry=srf_3)  # -> Area, Centroid
neg_10 = Negative(Value=division_3)
panel_9 = Panel("""FINAL GRIDSHELL FORM
Note: Red - Tension
Blue- Compression""")
vec_5 = VectorXYZ(XComponent=number_slider_5, YComponent=neg_10, ZComponent=0)  # -> Vector, Length
move_8 = Move(Geometry=area_3.Centroid, Motion=vec_5.Vector)  # -> Geometry, Transform
tag_2 = TextTag(Location=move_8.Geometry, Text=panel_9)

# ---- group: DISPLAY FINAL STRUCTURE WITH STRESSES
num_4 = Number(flatten(python_4.sptz))
len = Length(Curve=ln)
num_5 = Number(flatten(python_4.eptz))
python_5 = GhPythonScript(x=num_4, y=num_5, z=len)  # -> out, a
# ---------- python_5: Python ----------
print(x , y, z)
if x == 0 and y == 0 :
    a = 0.1 
else:
    a= z
# ---------- end python_5 ----------
multiplication_5 = Multiplication(FD=num_2, B=python_5.a)
abs = Absolute(Value=multiplication_5)
division_4 = Division(A=abs, B=Slider(750, range=0..1000))
pipe = Pipe(Curve=ln, Radius=division_4, Caps=0)
X_6 = UnitX(Factor=number_slider_5)
expression = Expression(
    x=flatten(multiplication_5),
    y=ColourSwatch(SwatchColor=RGB(224, 31, 31)),
    z=ColourSwatch(SwatchColor=RGB(49, 67, 204)),
    Expression="if(x≥0,y,z)")
move_9 = Move(Geometry=pipe, Motion=X_6)  # -> Geometry, Transform
preview = CustomPreview(Geometry=flatten(move_9.Geometry), Material=expression)

# ----
move_10 = Move(Geometry=ln, Motion=neg_5)  # -> Geometry, Transform
wbweave = WeaverbirdsMeshFromLinesWeaveBack(Lines=flatten(move_10.Geometry), MaximumValence=4)

# ---- group: BASE GEOMETRY
number_slider_6 = Slider(250, range=0..1000)
# ANNOTATIONS
division_5 = Division(A=number_slider_5, B=2)
neg_11 = Negative(Value=division_5)
area_4 = Area(Geometry=srf_3)  # -> Area, Centroid
vec_6 = VectorXYZ(XComponent=pt_3, YComponent=neg_11, ZComponent=0)  # -> Vector, Length
move_11 = Move(Geometry=area_4.Centroid, Motion=vec_6.Vector)  # -> Geometry, Transform
tag_3 = TextTag(Location=move_11.Geometry, Text="BASE GEOMETRY WITH MESH")

# ---- group: SHOW MEMBER CENTERLINE
number_slider_7 = Slider(30, range=0..1000)
# MEMBER SIZING
X_7 = UnitX(Factor=number_slider_3)
move_12 = Move(Geometry=ln, Motion=X_7)  # -> Geometry, Transform

# ---- group: TRIBUTARY AREA
mesh = Mesh(wbweave)
demesh = DeconstructMesh(Mesh=mesh)  # -> Vertices, graft(Faces), Colours, Normals
mesh_topo_vertex = MeshTopologyVertex(Mesh=mesh)  # -> ListOfMeshVertices, VertexVertexStructure, VertexFaceStructure
msh2psrf = MeshToPolysurface(Mesh=mesh, Triangles=False, FaceMerge=False)
debrep_2 = DeconstructBrep(Brep=msh2psrf)  # -> Faces, Edges, Vertices
deface = DeconstructFace(Face=demesh.Faces)  # -> CornerA, CornerB, CornerC, CornerD
item = ListItem(List=debrep_2.Faces, Index=mesh_topo_vertex.VertexFaceStructure, Wrap=True)
merge = Merge(Data1=deface.CornerA, Data2=deface.CornerB, Data3=deface.CornerC, Data4=deface.CornerD)
area_5 = Area(Geometry=item)  # -> Area, Centroid
cset = CreateSet(List=merge)  # -> Set, Map
lng_4 = ListLength(List=cset.Set)  # -> flatten(Length)
item_2 = ListItem(List=lng_4, Index=mesh_topo_vertex.VertexFaceStructure, Wrap=True)
division_6 = Division(A=area_5.Area, B=item_2)
ma = MassAddition(Input=division_6)  # -> Result, PartialResults
panel_10 = Panel(ma.Result)

# ---- group: SHOW FORCES
midpt = CurveMiddle(Curve=move_12.Geometry)
roundd = RoundToDecimalPlace(NumberX=multiplication_5, DecimalPlace=Slider(2, range=0..10), RoundType=0)  # -> Rounded, Difference
tag_4 = TextTag(Location=midpt, Text=roundd.Rounded)

# ---- group: TOTAL LOAD PATH
multiplication_6 = Multiplication(FORCE=abs, LENGTH=python_5.a)
ma_2 = MassAddition(Input=multiplication_6)  # -> Result, PartialResults
total_load_path = Panel(ma_2.Result)

# ----
num_6 = Number(simplify(total_load_path))

bnd = Bounds(Numbers=flatten([python_4.sptz, python_4.eptz]))
dedomain = DeconstructDomain(Domain=bnd)  # -> Start, End
panel_11 = Panel(dedomain.End)

num_7 = Number(graft([topo_choose, subdivision, panel_11]))
weight = Panel([num_7, num_6, panel_8])
rec = DataRecorder(weight, DataLimit=-10, RecordData=True)
num_8 = Number(rec)
panel_12 = Panel(num_8)
num_9 = Number(dedomain.End)

line_3 = LineSDL(Start=demesh.Vertices, Direction=demesh.Normals, Length=flatten(panel_10))
X_8 = UnitX(Factor=Slider(2, range=0..10))
dprod = DotProduct(VectorA=X_8, VectorB=line_3, Unitize=False)
Z = UnitZ(Factor=Slider(5, range=0..10))
line_4 = LineSDL(Start=demesh.Vertices, Direction=demesh.Normals, Length=flatten(dprod))
rev = Reverse(Vector=Z)
vec_7 = Vector(line_4)
multiplication_7 = Multiplication(A=panel_10, B=rev)
addition = Addition(A=flatten(vec_7), B=flatten(multiplication_7))

Y_2 = UnitY(Factor=Slider(25, range=0..100))
rev_2 = Reverse(Vector=Y_2)
line_5 = Line(line)
fixed_points_2 = Point(duppt)
move_13 = Move(Geometry=line_5, Motion=rev_2)  # -> Geometry, Transform
move_14 = Move(Geometry=fixed_points_2, Motion=rev_2)  # -> Geometry, Transform
line_6 = Line(move_13.Geometry)
end_3 = EndPoints(Curve=line_6)  # -> Start, End
duppt_2 = RemoveDuplicatePts(Points=[end_3.Start, end_3.End], Tolerance=0.01)
sort_pt = SortPoints(Points=duppt_2)  # -> Points, Indices
fixed_points_3 = Point(move_14.Geometry)
difference = SetDifference(SetA=sort_pt.Points, SetB=fixed_points_3)
end_4 = EndPoints(Curve=line_6)  # -> Start, End
index = ItemIndex(List=sort_pt.Points, Item=difference)
python_6 = GhPythonScript(x=fixed_points_3)  # -> aa; inputs x: list of Point3d; same code as python_3
python_7 = GhPythonScript(x=end_4.Start, y=end_4.End)  # -> flatten(array); inputs x: Point3d, y: Point3d; same code as python_2
item_3 = ListItem(List=addition, Index=index, Wrap=True)
devec = DeconstructVector(Vector=item_3)  # -> XComponent, YComponent, ZComponent
num_10 = Number(devec.ZComponent)
num_11 = Number(devec.XComponent)
num_12 = Number(devec.YComponent)
solver_2 = GhPythonScript(fxpt=flatten(python_6), x=flatten(python_7), px=num_11, py=num_12, pz=num_10, q=num_2)  # -> Cr, Cf, x_ound, y_ound, z_found, fxpt, CON, fxpt_indx, rpt_indx, u; inputs fxpt: list, x: list, px: list, py: list, pz: list, q: list
# ---------- solver_2: Python ----------
import ghpythonremote
import scriptcontext as sc
from ghpythonlib.treehelpers import list_to_tree
ssa = sc.sticky['scipy.sparse']
sci = sc.sticky['scipy']
np =sc.sticky['numpy']

lines = np.array(x)
lines = np.around(lines,decimals =4)
no_lines = len(lines)  # no_lines means no. of lines 

#get unique sets of points save them in matrix u and get indices in indices
lines = np.reshape(lines,(no_lines*2,2))
u,indices = np.unique(lines,return_inverse = True,axis = 0)
unqpt= np.unique(indices,return_inverse = False)
u_pt_len = len(indices)
#print ("length of u is",len(u))
#print('unique points are',u)

# CREATE CONNNECTIVITY MATRIX.
row = np.repeat(np.arange(no_lines),repeats =2 )
col = indices
data = np.tile([1,-1],no_lines)
cols = len(u)
C = ssa.csc_matrix( (data,(row,col)), shape = (no_lines,cols) ).todense()
CON = C.copy()

#GET FIXED POINT INDEX FROM LIST OF UNIQUE POINTS
fxpt = np.array(fxpt)
fxpt = np.around(fxpt,decimals =4)
fxpt_id = np.lexsort((fxpt[:,1],fxpt[:,0]))
fxpt = fxpt[fxpt_id]
res = (u[:, None] == fxpt).all(-1).any(-1)
fxpt_indx = np.where(res)
rpt_indx = np.where(np.invert(res))


#print('FXPT_INDX' , fxpt_indx)
#print(fxpt)

#create Q and Qf matrix for fixed point and free point - connectivity matrices. 
Qf = C[:,fxpt_indx]
Cf = np.reshape(Qf,(Qf.shape[0],Qf.shape[2]))
Qr = C[:,rpt_indx]
Cr = np.reshape(Qr,(Qr.shape[0],Qr.shape[2]))
#Cr = np.delete(C, fxpt_indx, axis=1)
#print(Cr.shape)

#CREATE DIAGONAL FORCE DENSITY MATRIX
q=np.array(q)
q = np.around(q,decimals =4)
Q=np.diag(q)
#print('Q shape',Q.shape)

#CREATE POINT LOAD VECTORS 
#p_x = np.zeros((len(u)-len(fxpt),1))
p_x = np.array(px)
p_x = np.reshape(p_x, (p_x.shape[0],1))
p_y = np.array(py)
p_y = np.reshape(p_y, (p_y.shape[0],1))
p_z = np.array(pz)
p_z = np.reshape(p_z, (p_y.shape[0],1))
#p_y = np.zeros((len(u)-len(fxpt),1))
#p_z = np.full((len(u)-len(fxpt),1),load)
#np.tile(load,len(u)-len(fxpt))
#p_z = np.reshape(p_z,(p_z.shape[0],1))

#CREATE FIXED POINT CO-ORDINATE VECTORS
x_f = fxpt[:,0]
x_f = np.reshape(x_f,(x_f.shape[0],))
y_f = fxpt[:,1]
y_f = np.reshape(y_f,(y_f.shape[0],))
z_f=  np.full((x_f.shape[0],), 0)

print(C.shape)

#CREATE D AND D_F
D = Cr.T.dot(Q).dot(Cr)
D_f = Cr.T.dot(Q).dot(Cf)


#GET THE CO-ORDINATES
#print("OK TILL NOW2")

print(np.linalg.inv(D).dot(p_x))
x_ound = np.linalg.inv(D).dot(p_x - np.reshape(D_f.dot(x_f),(D_f.dot(x_f).shape[1],1)))
y_ound = np.linalg.inv(D).dot(p_y - np.reshape(D_f.dot(y_f),(D_f.dot(y_f).shape[1],1)))
z_found = np.linalg.inv(D).dot(p_z - np.reshape(D_f.dot(z_f),(D_f.dot(z_f).shape[1],1)))



print("ok")
# ---------- end solver_2 ----------
python_8 = GhPythonScript(
    Cr=solver_2.Cr,
    Cf=solver_2.Cf,
    x=solver_2.x_ound,
    y=solver_2.y_ound,
    z=solver_2.z_found,
    fxpt=solver_2.fxpt,
    CON=solver_2.CON,
    fxpt_indx=solver_2.fxpt_indx,
    rpt_indx=solver_2.rpt_indx,
    u=solver_2.u)  # -> a, sptx, spty, sptz, eptx, epty, eptz; same code as python_4
pt_9 = ConstructPoint(XCoordinate=flatten(python_8.sptx), YCoordinate=flatten(python_8.spty), ZCoordinate=flatten(python_8.sptz))
pt_10 = ConstructPoint(XCoordinate=flatten(python_8.eptx), YCoordinate=flatten(python_8.epty), ZCoordinate=flatten(python_8.eptz))
ln_2 = Line(StartPoint=pt_9, EndPoint=pt_10)

move_15 = Move(Geometry=ln, Motion=neg_7)  # -> Geometry, Transform
move_16 = Move(Geometry=fixed_points, Motion=neg_7)  # -> Geometry, Transform
vec_8 = Vector(vec_7)
pt_11 = Point(demesh.Vertices)
move_17 = Move(Geometry=fixed_points_3, Motion=neg_8)  # -> Geometry, Transform

X_9 = UnitX(Factor=Slider(2, range=0..10))
line_7 = LineSDL(Start=demesh.Vertices, Direction=demesh.Normals, Length=flatten(panel_10))
Z_2 = UnitZ(Factor=Slider(5, range=0..10))
rev_3 = Reverse(Vector=Z_2)
multiplication_8 = Multiplication(A=panel_10, B=rev_3)

rev_4 = Reverse(Vector=X_9)

dprod_2 = DotProduct(VectorA=rev_4, VectorB=line_7, Unitize=False)
line_8 = LineSDL(Start=demesh.Vertices, Direction=demesh.Normals, Length=flatten(dprod_2))
vec_9 = Vector(line_8)
addition_2 = Addition(A=flatten(vec_9), B=flatten(multiplication_8))

Y_3 = UnitY(Factor=Slider(25, range=0..100))
rev_5 = Reverse(Vector=Y_3)
line_9 = Line(line)
fixed_points_4 = Point(duppt)
move_18 = Move(Geometry=line_9, Motion=rev_5)  # -> Geometry, Transform
move_19 = Move(Geometry=fixed_points_4, Motion=rev_5)  # -> Geometry, Transform
line_10 = Line(move_18.Geometry)
end_5 = EndPoints(Curve=line_10)  # -> Start, End
duppt_3 = RemoveDuplicatePts(Points=[end_5.Start, end_5.End], Tolerance=0.01)
sort_pt_2 = SortPoints(Points=duppt_3)  # -> Points, Indices
fixed_points_5 = Point(move_19.Geometry)
difference_2 = SetDifference(SetA=sort_pt_2.Points, SetB=fixed_points_5)
end_6 = EndPoints(Curve=line_10)  # -> Start, End
index_2 = ItemIndex(List=sort_pt_2.Points, Item=difference_2)
python_9 = GhPythonScript(x=fixed_points_5)  # -> aa; inputs x: list of Point3d; same code as python_3
python_10 = GhPythonScript(x=end_6.Start, y=end_6.End)  # -> flatten(array); inputs x: Point3d, y: Point3d; same code as python_2
item_4 = ListItem(List=addition_2, Index=index_2, Wrap=True)
devec_2 = DeconstructVector(Vector=item_4)  # -> XComponent, YComponent, ZComponent
num_13 = Number(devec_2.ZComponent)
num_14 = Number(devec_2.XComponent)
num_15 = Number(devec_2.YComponent)
solver_3 = GhPythonScript(fxpt=flatten(python_9), x=flatten(python_10), px=num_14, py=num_15, pz=num_13, q=num_2)  # -> Cr, Cf, x_ound, y_ound, z_found, fxpt, CON, fxpt_indx, rpt_indx, u; inputs fxpt: list, x: list, px: list, py: list, pz: list, q: list; same code as solver_2
python_11 = GhPythonScript(
    Cr=solver_3.Cr,
    Cf=solver_3.Cf,
    x=solver_3.x_ound,
    y=solver_3.y_ound,
    z=solver_3.z_found,
    fxpt=solver_3.fxpt,
    CON=solver_3.CON,
    fxpt_indx=solver_3.fxpt_indx,
    rpt_indx=solver_3.rpt_indx,
    u=solver_3.u)  # -> a, sptx, spty, sptz, eptx, epty, eptz; same code as python_4
pt_12 = ConstructPoint(XCoordinate=flatten(python_11.sptx), YCoordinate=flatten(python_11.spty), ZCoordinate=flatten(python_11.sptz))
pt_13 = ConstructPoint(XCoordinate=flatten(python_11.eptx), YCoordinate=flatten(python_11.epty), ZCoordinate=flatten(python_11.eptz))
ln_3 = Line(StartPoint=pt_12, EndPoint=pt_13)

addition_3 = Addition(A=python_8.spty, B=python_11.spty)
addition_4 = Addition(A=python_8.sptx, B=python_11.sptx)
addition_5 = Addition(A=python_8.sptz, B=python_11.sptz)
addition_6 = Addition(A=python_8.epty, B=python_11.epty)
addition_7 = Addition(A=python_8.eptz, B=python_11.eptz)
addition_8 = Addition(A=python_8.eptx, B=python_11.eptx)
division_7 = Division(A=addition_4, B=2)
division_8 = Division(A=addition_3, B=2)
division_9 = Division(A=addition_5, B=2)
division_10 = Division(A=addition_7, B=2)
division_11 = Division(A=addition_8, B=2)
division_12 = Division(A=addition_6, B=2)
pt_14 = ConstructPoint(XCoordinate=division_11, YCoordinate=division_12, ZCoordinate=division_10)
pt_15 = ConstructPoint(XCoordinate=division_7, YCoordinate=division_8, ZCoordinate=division_9)
ln_4 = Line(StartPoint=pt_15, EndPoint=pt_14)

X_10 = UnitX(Factor=Slider(30, range=0..100))
neg_12 = Negative(Value=X_10)
move_20 = Move(Geometry=ln_4, Motion=neg_12)  # -> Geometry, Transform
wbweave_2 = WeaverbirdsMeshFromLinesWeaveBack(Lines=flatten(move_20.Geometry), MaximumValence=4)
mesh_2 = Mesh(wbweave_2)
demesh_2 = DeconstructMesh(Mesh=mesh_2)  # -> Vertices, graft(Faces), Colours, Normals
mesh_topo_vertex_2 = MeshTopologyVertex(Mesh=mesh_2)  # -> ListOfMeshVertices, VertexVertexStructure, VertexFaceStructure
msh2psrf_2 = MeshToPolysurface(Mesh=mesh_2, Triangles=False, FaceMerge=False)
debrep_3 = DeconstructBrep(Brep=msh2psrf_2)  # -> Faces, Edges, Vertices
deface_2 = DeconstructFace(Face=demesh_2.Faces)  # -> CornerA, CornerB, CornerC, CornerD
item_5 = ListItem(List=debrep_3.Faces, Index=mesh_topo_vertex_2.VertexFaceStructure, Wrap=True)
merge_2 = Merge(Data1=deface_2.CornerA, Data2=deface_2.CornerB, Data3=deface_2.CornerC, Data4=deface_2.CornerD)
area_6 = Area(Geometry=item_5)  # -> Area, Centroid
cset_2 = CreateSet(List=merge_2)  # -> Set, Map
lng_5 = ListLength(List=cset_2.Set)  # -> flatten(Length)
item_6 = ListItem(List=lng_5, Index=mesh_topo_vertex_2.VertexFaceStructure, Wrap=True)
division_13 = Division(A=area_6.Area, B=item_6)
ma_3 = MassAddition(Input=division_13)  # -> Result, PartialResults
panel_13 = Panel(ma_3.Result)
line_11 = LineSDL(Start=demesh_2.Vertices, Direction=demesh_2.Normals, Length=flatten(panel_13))
X_11 = UnitX(Factor=Slider(2, range=0..10))
dprod_3 = DotProduct(VectorA=X_11, VectorB=line_11, Unitize=False)
Z_3 = UnitZ(Factor=Slider(5, range=0..10))
line_12 = LineSDL(Start=demesh_2.Vertices, Direction=demesh_2.Normals, Length=flatten(dprod_3))
rev_6 = Reverse(Vector=Z_3)
multiplication_9 = Multiplication(A=panel_13, B=rev_6)
vec_10 = Vector(line_12)
addition_9 = Addition(A=flatten(vec_10), B=flatten(multiplication_9))

move_21 = Move(Geometry=ln_4, Motion=neg_8)  # -> Geometry, Transform
move_22 = Move(Geometry=ln_4, Motion=vec_4.Vector)  # -> Geometry, Transform
len_2 = Length(Curve=flatten(ln_4))
num_16 = Number(flatten(division_9))
num_17 = Number(flatten(division_10))
python_12 = GhPythonScript(x=num_16, y=num_17, z=len_2)  # -> out, a; same code as python_5
multiplication_10 = Multiplication(FD=num_2, B=python_12.a)
abs_2 = Absolute(Value=multiplication_10)

upperchord_crv = Curve(move_21.Geometry)
supports_pt = Point(move_17.Geometry)
nodesq_pt = Point(mesh_topo_vertex_2.ListOfMeshVertices)
vec_11 = Vector(vec_10)
q_num = Number(flatten(multiplication_9))
pt_16 = Point(demesh_2.Vertices)
Z_4 = UnitZ(Factor=q_num)
# KARAMBA MODEL
panel_14 = Panel("25")
rev_7 = Reverse(Vector=Z_4)
matprops_2 = MaterialPropertiesKaramba3D(
    FamilyOfMaterial="Mild Steel",
    Name="Fe250",
    YoungsModulus_kN_cm2="21000",
    InPlaneShearModulus_kN_cm2=8076,
    TransverseShearModulus_kN_cm2=8076,
    SpecificWeight_kN_m3="78.5",
    CoefficientOfThermalExpansion_1_C=1e-05,
    YieldStrength_kN_cm2=panel_14,
    mode="Isotrop")
matselect = MaterialSelectionKaramba3D(menu=[dropdown(1), dropdown(2)])
panel_15 = Panel("""ISNB40M
ISNB50M
ISNB65M
ISNB80M
ISNB90M
ISNB100M
ISNB110M""")
panel_16 = Panel("""ISNB50M
ISNB50M
ISNB65M
ISNB80M
ISNB90M
ISNB100M
ISNB110M""")
panel_17 = Panel("""0.32
0.36
0.36
0.4
0.4
0.45
0.48""")
panel_18 = Panel("""4.83
6.03
7.61
8.89
10.16
11.43
12.7""")
cross_section_2 = CrossSectionKaramba3D(
    FamilyNameOfCrossSection="ISNB",
    NameOfCrossSection=panel_15,
    ElementIdentifier=panel_16,
    Material=matprops_2,
    Diameter_cm=panel_18,
    WallThickness_cm=panel_17,
    mode="Circular Hollow")
crosecrselect = CrossSectionRangeSelectorKaramba3D(MaximumHeight_cm=-1, MaximumWidth_cm=-1, Material=matselect, menu=[dropdown(2), dropdown(0), dropdown(1)])
supp = SupportKaramba3D(PosInd=supports_pt, menu=[buttons(on, on, on, off, off, off)])
loads = LoadsKaramba3D(ForceVector=[vec_11, rev_7], Local=False, PosInd=[nodesq_pt, pt_16], LCase=0, mode="Point")  # -> flatten(Load)
gencstable_2 = GenerateCrossSectionTableKaramba3D(CrossSections=cross_section_2)
Y_4 = UnitY(Factor="0.001")
beam_joints = BeamJointsKaramba3D(
    ElementIdentifiers="Upper Chord",
    CtKNMAtStartingNode=Vector(0, 0, 0),
    CrKNmRadAtStartingNode=Vector(0, 0, 0),
    CtKNMAtEndNode=Vector(0, 0, 0),
    CrKNmRadAtEndNode=Vector(0, 0, 0),
    menu=[buttons(off, off, off, off, off, off), buttons(off, off, off, off, off, off)])
linetobeam = LineToBeamKaramba3D(
    Line=upperchord_crv,
    Identifier=graft("Upper Chord"),
    CrossSection=cross_section_2,
    New=True,
    Remove=True,
    LimitDistance_m=0.005)  # -> Element, Points, Info
panel_19 = Panel(gencstable_2)
readcstable_2 = ReadCrossSectionTableFromFileKaramba3D()  # -> CrossSection, Info
assemble = AssembleModelKaramba3D(
    Elem=flatten(linetobeam.Element),
    Support=flatten(supp),
    Load=flatten(loads),
    Joint=flatten(beam_joints),
    LimitDistance_m=0.005)  # -> Model, Info, Mass_kg, CenterOfGravity
analyze = AnalyzeKaramba3D(Model=assemble.Model)  # -> CalculatedModel, MaximumDisplacement_cm, ResultingForceOfGravity_kN, ElasticEnergy_kNm
modelview = ModelViewKaramba3D(Model=analyze.CalculatedModel, ResultFactors=1, ResultCase=-1)  # -> Model, DeformedMesh, DeformedAxes, DeformedModel
b_forces = BeamForcesKaramba3D(AnalyzedModel=analyze.CalculatedModel, LCase=-1, MaximumDistanceBetweenResults_m=-1, NumberOfResultsPerBeamElement=2)  # -> AnalyzedModel, NormalForce_kN, ShearForceVz_kN, ShearForceVy_kN, BendingMomentMt_kNm, BendingMomentMy_kNm, BendingMomentMz_kNm
# KARAMBA OPTIMIZATION
opticrosec = OptimizeCrossSectionKaramba3D(
    Model=assemble.Model,
    CrossSections=cross_section_2,
    MaximumUtilization=1,
    MaximumDisplacement_cm=-1,
    UltimateLimitStateIterations="1",
    DisplacementIterations=5,
    NumberOfSamplePoints=3,
    ElasticDesign=True,
    GammaM0=1,
    GammaM1=1)  # -> ModelWithOptimizedCrossSections, Info, Mass_kg, MaximumDisplacement_cm, ElasticEnergy_kNm
item_7 = ListItem(List=b_forces.NormalForce_kN, Index=0, Wrap=True)  # -> flatten(Item)
beamview = BeamViewKaramba3D(Model=modelview.Model)  # -> Model, MeshesOfRenderedBeams, DeformedBeamAxes, LegendColors, LegendTags
num_18 = Number(opticrosec.Mass_kg)
modelview_2 = ModelViewKaramba3D(Model=opticrosec.ModelWithOptimizedCrossSections, ResultFactors=1, ResultCase=-1)  # -> Model, DeformedMesh, DeformedAxes, DeformedModel
nodedisp = NodalDisplacementsKaramba3D(AnalyzedModel=modelview.Model, ResultCase=0)  # -> AnalyzedModel, NodalTranslations_m, NodalRotations_rad
curvepoint = PointOnCurve(beamview.DeformedBeamAxes, parameter=0.5)
roundd_2 = RoundToDecimalPlace(NumberX=item_7, DecimalPlace=Slider(2, range=0..10), RoundType=0)  # -> Rounded, Difference
tag_5 = TextTag(Location=curvepoint, Text=roundd_2.Rounded)
item_8 = ListItem(List=nodedisp.NodalTranslations_m, Index=Slider(80, range=0..100), Wrap=True)
panel_20 = Panel(item_8)
devec_3 = DeconstructVector(Vector=nodedisp.NodalTranslations_m)  # -> XComponent, YComponent, ZComponent
abs_3 = Absolute(Value=devec_3.ZComponent)
abs_4 = Absolute(Value=devec_3.XComponent)
abs_5 = Absolute(Value=devec_3.YComponent)
hilonums = HighestLowestNumbers(Numbers=abs_3)  # -> Highest, Lowest
hilonums_2 = HighestLowestNumbers(Numbers=abs_4)  # -> Highest, Lowest
hilonums_3 = HighestLowestNumbers(Numbers=abs_5)  # -> Highest, Lowest
deflection_max = Panel(hilonums.Highest)
deflection_max_2 = Panel(hilonums_2.Highest)
deflection_max_3 = Panel(hilonums_3.Highest)

multiplication_11 = Multiplication(FORCE=flatten(abs_2), LENGTH=flatten(python_12.a))  # -> flatten(Result)
ma_4 = MassAddition(Input=multiplication_11)  # -> Result, PartialResults
total_load_path_2 = Panel(ma_4.Result)

# ----
# KARAMBA MODEL
# KARAMBA OPTIMIZATION
upperchord_crv_2 = Curve(move_15.Geometry)
supports_pt_2 = Point(move_16.Geometry)
q_num_2 = Number(flatten(multiplication_7))
nodesq_pt_2 = Point(mesh_topo_vertex.ListOfMeshVertices)
matselect_2 = MaterialSelectionKaramba3D(menu=[dropdown(1), dropdown(2)])
supp_2 = SupportKaramba3D(PosInd=supports_pt_2, menu=[buttons(on, on, on, off, off, off)])
Y_5 = UnitY(Factor="0.001")
beam_joints_2 = BeamJointsKaramba3D(
    ElementIdentifiers="Upper Chord",
    CtKNMAtStartingNode=Vector(0, 0, 0),
    CrKNmRadAtStartingNode=Vector(0, 0, 0),
    CtKNMAtEndNode=Vector(0, 0, 0),
    CrKNmRadAtEndNode=Vector(0, 0, 0),
    menu=[buttons(off, off, off, off, off, off), buttons(off, off, off, off, off, off)])

Z_5 = UnitZ(Factor=q_num_2)
rev_8 = Reverse(Vector=Z_5)

# ---- group: Cross Section Range Selector (Karamba3D)
crosecrselect_2 = CrossSectionRangeSelectorKaramba3D(MaximumHeight_cm=-1, MaximumWidth_cm=-1, Material=matselect_2, menu=[dropdown(2), dropdown(0), dropdown(1)])

# ---- group: Loads (Karamba3D)
loads_2 = LoadsKaramba3D(ForceVector=[vec_8, rev_8], Local=False, PosInd=[nodesq_pt_2, pt_11], LCase=0, mode="Point")  # -> flatten(Load)

# ---- group: Line to Beam (Karamba3D)
linetobeam_2 = LineToBeamKaramba3D(
    Line=upperchord_crv_2,
    Identifier=graft("Upper Chord"),
    CrossSection=cross_section,
    New=True,
    Remove=True,
    LimitDistance_m=0.005)  # -> Element, Points, Info

# ---- group: Assemble Model (Karamba3D)
assemble_2 = AssembleModelKaramba3D(
    Elem=flatten(linetobeam_2.Element),
    Support=flatten(supp_2),
    Load=flatten(loads_2),
    Joint=flatten(beam_joints_2),
    LimitDistance_m=0.005)  # -> Model, Info, Mass_kg, CenterOfGravity

# ---- group: Analyze (Karamba3D)
analyze_2 = AnalyzeKaramba3D(Model=assemble_2.Model)  # -> CalculatedModel, MaximumDisplacement_cm, ResultingForceOfGravity_kN, ElasticEnergy_kNm

# ---- group: Model View (Karamba3D)
modelview_3 = ModelViewKaramba3D(Model=analyze_2.CalculatedModel, ResultFactors=1, ResultCase=-1)  # -> Model, DeformedMesh, DeformedAxes, DeformedModel

# ---- group: Optimize Cross Section (Karamba3D)
opticrosec_2 = OptimizeCrossSectionKaramba3D(
    Model=assemble_2.Model,
    CrossSections=cross_section,
    MaximumUtilization=1,
    MaximumDisplacement_cm=-1,
    UltimateLimitStateIterations="1",
    DisplacementIterations=5,
    NumberOfSamplePoints=3,
    ElasticDesign=True,
    GammaM0=1,
    GammaM1=1)  # -> ModelWithOptimizedCrossSections, Info, Mass_kg, MaximumDisplacement_cm, ElasticEnergy_kNm

# ---- group: Beam View (Karamba3D)
beamview_2 = BeamViewKaramba3D(Model=modelview_3.Model)  # -> Model, MeshesOfRenderedBeams, DeformedBeamAxes, LegendColors, LegendTags

# ----
b_forces_2 = BeamForcesKaramba3D(AnalyzedModel=analyze_2.CalculatedModel, LCase=-1, MaximumDistanceBetweenResults_m=-1, NumberOfResultsPerBeamElement=2)  # -> AnalyzedModel, NormalForce_kN, ShearForceVz_kN, ShearForceVy_kN, BendingMomentMt_kNm, BendingMomentMy_kNm, BendingMomentMz_kNm
item_9 = ListItem(List=b_forces_2.NormalForce_kN, Index=0, Wrap=True)  # -> flatten(Item)
num_19 = Number(opticrosec_2.Mass_kg)
nodedisp_2 = NodalDisplacementsKaramba3D(AnalyzedModel=modelview_3.Model, ResultCase=0)  # -> AnalyzedModel, NodalTranslations_m, NodalRotations_rad
curvepoint_2 = PointOnCurve(beamview_2.DeformedBeamAxes, parameter=0.5)
roundd_3 = RoundToDecimalPlace(NumberX=item_9, DecimalPlace=Slider(2, range=0..10), RoundType=0)  # -> Rounded, Difference
tag_6 = TextTag(Location=curvepoint_2, Text=roundd_3.Rounded)
item_10 = ListItem(List=nodedisp_2.NodalTranslations_m, Index=Slider(80, range=0..100), Wrap=True)
panel_21 = Panel(item_10)

# ---- group: Model View (Karamba3D)
modelview_4 = ModelViewKaramba3D(Model=opticrosec_2.ModelWithOptimizedCrossSections, ResultFactors=1, ResultCase=-1)  # -> Model, DeformedMesh, DeformedAxes, DeformedModel

# ----
devec_4 = DeconstructVector(Vector=nodedisp_2.NodalTranslations_m)  # -> XComponent, YComponent, ZComponent
abs_6 = Absolute(Value=devec_4.ZComponent)
abs_7 = Absolute(Value=devec_4.XComponent)
abs_8 = Absolute(Value=devec_4.YComponent)
hilonums_4 = HighestLowestNumbers(Numbers=abs_6)  # -> Highest, Lowest
hilonums_5 = HighestLowestNumbers(Numbers=abs_7)  # -> Highest, Lowest
hilonums_6 = HighestLowestNumbers(Numbers=abs_8)  # -> Highest, Lowest
deflection_max_4 = Panel(hilonums_4.Highest)
deflection_max_5 = Panel(hilonums_6.Highest)
deflection_max_6 = Panel(hilonums_5.Highest)

# ==== cluster GHPythonRemote: Connects the Grasshopper Python component to an external Python instance.
python = PythonScript()  # -> gh_parent_doc_dir
# ---------- python: Python ----------
from os import path

gh_parent_doc_dir = path.abspath(path.dirname(ghenv.Component.OnPingDocument().Owner.OnPingDocument().FilePath))
# ---------- end python ----------
# GH to python remote example.
# Pierre Cuvilliers, 2017-2018
# Released under the MIT license
# github.com/pilcru/ghpythonremote
# Runs and connects to an external python engine, and
# assigns imported modules to scriptcontext.sticky variables.
# 
# Arguments:
#       code (str): Path to the GH_to_python_sticky.py code file.
#       location (str): Path to a python executable, or to a folder
#             containing `python.exe`, or the name of a conda-created
#             virtual environment prefixed by `conda://` (`conda://env_name`).
#             If empty, finds python from your windows %PATH%.
#       run (boolean): Creates the connection, and imports new
#             modules, when turned to True. Kills the connection,
#             and deletes the references to the imports, when turned
#             to False.
#       modules (str list): List of module names to import in the
#             remote python. They will be added to the
#             scriptcontext.sticky dictionary, allowing them to be
#             reused from other python components in the same
#             Grasshopper document. Submodules (for example
#             `numpy.linalg` have to be added explicitly to this list
#             to be available later.
#       log_level (str from ['NOTSET', 'DEBUG', 'INFO', 'WARNING', 'ERROR', 'CRITICAL']):
#             Logging level to use for the local IronPython and the
#             remote python instance.
#       working_dir (str): Working directory for the remote python
#             instance.
# 
# Returns:
#       out (str): Console output with DEBUG information.
#       linked_modules (str list): list of imported module names.
#       rpy (rpyc connection object): The object representing the
#             remote Python interpreter.
location = ClusterInput()  # location (str): Path to a python executable, or to a folder containing `python.exe`, or the name of a conda-created virtual environment prefixed by `conda://` (`conda://env_name`). If empty, finds python from your windows %PATH%.
run = ClusterInput()  # run (boolean): Creates the connection, and imports new modules, when turned to True. Kills the connection,and deletes the references to the imports, when turned to False.
modules = ClusterInput()  # modules (str list): List of module names to import in the remote python. They will be added to the scriptcontext.sticky dictionary, allowing them to be reused from other python components in the same Grasshopper document. Submodules (for example `numpy.linalg` have to be added explicitly to this list to be available later.
list = ValueList({"CRITICAL", "ERROR", "WARNING", "INFO", "DEBUG", "NOTSET"}, selected="DEBUG")
panel = Panel(python)
ghpythonremote = GHPythonRemote(location=location, run=run, modules=modules, log_level=list, working_dir=panel)  # -> out, linked_modules, rpy; inputs run: Boolean, modules: list
# ---------- ghpythonremote: Python ----------
import inspect
import logging
from os import path
import sys
from time import sleep

import scriptcontext

import ghpythonremote
from ghpythonremote.connectors import GrasshopperToPythonRemote

local_log_level = getattr(logging, log_level, logging.WARNING)
logger = logging.getLogger("ghpythonremote")
logger.setLevel(local_log_level)
ch = logging.StreamHandler()
ch.setLevel(local_log_level)
formatter = logging.Formatter("%(levelname)s: %(name)s:\n%(message)s")
ch.setFormatter(formatter)
logger.handlers = []
logger.addHandler(ch)
logger = logging.getLogger("ghpythonremote.GH_to_python")

ROOT = path.abspath(path.dirname(inspect.getfile(ghpythonremote)))
rpyc_server_py = path.join(ROOT, "pythonservice.py")

# Set connection to CLOSED if this is the first run
# and initialize set of linked modules
try:
    remote_python_status
except NameError:
    remote_python_status = "CLOSED"
    lkd_modules = set()

# Wait for connection to connect or terminate
timer = 0
while remote_python_status == "CONNECTING" or remote_python_status == "CLOSING":
    sleep(1)
    timer += 1
    if timer == 10:
        try:
            gh2py_manager.__exit__(*sys.exc_info())
        except Exception:
            pass
        remote_python_status = "CLOSED"
        lkd_modules = set()
        raise RuntimeError(
            "Connection left in an inconsistent state and not returning. Reset "
            "everything."
        )

if run:
    if not remote_python_status == "OPEN":
        remote_python_status = "CONNECTING"
        gh2py_manager = GrasshopperToPythonRemote(
            rpyc_server_py,
            location=location,
            timeout=10,
            port=None,
            log_level=log_level,
            working_dir=working_dir,
        )
        gh2py = gh2py_manager.__enter__()
        remote_python_status = "OPEN"

    # Stuff that we can reach
    rpymod = gh2py.py_remote_modules  # A getter function for a named python module
    rpy = gh2py.connection  # Represents the remote instance root object
    scriptcontext.sticky["rpy"] = rpy
    # Add modules
    for mod in modules:
        try:
            scriptcontext.sticky[mod] = rpymod(mod)
            lkd_modules.add(mod)
        except ImportError:
            gh2py_manager.__exit__(*sys.exc_info())
            raise

elif not remote_python_status == "CLOSED":
    remote_python_status = "CLOSING"
    # Remove linked modules
    for mod in lkd_modules:
        del scriptcontext.sticky[mod]
    del scriptcontext.sticky["rpy"]
    gh2py_manager.__exit__(*sys.exc_info())
    lkd_modules = set()
    remote_python_status = "CLOSED"

# Change variable name because ghpython resets outputs to None before each run
linked_modules = lkd_modules

logger.info("GH to python connection is {}".format(remote_python_status))
# ---------- end ghpythonremote ----------
out = ClusterOutput(ghpythonremote.out)  # Console output.
linked_modules = ClusterOutput(ghpythonremote.linked_modules)  # Names of modules that were successfully added to the scriptcontext.sticky dictionary.
rpy = ClusterOutput(ghpythonremote.rpy)  # The object representing the remote python instance
python_2 = PythonScript(module_names=ghpythonremote.linked_modules)  # -> import_statements; inputs module_names: list
# ---------- python_2: Python ----------
import_statements = ["import scriptcontext as sc"]
for module_name in module_names:
    import_statements.append("{0} = sc.sticky['{0}']".format(module_name))

if len(module_names) == 0:
    import_statements = []
# ---------- end python_2 ----------
import_statements = ClusterOutput(python_2)  # Useful import statements to use the imported modules in your scripts.
