# Grasshopper definition wind load different forms.gh (Grasshopper 1.0.7)
# Copyright: © 2017-2018 Pierre Cuvilliers, Caitlin Mueller, Massachusetts Institute of Technology
# plug-ins: Pufferfish, LunchBox, Kangaroo2 Components, karambaGH, Weaverbird, Sandbox Topology, EleFront

# ---- group: RECTANGLE
number_slider = Slider(6, range=0..100)
number_slider_2 = Slider(6, range=0..100)
# BASE GEOMETRY
pt = ConstructPoint(XCoordinate=0, YCoordinate=0, ZCoordinate=0)
neg = Negative(Value=number_slider)
neg_2 = Negative(Value=number_slider_2)
vec = VectorXYZ(XComponent=number_slider, YComponent=number_slider_2, ZComponent=0)  # -> Vector, Length
vec_2 = VectorXYZ(XComponent=neg, YComponent=neg_2, ZComponent=0)  # -> Vector, Length
move = Move(Geometry=pt, Motion=vec_2.Vector)  # -> Geometry, Transform
move_2 = Move(Geometry=pt, Motion=vec.Vector)  # -> Geometry, Transform
rec_2pt = Rectangle2Pt(Plane=PlaneXY(0, 0, 0), PointA=move_2.Geometry, PointB=move.Geometry, Radius=0)  # -> Rectangle, Length
srf = Surface(rec_2pt.Rectangle)

# ---- group: CIRCLE
pt_2 = ConstructPoint(XCoordinate=0, YCoordinate=0, ZCoordinate=0)
circle = CircleCNR(Center=pt_2, Normal=Vector(0, 0, 1), Radius=Slider(30, range=0..100))
srf_2 = Surface(circle)

# ----
pt_3 = Point(pt_2)

# ---- group: IMPORT GHPYTHON
panel = Panel("""numpy
scipy
networkx
scipy.sparse""")
pythonremote = GHPythonRemote(location="C:\Users\nisha\anaconda3\envs\rhino_remote\python.exe", run=Toggle(True), modules=panel)  # -> out, linked_modules, rpy, import_statements

# ----
srf_3 = Surface(srf)
geo = Geometry(rec_2pt.Rectangle)

number_slider_3 = Slider(60, range=0..100)
number_slider_4 = Slider(6, range=0..10)
neg_3 = Negative(Value=number_slider_4)
pt_4 = ConstructPoint(XCoordinate=0, YCoordinate=0, ZCoordinate=0)
dom = ConstructDomain(DomainStart=neg_3, DomainEnd=number_slider_4)
rectangle = Rectangle(Plane=pt_4, XSize=dom, YSize=dom, Radius=0)  # -> Rectangle, Length
explode = Explode(Curve=rectangle.Rectangle, Recursive=True)  # -> Segments, Vertices
item = ListItem(List=explode.Segments, Index=Slider(1, range=0..1), Wrap=True)
item_2 = ListItem(List=explode.Segments, Index=0, Wrap=True)
divide = DivideCurve(Curve=explode.Segments, Count=10, Kinks=False)  # -> Points, Tangents, Parameters
divide_2 = DivideCurve(Curve=item_2, Count=10, Kinks=False)  # -> Points, Tangents, Parameters
divide_3 = DivideCurve(Curve=item, Count=10, Kinks=False)  # -> Points, Tangents, Parameters
shatter = Shatter(Curve=explode.Segments, Parameters=divide.Parameters)
rev = ReverseList(List=divide_3.Points)
ln = Line(StartPoint=divide_2.Points, EndPoint=rev)
panel_2 = Panel("""0.5*pi
pi
1.5*pi""")
rotate = Rotate(Geometry=ln, Angle=graft(panel_2), Plane=pt_4)  # -> Geometry, Transform
llinter = LineLineIntersectionKaramba3D(Line=flatten([rotate.Geometry, ln, shatter]), LimitDistance_m=0.005)  # -> IntersectionPoints, flatten(LineSubSegements)
dupln = RemoveDuplicateLines(Lines=llinter.LineSubSegements, Tolerance=0.01)

number_slider_5 = Slider(-30, range=-100..-30)
topo_choose = Slider(0, range=0..4)
force_density = Slider(3, range=1..10)

number_slider_6 = Slider(6, range=0..10)
neg_4 = Negative(Value=number_slider_6)
pt_5 = ConstructPoint(XCoordinate=0, YCoordinate=Slider(60, range=0..100), ZCoordinate=0)
dom_2 = ConstructDomain(DomainStart=neg_4, DomainEnd=number_slider_6)
rectangle_2 = Rectangle(Plane=pt_5, XSize=dom_2, YSize=dom_2, Radius=0)  # -> Rectangle, Length
explode_2 = Explode(Curve=rectangle_2.Rectangle, Recursive=True)  # -> Segments, Vertices
item_3 = ListItem(List=explode_2.Segments, Index=Slider(1, range=0..1), Wrap=True)
item_4 = ListItem(List=explode_2.Segments, Index=0, Wrap=True)
divide_4 = DivideCurve(Curve=explode_2.Segments, Count=10, Kinks=False)  # -> Points, Tangents, Parameters
divide_5 = DivideCurve(Curve=item_4, Count=10, Kinks=False)  # -> Points, Tangents, Parameters
divide_6 = DivideCurve(Curve=item_3, Count=10, Kinks=False)  # -> Points, Tangents, Parameters
shatter_2 = Shatter(Curve=explode_2.Segments, Parameters=divide_4.Parameters)
rev_2 = ReverseList(List=divide_6.Points)
ln_2 = Line(StartPoint=divide_5.Points, EndPoint=rev_2)
panel_3 = Panel("""0.5*pi
pi
1.5*pi""")
rotate_2 = Rotate(Geometry=ln_2, Angle=graft(panel_3), Plane=pt_5)  # -> Geometry, Transform
llinter_2 = LineLineIntersectionKaramba3D(Line=flatten([rotate_2.Geometry, ln_2, shatter_2]), LimitDistance_m=0.005)  # -> IntersectionPoints, flatten(LineSubSegements)
dupln_2 = RemoveDuplicateLines(Lines=llinter_2.LineSubSegements, Tolerance=0.01)

multiplication = Multiplication(A=force_density, B=5)
# FORCE DENSITY METHOD
duppt = RemoveDuplicatePts(Points=flatten(divide_4.Points), Tolerance=0.01)
number_slider_7 = Slider(3, range=0..10)

# ---- group: Dimension
multiplication_2 = Multiplication(A=number_slider_2, B=2)
Y = UnitY(Factor=multiplication_2)
X = UnitX(Factor=multiplication_2)
neg_5 = Negative(Value=Y)
pt_6 = Point(move_2.Geometry)
move_3 = Move(Geometry=move.Geometry, Motion=X)  # -> Geometry, Transform
move_4 = Move(Geometry=pt_6, Motion=neg_5)  # -> Geometry, Transform
neg_6 = Negative(Value=Slider(1, range=0..1))
aligndim = AlignedDimension(
    Plane=PlaneXY(0, 0, 0),
    PointA=move_3.Geometry,
    PointB=move.Geometry,
    Offset=1,
    Text="{0:0.00}",
    Size=Slider(0.2, range=0..1))
aligndim_2 = AlignedDimension(Plane=PlaneXY(0, 0, 0), PointA=move_4.Geometry, PointB=pt_6, Offset=neg_6, Text="{0:0.00}", Size=Slider(0.2, range=0..1))

# ----
panel_4 = Panel("""0.5*pi
pi
1.5*pi""")
panel_5 = Panel("""0.5*pi
pi
1.5*pi""")
X_2 = UnitX(Factor=Slider(30, range=0..100))
matprops = MaterialPropertiesKaramba3D(
    FamilyOfMaterial="Mild Steel",
    Name="Fe250",
    YoungsModulus_kN_cm2="21000",
    InPlaneShearModulus_kN_cm2=8076,
    TransverseShearModulus_kN_cm2=8076,
    SpecificWeight_kN_m3="78.5",
    CoefficientOfThermalExpansion_1_C=1e-05,
    YieldStrength_kN_cm2="25",
    mode="Isotrop")
panel_6 = Panel("""ISNB40M
ISNB50M
ISNB65M
ISNB80M
ISNB90M
ISNB100M
ISNB110M""")
panel_7 = Panel("""ISNB50M
ISNB50M
ISNB65M
ISNB80M
ISNB90M
ISNB100M
ISNB110M""")
panel_8 = Panel("""0.32
0.36
0.36
0.4
0.4
0.45
0.48""")
panel_9 = Panel("""4.83
6.03
7.61
8.89
10.16
11.43
12.7""")
cross_section = CrossSectionKaramba3D(
    FamilyNameOfCrossSection="ISNB",
    NameOfCrossSection=panel_6,
    ElementIdentifier=panel_7,
    Material=matprops,
    Diameter_cm=panel_9,
    WallThickness_cm=panel_8,
    mode="Circular Hollow")
gencstable = GenerateCrossSectionTableKaramba3D(CrossSections=cross_section)
panel_10 = Panel(gencstable)
readcstable = ReadCrossSectionTableFromFileKaramba3D()  # -> CrossSection, Info

number_slider_8 = Slider(6, range=0..10)
number_slider_9 = Slider(-30, range=-100..-30)
neg_7 = Negative(Value=number_slider_8)
pt_7 = ConstructPoint(XCoordinate=0, YCoordinate=0, ZCoordinate=0)
dom_3 = ConstructDomain(DomainStart=neg_7, DomainEnd=number_slider_8)
rectangle_3 = Rectangle(Plane=pt_7, XSize=dom_3, YSize=dom_3, Radius=0)  # -> Rectangle, Length
box_corners = BoxCorners(Box=rectangle_3.Rectangle)  # -> CornerA, CornerB, CornerC, CornerD, CornerE, CornerF, CornerG, CornerH
box_corners_2 = BoxCorners(Box=rectangle_3.Rectangle)  # -> CornerA, CornerB, CornerC, CornerD, CornerE, CornerF, CornerG, CornerH
explode_3 = Explode(Curve=rectangle_3.Rectangle, Recursive=True)  # -> Segments, Vertices
item_5 = ListItem(List=explode_3.Segments, Index=0, Wrap=True)

explode_4 = Explode(Curve=rectangle_3.Rectangle, Recursive=True)  # -> Segments, Vertices
divide_7 = DivideCurve(Curve=explode_4.Segments, Count=10, Kinks=False)  # -> Points, Tangents, Parameters

# ---- group: MESHING
subdivision = Slider(20, range=6..24)
# MESHING
diamond = DiamondPanels(Surface=srf_3, UDivisions=subdivision, VDivisions=subdivision)  # -> DiamondPanels, TriPanels
trib = TrianglePanelsB(Surface=srf_3, UDivisions=subdivision, VDivisions=subdivision)
quads = QuadPanels(Surface=srf_3, UDivisions=subdivision, VDivisions=subdivision)
tric = TrianglePanelsC(Surface=srf_3, UDivisions=subdivision, VDivisions=subdivision)
tria = TriangularPanelsA(Surface=srf_3, UDivisions=subdivision, VDivisions=subdivision)

# ----
panel_11 = Panel(subdivision)
brep = Brep(flatten([diamond.DiamondPanels, diamond.TriPanels]))
python = GhPythonScript(x=brep, y=tria, z=trib, u=tric, v=quads, i=topo_choose)  # -> out, a; inputs x: list, y: list, z: list, u: list, v: list
# ---------- python: Python ----------
if i==0 :
    a = x
if i==1:
    a = y
if i==2:
    a = z
if i==3:
    a = u
if i==4:
    a = v
# ---------- end python ----------

# ---- group: MESHING (continued)
join = BrepJoin(Breps=python.a)  # -> Breps, Closed
debrep = DeconstructBrep(Brep=join.Breps)  # -> Faces, Edges, Vertices
join_2 = BrepJoin(Breps=debrep.Faces)  # -> Breps, Closed
edges = BrepEdges(Brep=join_2.Breps)  # -> Naked, Interior, NonManifold
line = Line([edges.Naked, edges.Interior])

# ---- group: FIXED POINTS
end = EndPoints(Curve=edges.Naked)  # -> Start, End
pt_8 = Point([end.End, end.Start])
duppt_2 = RemoveDuplicatePts(Points=pt_8, Tolerance=0.01)

# ----
lng = ListLength(List=duppt_2)

number_slider_10 = Slider(6, range=0..10)
number_slider_11 = Slider(30, range=0..100)
neg_8 = Negative(Value=number_slider_10)
dom_4 = ConstructDomain(DomainStart=neg_8, DomainEnd=number_slider_10)
number_slider_12 = Slider(2, range=0..10)
pt_9 = ConstructPoint(XCoordinate=0, YCoordinate=number_slider_11, ZCoordinate=0)
rectangle_4 = Rectangle(Plane=pt_9, XSize=dom_4, YSize=dom_4, Radius=0)  # -> Rectangle, Length
area = Area(Geometry=rectangle_4.Rectangle)  # -> Area, Centroid
panel_12 = Panel("""0.5*pi
pi
1.5*pi""")
pt_10 = ConstructPoint(XCoordinate=0, YCoordinate=number_slider_11, ZCoordinate=0)

explode_5 = Explode(Curve=rectangle_4.Rectangle, Recursive=True)  # -> Segments, Vertices
divide_8 = DivideCurve(Curve=explode_5.Segments, Count=10, Kinks=False)  # -> Points, Tangents, Parameters

# ---- group: FORCE DENSITY
panel_13 = Panel(multiplication)
neg_9 = Negative(Value=panel_13)

# ---- group: LOADING
area_2 = Area(Geometry=srf_3)  # -> Area, Centroid
pt_11 = Point(debrep.Vertices)
lng_2 = ListLength(List=pt_11)
num = Number("3.5")
multiplication_3 = Multiplication(A=Slider(5, range=0..10), B=area_2.Area)

# ----
subtraction = Subtraction(A=lng_2, B=lng)

# ---- group: LOADING (continued)
division = Division(A=multiplication_3, B=subtraction)

# ---- group: FORCE DENSITY METHOD SOLVER
line_2 = Line(dupln_2)
end_2 = EndPoints(Curve=line_2)  # -> Start, End
fixed_points = Point(flatten(duppt))
num_2 = Number(division)
python_2 = GhPythonScript(x=end_2.Start, y=end_2.End)  # -> flatten(array); inputs x: Point3d, y: Point3d
# ---------- python_2: Python ----------
import rhinoscriptsyntax as rs


array  = [ ((x[0],x[1]) , (y[0],y[1])) ]


print(array)
# ---------- end python_2 ----------
python_3 = GhPythonScript(x=fixed_points)  # -> aa; inputs x: list of Point3d
# ---------- python_3: Python ----------
import rhinoscriptsyntax as rs

#CONVERT GUID DATA TO RS POINT3D
a = []
for item in x:
    a.append(rs.coerce3dpoint(item))

# MAKE ARRAYS OF POINTS
aa=[]
for item in a:
    aa.append((item[0],item[1]))
# ---------- end python_3 ----------
loading = Negative(Value=num_2)

# ---- group: FORCE DENSITY (continued)
lng_3 = ListLength(Edges=line_2)
repeat = RepeatData(Data=neg_9, Length=lng_3)
multiplication_4 = Multiplication(A=repeat, B=Slider(1, range=0..10))

# ---- group: FORCE DENSITY METHOD SOLVER (continued)
num_3 = Number(multiplication_4)
solver = GhPythonScript(fxpt=flatten(python_3), x=flatten(python_2), q=num_3, load=loading)  # -> Cr, Cf, x_ound, y_ound, z_found, fxpt, CON, fxpt_indx, rpt_indx, u; inputs fxpt: list, x: list, q: list
# ---------- solver: Python ----------
import ghpythonremote
import scriptcontext as sc
from ghpythonlib.treehelpers import list_to_tree
ssa = sc.sticky['scipy.sparse']
sci = sc.sticky['scipy']
np =sc.sticky['numpy']

lines = np.array(x)
lines = np.around(lines,decimals =4)
no_lines = len(lines)  # no_lines means no. of lines 

#get unique sets of points save them in matrix u and get indices in indices
lines = np.reshape(lines,(no_lines*2,2))
u,indices = np.unique(lines,return_inverse = True,axis = 0)
unqpt= np.unique(indices,return_inverse = False)
u_pt_len = len(indices)
#print ("length of u is",len(u))
#print('unique points are',u)

# CREATE CONNNECTIVITY MATRIX.
row = np.repeat(np.arange(no_lines),repeats =2 )
col = indices
data = np.tile([1,-1],no_lines)
cols = len(u)
C = ssa.csc_matrix( (data,(row,col)), shape = (no_lines,cols) ).todense()
CON = C.copy()

#GET FIXED POINT INDEX FROM LIST OF UNIQUE POINTS
fxpt = np.array(fxpt)
fxpt = np.around(fxpt,decimals =4)
fxpt_id = np.lexsort((fxpt[:,1],fxpt[:,0]))
fxpt = fxpt[fxpt_id]
res = (u[:, None] == fxpt).all(-1).any(-1)
fxpt_indx = np.where(res)
rpt_indx = np.where(np.invert(res))


#print('FXPT_INDX' , fxpt_indx)
#print(fxpt)

#create Q and Qf matrix for fixed point and free point - connectivity matrices. 
Qf = C[:,fxpt_indx]
Cf = np.reshape(Qf,(Qf.shape[0],Qf.shape[2]))
Qr = C[:,rpt_indx]
Cr = np.reshape(Qr,(Qr.shape[0],Qr.shape[2]))
#Cr = np.delete(C, fxpt_indx, axis=1)
#print(Cr.shape)

#CREATE DIAGONAL FORCE DENSITY MATRIX
q=np.array(q)
q = np.around(q,decimals =4)
Q=np.diag(q)
#print('Q shape',Q.shape)

#CREATE POINT LOAD VECTORS 
p_x = np.zeros((len(u)-len(fxpt),1))
p_y = np.zeros((len(u)-len(fxpt),1))
p_z = np.full((len(u)-len(fxpt),1),load)
#np.tile(load,len(u)-len(fxpt))
#p_z = np.reshape(p_z,(p_z.shape[0],1))

#CREATE FIXED POINT CO-ORDINATE VECTORS
x_f = fxpt[:,0]
x_f = np.reshape(x_f,(x_f.shape[0],))
y_f = fxpt[:,1]
y_f = np.reshape(y_f,(y_f.shape[0],))
z_f=  np.full((x_f.shape[0],), 0)

print(C.shape)

#CREATE D AND D_F
D = Cr.T.dot(Q).dot(Cr)
D_f = Cr.T.dot(Q).dot(Cf)


#GET THE CO-ORDINATES
#print("OK TILL NOW2")

print(np.linalg.inv(D).dot(p_x))
x_ound = np.linalg.inv(D).dot(p_x - np.reshape(D_f.dot(x_f),(D_f.dot(x_f).shape[1],1)))
y_ound = np.linalg.inv(D).dot(p_y - np.reshape(D_f.dot(y_f),(D_f.dot(y_f).shape[1],1)))
z_found = np.linalg.inv(D).dot(p_z - np.reshape(D_f.dot(z_f),(D_f.dot(z_f).shape[1],1)))



print("ok")
# ---------- end solver ----------
python_4 = GhPythonScript(
    Cr=solver.Cr,
    Cf=solver.Cf,
    x=solver.x_ound,
    y=solver.y_ound,
    z=solver.z_found,
    fxpt=solver.fxpt,
    CON=solver.CON,
    fxpt_indx=solver.fxpt_indx,
    rpt_indx=solver.rpt_indx,
    u=solver.u)  # -> a, sptx, spty, sptz, eptx, epty, eptz
# ---------- python_4: Python ----------
import rhinoscriptsyntax as rs
import ghpythonremote
import scriptcontext as sc
from ghpythonlib.treehelpers import list_to_tree
ssa = sc.sticky['scipy.sparse']
sci = sc.sticky['scipy']
np =sc.sticky['numpy']
                
xx =np.array(x)
x=np.reshape(x,(len(x),1))
y = np.array(y)
y=np.reshape(y,(len(y),1))
z = np.array(z)
z = np.around(z,decimals=4)
z=np.reshape(z,(len(z),1))
        
xedo = np.zeros((len(fxpt),1))
fxpt = np.hstack((fxpt,xedo))
fxpt_id = np.lexsort((fxpt[:,1],fxpt[:,0]))
fxpt = fxpt[fxpt_id]
        
xyz=np.concatenate((x,y,z),axis=1)
#xyz= np.vstack((fxpt,xyz))
        
pt_num = len(fxpt)+len(x)
allpt = np.zeros((pt_num,3))
allpt[fxpt_indx] = fxpt
allpt[rpt_indx]=xyz

print(u)
xedo = np.zeros((len(u),1))
u = np.hstack((u,xedo))
print(fxpt)
print(fxpt_indx)
#print(allpt)
                
                
        
con =CON.copy()
#con = np.concatenate((Cf,Cr),axis =1)
cone =CON.copy()
                
con[con==1] =0
con[con==-1] = 1
spt = np.dot(con,allpt)
                
cone[cone==-1] =0
ept = np.dot(cone,allpt)
                
#PUSH DATA TO GRASSHOPPER TREE
sptx = ghpythonremote.obtain(spt[0:,0].tolist())
sptx =list_to_tree(sptx,source=[0,])
                
spty = ghpythonremote.obtain(spt[0:,1].tolist())
spty =list_to_tree(spty,source=[0,])
                
sptz = ghpythonremote.obtain(spt[0:,2].tolist())
sptz =list_to_tree(sptz,source=[0,])
                
eptx = ghpythonremote.obtain(ept[0:,0].tolist())
eptx =list_to_tree(eptx,source=[0,])
                
epty = ghpythonremote.obtain(ept[0:,1].tolist())
epty =list_to_tree(epty,source=[0,])
                
eptz = ghpythonremote.obtain(ept[0:,2].tolist())
eptz =list_to_tree(eptz,source=[0,])
# ---------- end python_4 ----------
pt_12 = ConstructPoint(XCoordinate=flatten(python_4.sptx), YCoordinate=flatten(python_4.spty), ZCoordinate=flatten(python_4.sptz))
pt_13 = ConstructPoint(XCoordinate=flatten(python_4.eptx), YCoordinate=flatten(python_4.epty), ZCoordinate=flatten(python_4.eptz))
ln_3 = Line(StartPoint=pt_12, EndPoint=pt_13)

# ----
bnd = Bounds(Numbers=flatten([python_4.sptz, python_4.eptz]))
dedomain = DeconstructDomain(Domain=bnd)  # -> Start, End
panel_14 = Panel(dedomain.End)

num_4 = Number(graft([topo_choose, subdivision, panel_14]))

Z = UnitZ(Factor=panel_14)
move_5 = Move(Geometry=pt_7, Motion=Z)  # -> Geometry, Transform
arc = Arc3Pt(PointA=box_corners.CornerA, PointB=move_5.Geometry, PointC=box_corners.CornerC)  # -> Arc, Plane, Radius
arc_2 = Arc3Pt(PointA=box_corners_2.CornerB, PointB=move_5.Geometry, PointC=box_corners_2.CornerD)  # -> Arc, Plane, Radius
divide_9 = DivideCurve(Curve=arc_2.Arc, Count=Slider(2, range=0..10), Kinks=False)  # -> Points, Tangents, Parameters
divide_10 = DivideCurve(Curve=arc.Arc, Count=Slider(2, range=0..10), Kinks=False)  # -> Points, Tangents, Parameters
shatter_3 = Shatter(Curve=arc_2.Arc, Parameters=divide_9.Parameters)
shatter_4 = Shatter(Curve=arc.Arc, Parameters=divide_10.Parameters)
item_6 = ListItem(List=shatter_3, Index=0, Wrap=True)
item_7 = ListItem(List=shatter_4, Index=0, Wrap=True)
loft = Loft(
    Curves=flatten([item_6, item_7]),
    Options={Adjust=False, Closed=False, LoftEnds=0, LoftSimp=0, LoftType=0, Rebuild=10, Refit=0.01})

panel_15 = Panel(panel_14)
Z_2 = UnitZ(Factor=panel_15)
move_6 = Move(Geometry=area.Centroid, Motion=Z_2)  # -> Geometry, Transform
extr = ExtrudePoint(Base=rectangle_4.Rectangle, Point=move_6.Geometry)
edges_2 = BrepEdges(Brep=extr)  # -> Naked, Interior, NonManifold
item_8 = ListItem(List=edges_2.Interior, Index=Slider(5, range=0..10), Wrap=True)
item_9 = ListItem(List=edges_2.Naked, Index=Slider(5, range=0..10), Wrap=True)
item_10 = ListItem(List=edges_2.Interior, Index=0, Wrap=True)
divide_11 = DivideCurve(Curve=item_10, Count=10, Kinks=False)  # -> Points, Tangents, Parameters
divide_12 = DivideCurve(Curve=item_9, Count=10, Kinks=False)  # -> Points, Tangents, Parameters
divide_13 = DivideCurve(Curve=item_9, Count=10, Kinks=False)  # -> Points, Tangents, Parameters
divide_14 = DivideCurve(Curve=item_8, Count=10, Kinks=False)  # -> Points, Tangents, Parameters
rev_3 = ReverseList(List=divide_12.Points)
ln_4 = Line(StartPoint=divide_13.Points, EndPoint=divide_14.Points)
ln_5 = Line(StartPoint=divide_11.Points, EndPoint=rev_3)
rotate_3 = Rotate(Geometry=[ln_5, ln_4], Angle=graft(panel_12), Plane=pt_10)  # -> Geometry, Transform
line_3 = Line([ln_5, ln_4, rotate_3.Geometry, edges_2.Interior])
line_4 = Line(edges_2.Naked)

project = Project(Curve=dupln, Brep=loft, Direction=Vector(0, 0, 1))
relay = Relay([ln_5, ln_4, item_9])
rdlines = RemoveDuplicateLinesKaramba3D(Line=relay, LimitDistance=0.005)  # -> OutLine, Info, Indexes
llinter_3 = LineLineIntersectionKaramba3D(Line=rdlines.OutLine, LimitDistance_m=0.005)  # -> IntersectionPoints, LineSubSegements

crv = Curve(reparameterize(project))
lng_4 = ListLength(List=crv)
mcx = MultipleCurves(Curves=crv)  # -> Points, IndexA, IndexB, ParamA, ParamB
series = Series(Start=0, Step=1, Count=lng_4)
int = Integer(series)
mindex = MemberIndex(Set=[mcx.IndexA, mcx.IndexB], Member=int)  # -> Index, Count
pshift = ShiftPaths(Data=mindex.Index, Offset=-1)
number_slider_13 = Slider(0.0001, range=1e-05..0.1)
item_11 = ListItem(List=[mcx.ParamA, mcx.ParamB], Index=pshift, Wrap=True)
unflatten = UnflattenTree(Tree=item_11, Guide=mindex.Index)
cset = CreateSet(List=unflatten)  # -> Set, Map
larger = LargerThan(FirstNumber=cset.Set, SecondNumber=expr("1-x", number_slider_13))  # -> LargerThan, OrEqualTo
smaller = SmallerThan(FirstNumber=cset.Set, SecondNumber=number_slider_13)  # -> SmallerThan, OrEqualTo
or = GateOr(A=smaller.SmallerThan, B=larger.LargerThan)
cull = CullPattern(List=cset.Set, CullPattern=invert(or))
vb = VBScript(x=cull)  # -> out, A
# ---------- vb: VB ----------
    If x Is Nothing Then
      a = nothing
    Else
      a = x
    End If
# ---------- end vb ----------
shatter_5 = Shatter(Curve=graft(crv), Parameters=vb.A)  # -> simplify(Segments)

wbweave = WeaverbirdsMeshFromLinesWeaveBack(Lines=flatten(llinter_3.LineSubSegements), MaximumValence=4)
llinter_4 = LineLineIntersectionKaramba3D(Line=[line_3, line_4], LimitDistance_m=0.005)  # -> IntersectionPoints, LineSubSegements
medges = MeshEdges(Mesh=wbweave)  # -> NakedEdges, InteriorEdges, NonManifoldEdges
rdlines_2 = RemoveDuplicateLinesKaramba3D(Line=llinter_4.LineSubSegements, LimitDistance=0.005)  # -> OutLine, Info, Indexes
rotate_4 = Rotate(Geometry=wbweave, Angle=graft(panel_4), Plane=pt_10)  # -> Geometry, Transform
weld = WeldMesh(Mesh=flatten([rotate_4.Geometry, wbweave]), Angle=3.141592654)
clean = CleanParallel(PrimaryData=llinter_4.LineSubSegements)  # -> PrimaryData, SecondaryData1
wbedges = WeaverbirdsMeshEdges(MeshOrPolylines=weld)

# ---- group: DISPLAY FINAL STRUCTURE WITH STRESSES
num_5 = Number(flatten(python_4.sptz))
len = Length(Curve=ln_3)
num_6 = Number(flatten(python_4.eptz))
python_5 = GhPythonScript(x=num_5, y=num_6, z=len)  # -> out, a
# ---------- python_5: Python ----------
print(x , y, z)
if x == 0 and y == 0 :
    a = 0.1 
else:
    a= z
# ---------- end python_5 ----------
multiplication_5 = Multiplication(FD=num_3, B=python_5.a)
abs = Absolute(Value=multiplication_5)
division_2 = Division(A=abs, B=Slider(750, range=0..1000))
pipe = Pipe(Curve=ln_3, Radius=division_2, Caps=0)
X_3 = UnitX(Factor=Slider(0, range=0..100))
expression = Expression(
    x=flatten(multiplication_5),
    y=ColourSwatch(SwatchColor=RGB(224, 31, 31)),
    z=ColourSwatch(SwatchColor=RGB(49, 67, 204)),
    Expression="if(x≥0,y,z)")
move_7 = Move(Geometry=pipe, Motion=X_3)  # -> Geometry, Transform
preview = CustomPreview(Geometry=flatten(move_7.Geometry), Material=expression)

# ----
wbweave_2 = WeaverbirdsMeshFromLinesWeaveBack(Lines=flatten(wbedges), MaximumValence=4)
medges_2 = MeshEdges(Mesh=wbweave_2)  # -> NakedEdges, InteriorEdges, NonManifoldEdges

# ---- group: SHOW MEMBER CENTERLINE
number_slider_14 = Slider(30, range=0..1000)
# MEMBER SIZING
X_4 = UnitX(Factor=1)
move_8 = Move(Geometry=ln_3, Motion=X_4)  # -> Geometry, Transform

# ----
X_5 = UnitX(Factor=Slider(30, range=0..100))
neg_10 = Negative(Value=X_5)
move_9 = Move(Geometry=ln_3, Motion=X_5)  # -> Geometry, Transform
wbweave_3 = WeaverbirdsMeshFromLinesWeaveBack(Lines=flatten(move_9.Geometry), MaximumValence=4)
mesh = Mesh(wbweave_3)
demesh = DeconstructMesh(Mesh=mesh)  # -> Vertices, graft(Faces), Colours, Normals
mesh_topo_vertex = MeshTopologyVertex(Mesh=mesh)  # -> ListOfMeshVertices, VertexVertexStructure, VertexFaceStructure
msh2psrf = MeshToPolysurface(Mesh=mesh, Triangles=False, FaceMerge=False)
debrep_2 = DeconstructBrep(Brep=msh2psrf)  # -> Faces, Edges, Vertices
deface = DeconstructFace(Face=demesh.Faces)  # -> CornerA, CornerB, CornerC, CornerD
item_12 = ListItem(List=debrep_2.Faces, Index=mesh_topo_vertex.VertexFaceStructure, Wrap=True)
merge = Merge(Data1=deface.CornerA, Data2=deface.CornerB, Data3=deface.CornerC, Data4=deface.CornerD)
area_3 = Area(Geometry=item_12)  # -> Area, Centroid
cset_2 = CreateSet(List=merge)  # -> Set, Map
lng_5 = ListLength(List=cset_2.Set)  # -> flatten(Length)
item_13 = ListItem(List=lng_5, Index=mesh_topo_vertex.VertexFaceStructure, Wrap=True)
division_3 = Division(A=area_3.Area, B=item_13)
ma = MassAddition(Input=division_3)  # -> Result, PartialResults
panel_16 = Panel(ma.Result)
line_5 = LineSDL(Start=demesh.Vertices, Direction=demesh.Normals, Length=flatten(panel_16))
X_6 = UnitX(Factor=Slider(5.3, range=0..10))
dprod = DotProduct(VectorA=X_6, VectorB=line_5, Unitize=False)
Z_3 = UnitZ(Factor=Slider(5, range=0..10))
line_6 = LineSDL(Start=demesh.Vertices, Direction=demesh.Normals, Length=flatten(dprod))
rev_4 = Reverse(Vector=Z_3)
vec_3 = Vector(line_6)
multiplication_6 = Multiplication(A=panel_16, B=rev_4)
addition = Addition(A=flatten(vec_3), B=flatten(multiplication_6))

end_3 = EndPoints(Curve=shatter_5)  # -> Start, End
ln_6 = Line(StartPoint=end_3.Start, EndPoint=end_3.End)

# ---- group: SHOW FORCES
midpt = CurveMiddle(Curve=move_8.Geometry)
roundd = RoundToDecimalPlace(NumberX=multiplication_5, DecimalPlace=Slider(2, range=0..10), RoundType=0)  # -> Rounded, Difference
tag = TextTag(Location=midpt, Text=roundd.Rounded)

# ----
wbweave_4 = WeaverbirdsMeshFromLinesWeaveBack(Lines=flatten(ln_6), MaximumValence=4)

# ---- group: TOTAL LOAD PATH
multiplication_7 = Multiplication(FORCE=abs, LENGTH=python_5.a)
ma_2 = MassAddition(Input=multiplication_7)  # -> Result, PartialResults
total_load_path = Panel(ma_2.Result)

# ----
num_7 = Number(simplify(total_load_path))
weight = Panel([num_4, num_7, panel_13])
rec = DataRecorder(weight, DataLimit=-10, RecordData=True)
num_8 = Number(rec)
panel_17 = Panel(num_8)
rotate_5 = Rotate(Geometry=flatten(wbweave_4), Angle=graft(panel_5), Plane=pt_7)  # -> Geometry, Transform
weld_2 = WeldMesh(Mesh=flatten([rotate_5.Geometry, wbweave_4]), Angle=3.141592654)

X_7 = UnitX(Factor=Slider(30, range=0..100))
move_10 = Move(Geometry=weld_2, Motion=X_7)  # -> Geometry, Transform
mesh_2 = Mesh(move_10.Geometry)
mesh_topo_vertex_2 = MeshTopologyVertex(Mesh=flatten(mesh_2))  # -> flatten(ListOfMeshVertices), VertexVertexStructure, VertexFaceStructure
demesh_2 = DeconstructMesh(Mesh=mesh_2)  # -> Vertices, graft(Faces), Colours, Normals
msh2psrf_2 = MeshToPolysurface(Mesh=mesh_2, Triangles=False, FaceMerge=False)
cset_3 = CreateSet(List=mesh_topo_vertex_2.VertexFaceStructure)  # -> Set, Map
debrep_3 = DeconstructBrep(Brep=msh2psrf_2)  # -> Faces, Edges, Vertices
edges_3 = BrepEdges(Brep=msh2psrf_2)  # -> Naked, Interior, NonManifold
deface_2 = DeconstructFace(Face=demesh_2.Faces)  # -> CornerA, CornerB, CornerC, CornerD
line_7 = Line([edges_3.Naked, edges_3.Interior])
item_14 = ListItem(List=debrep_3.Faces, Index=cset_3.Set, Wrap=True)
merge_2 = Merge(Data1=deface_2.CornerA, Data2=deface_2.CornerB, Data3=deface_2.CornerC, Data4=deface_2.CornerD)
llinter_5 = LineLineIntersectionKaramba3D(Line=line_7, LimitDistance_m=0.005)  # -> IntersectionPoints, LineSubSegements
area_4 = Area(Geometry=item_14)  # -> Area, Centroid
cset_4 = CreateSet(List=merge_2)  # -> Set, Map
lng_6 = ListLength(List=cset_4.Set)  # -> flatten(Length)
item_15 = ListItem(List=lng_6, Index=cset_3.Set, Wrap=True)
panel_18 = Panel(cset_3.Set)
division_4 = Division(A=area_4.Area, B=item_15)
ma_3 = MassAddition(Input=division_4)  # -> Result, PartialResults
panel_19 = Panel(ma_3.Result)
line_8 = LineSDL(Start=demesh_2.Vertices, Direction=demesh_2.Normals, Length=flatten(panel_19))
X_8 = UnitX(Factor=Slider(5, range=0..10))
dprod_2 = DotProduct(VectorA=X_8, VectorB=line_8, Unitize=False)
Z_4 = UnitZ(Factor=Slider(5, range=0..10))
line_9 = LineSDL(Start=flatten(demesh_2.Vertices), Direction=flatten(demesh_2.Normals), Length=flatten(dprod_2))
rev_5 = Reverse(Vector=Z_4)
multiplication_8 = Multiplication(A=panel_19, B=rev_5)
vec_4 = Vector(line_9)
addition_2 = Addition(A=flatten(vec_4), B=flatten(multiplication_8))

num_9 = Number(dedomain.End)
medges_3 = MeshEdges(Mesh=weld_2)  # -> NakedEdges, InteriorEdges, NonManifoldEdges
panel_20 = Panel(debrep_3.Faces)
area_5 = Area(Geometry=wbweave)  # -> Area, Centroid
multiplication_9 = Multiplication(A=area_5.Area, B=4)
multiplication_10 = Multiplication(A=Slider(5, range=0..10), B=multiplication_9)
area_6 = Area(Geometry=flatten(msh2psrf))  # -> Area, Centroid
multiplication_11 = Multiplication(A=Slider(5, range=0..10), B=area_6.Area)
lng_7 = ListLength(List=flatten(mesh_topo_vertex.ListOfMeshVertices))
move_11 = Move(Geometry=ln_3, Motion=X_2)  # -> Geometry, Transform
move_12 = Move(Geometry=fixed_points, Motion=X_2)  # -> Geometry, Transform
division_5 = Division(A=multiplication_11, B=lng_7)
repeat_2 = RepeatData(Data=division_5, Length=lng_7)
panel_21 = Panel(repeat_2)
q_num = Number(flatten(repeat_2))
pt_14 = Point(flatten(mesh_topo_vertex.ListOfMeshVertices))
vec_5 = Vector(vec_3)
Z_5 = UnitZ(Factor=q_num)
area_7 = Area(Geometry=flatten(wbweave_4))  # -> Area, Centroid
rev_6 = Reverse(Vector=Z_5)
multiplication_12 = Multiplication(A=area_7.Area, B=4)
multiplication_13 = Multiplication(A=Slider(5, range=0..10), B=multiplication_12)
lng_8 = ListLength(List=flatten(demesh_2.Vertices))
move_13 = Move(Geometry=divide_7.Points, Motion=X_7)  # -> Geometry, Transform
division_6 = Division(A=multiplication_13, B=lng_8)
loads = LoadsKaramba3D(ForceVector=vec_5, Local=False, PosInd=pt_14, LCase=0, mode="Point")  # -> flatten(Load)
loads_2 = LoadsKaramba3D(ForceVector=rev_6, Local=False, PosInd=pt_14, LCase=Slider(1, range=0..1), mode="Point")  # -> flatten(Load)
repeat_3 = RepeatData(Data=division_6, Length=lng_8)  # -> flatten(Data)
duppt_3 = RemoveDuplicatePts(Points=move_13.Geometry, Tolerance=0.01)  # -> flatten(UniquePoints)
panel_22 = Panel(repeat_3)

# ----
# KARAMBA MODEL
# KARAMBA OPTIMIZATION
upperchord_crv = Curve(flatten(llinter_5.LineSubSegements))
supports_pt = Point(duppt_3)
q_num_2 = Number(flatten(repeat_3))
pt_15 = Point(flatten(demesh_2.Vertices))
pt_16 = Point(flatten(demesh_2.Vertices))
vec_6 = Vector(vec_4)
Z_6 = UnitZ(Factor=q_num_2)
rev_7 = Reverse(Vector=Z_6)
matprops_2 = MaterialPropertiesKaramba3D(
    FamilyOfMaterial="Mild Steel",
    Name="Fe250",
    YoungsModulus_kN_cm2="21000",
    InPlaneShearModulus_kN_cm2=8076,
    TransverseShearModulus_kN_cm2=8076,
    SpecificWeight_kN_m3="78.5",
    CoefficientOfThermalExpansion_1_C=1e-05,
    YieldStrength_kN_cm2="25",
    mode="Isotrop")
matselect = MaterialSelectionKaramba3D(menu=[dropdown(1), dropdown(2)])
panel_23 = Panel("""ISNB40M
ISNB50M
ISNB65M
ISNB80M
ISNB90M
ISNB100M
ISNB110M""")
panel_24 = Panel("""ISNB50M
ISNB50M
ISNB65M
ISNB80M
ISNB90M
ISNB100M
ISNB110M""")
panel_25 = Panel("""0.32
0.36
0.36
0.4
0.4
0.45
0.48""")
panel_26 = Panel("""4.83
6.03
7.61
8.89
10.16
11.43
12.7""")
cross_section_2 = CrossSectionKaramba3D(
    FamilyNameOfCrossSection="ISNB",
    NameOfCrossSection=panel_23,
    ElementIdentifier=panel_24,
    Material=matprops_2,
    Diameter_cm=panel_26,
    WallThickness_cm=panel_25,
    mode="Circular Hollow")
crosecrselect = CrossSectionRangeSelectorKaramba3D(MaximumHeight_cm=-1, MaximumWidth_cm=-1, Material=matselect, menu=[dropdown(2), dropdown(0), dropdown(1)])
supp = SupportKaramba3D(PosInd=supports_pt, menu=[buttons(on, on, on, off, off, off)])
loads_3 = LoadsKaramba3D(ForceVector=vec_6, Local=False, PosInd=pt_15, LCase=0, mode="Point")  # -> flatten(Load)
loads_4 = LoadsKaramba3D(ForceVector=rev_7, Local=False, PosInd=pt_16, LCase=Slider(1, range=0..1), mode="Point")  # -> flatten(Load)
gencstable_2 = GenerateCrossSectionTableKaramba3D(CrossSections=cross_section_2)
Y_2 = UnitY(Factor="0.001")
beam_joints = BeamJointsKaramba3D(
    ElementIdentifiers="Upper Chord",
    CtKNMAtStartingNode=Vector(0, 0, 0),
    CrKNmRadAtStartingNode=Y_2,
    CtKNMAtEndNode=Vector(0, 0, 0),
    CrKNmRadAtEndNode=Y_2,
    menu=[buttons(off, off, off, off, off, off), buttons(off, off, off, off, off, off)])
linetobeam = LineToBeamKaramba3D(
    Line=upperchord_crv,
    Identifier=graft("Upper Chord"),
    CrossSection=cross_section_2,
    New=True,
    Remove=True,
    LimitDistance_m=0.005)  # -> Element, Points, Info
panel_27 = Panel(gencstable_2)
readcstable_2 = ReadCrossSectionTableFromFileKaramba3D()  # -> CrossSection, Info
assemble = AssembleModelKaramba3D(
    Elem=flatten(linetobeam.Element),
    Support=flatten(supp),
    Load=flatten([loads_3, loads_4]),
    Joint=flatten(beam_joints),
    LimitDistance_m=0.005)  # -> Model, Info, Mass_kg, CenterOfGravity
analyze = AnalyzeKaramba3D(Model=assemble.Model)  # -> CalculatedModel, MaximumDisplacement_cm, ResultingForceOfGravity_kN, ElasticEnergy_kNm
modelview = ModelViewKaramba3D(Model=analyze.CalculatedModel, ResultFactors=1, ResultCase=-1)  # -> Model, DeformedMesh, DeformedAxes, DeformedModel
b_forces = BeamForcesKaramba3D(AnalyzedModel=analyze.CalculatedModel, LCase=-1, MaximumDistanceBetweenResults_m=-1, NumberOfResultsPerBeamElement=2)  # -> AnalyzedModel, NormalForce_kN, ShearForceVz_kN, ShearForceVy_kN, BendingMomentMt_kNm, BendingMomentMy_kNm, BendingMomentMz_kNm
opticrosec = OptimizeCrossSectionKaramba3D(
    Model=assemble.Model,
    CrossSections=cross_section_2,
    MaximumUtilization=1,
    MaximumDisplacement_cm=-1,
    UltimateLimitStateIterations="1",
    DisplacementIterations=5,
    NumberOfSamplePoints=3,
    ElasticDesign=True,
    GammaM0=1,
    GammaM1=1)  # -> ModelWithOptimizedCrossSections, Info, Mass_kg, MaximumDisplacement_cm, ElasticEnergy_kNm
item_16 = ListItem(List=b_forces.NormalForce_kN, Index=0, Wrap=True)  # -> flatten(Item)
beamview = BeamViewKaramba3D(Model=modelview.Model)  # -> Model, MeshesOfRenderedBeams, DeformedBeamAxes, LegendColors, LegendTags
num_10 = Number(opticrosec.Mass_kg)
modelview_2 = ModelViewKaramba3D(Model=opticrosec.ModelWithOptimizedCrossSections, ResultFactors=1, ResultCase=-1)  # -> Model, DeformedMesh, DeformedAxes, DeformedModel
nodedisp = NodalDisplacementsKaramba3D(AnalyzedModel=modelview.Model, ResultCase=Slider(0, range=0..1))  # -> AnalyzedModel, NodalTranslations_m, NodalRotations_rad
curvepoint = PointOnCurve(beamview.DeformedBeamAxes, parameter=0.5)
roundd_2 = RoundToDecimalPlace(NumberX=item_16, DecimalPlace=Slider(2, range=0..10), RoundType=0)  # -> Rounded, Difference
tag_2 = TextTag(Location=curvepoint, Text=roundd_2.Rounded)
item_17 = ListItem(List=nodedisp.NodalTranslations_m, Index=Slider(80, range=0..100), Wrap=True)
panel_28 = Panel(item_17)
devec = DeconstructVector(Vector=nodedisp.NodalTranslations_m)  # -> XComponent, YComponent, ZComponent
abs_2 = Absolute(Value=devec.ZComponent)

abs_3 = Absolute(Value=devec.XComponent)
abs_4 = Absolute(Value=devec.YComponent)
panel_29 = Panel(num_10)
hilonums = HighestLowestNumbers(Numbers=abs_2)  # -> Highest, Lowest
deflection_max = Panel(hilonums.Highest)
hilonums_2 = HighestLowestNumbers(Numbers=abs_3)  # -> Highest, Lowest
# CIRCULAR
deflection_max_2 = Panel(hilonums_2.Highest)
hilonums_3 = HighestLowestNumbers(Numbers=abs_4)  # -> Highest, Lowest
deflection_max_3 = Panel(hilonums_3.Highest)

X_9 = UnitX(Factor=Slider(30, range=0..100))
move_14 = Move(Geometry=weld, Motion=X_9)  # -> Geometry, Transform
mesh_3 = Mesh(move_14.Geometry)
mesh_topo_vertex_3 = MeshTopologyVertex(Mesh=flatten(mesh_3))  # -> flatten(ListOfMeshVertices), VertexVertexStructure, VertexFaceStructure
demesh_3 = DeconstructMesh(Mesh=mesh_3)  # -> Vertices, graft(Faces), Colours, Normals
msh2psrf_3 = MeshToPolysurface(Mesh=mesh_3, Triangles=False, FaceMerge=False)
debrep_4 = DeconstructBrep(Brep=msh2psrf_3)  # -> flatten(Faces), Edges, Vertices
deface_3 = DeconstructFace(Face=demesh_3.Faces)  # -> CornerA, CornerB, CornerC, CornerD
merge_3 = Merge(Data1=deface_3.CornerA, Data2=deface_3.CornerB, Data3=deface_3.CornerC, Data4=deface_3.CornerD)
cset_5 = CreateSet(List=merge_3)  # -> Set, Map
lng_9 = ListLength(List=cset_5.Set)  # -> flatten(Length)
X_10 = UnitX(Factor=Slider(2, range=0..10))
Z_7 = UnitZ(Factor=Slider(5, range=0..10))
rev_8 = Reverse(Vector=Z_7)

cset_6 = CreateSet(List=mesh_topo_vertex_3.VertexFaceStructure)  # -> Set, Map
edges_4 = BrepEdges(Brep=msh2psrf_3)  # -> Naked, Interior, NonManifold
line_10 = Line([edges_4.Naked, edges_4.Interior])

item_18 = ListItem(List=debrep_4.Faces, Index=cset_6.Set, Wrap=True)
area_8 = Area(Geometry=item_18)  # -> Area, Centroid
item_19 = ListItem(List=lng_9, Index=cset_6.Set, Wrap=True)
division_7 = Division(A=area_8.Area, B=item_19)
ma_4 = MassAddition(Input=division_7)  # -> Result, PartialResults
panel_30 = Panel(ma_4.Result)
line_11 = LineSDL(Start=demesh_3.Vertices, Direction=demesh_3.Normals, Length=flatten(panel_30))
dprod_3 = DotProduct(VectorA=X_10, VectorB=line_11, Unitize=False)
line_12 = LineSDL(Start=flatten(demesh_3.Vertices), Direction=flatten(demesh_3.Normals), Length=flatten(dprod_3))
multiplication_14 = Multiplication(A=panel_30, B=rev_8)
vec_7 = Vector(line_12)
addition_3 = Addition(A=flatten(vec_7), B=flatten(multiplication_14))

llinter_6 = LineLineIntersectionKaramba3D(Line=line_10, LimitDistance_m=0.005)  # -> IntersectionPoints, LineSubSegements
panel_31 = Panel(cset_6.Set)
lng_10 = ListLength(List=flatten(demesh_3.Vertices))
move_15 = Move(Geometry=divide_8.Points, Motion=X_9)  # -> Geometry, Transform
division_8 = Division(A=multiplication_10, B=lng_10)
repeat_4 = RepeatData(Data=division_8, Length=lng_10)  # -> flatten(Data)
duppt_4 = RemoveDuplicatePts(Points=move_15.Geometry, Tolerance=0.01)  # -> flatten(UniquePoints)
pt_17 = Point(flatten(demesh_3.Vertices))
pt_18 = Point(demesh_3.Vertices)

# ----
# KARAMBA MODEL
# KARAMBA OPTIMIZATION
upperchord_crv_2 = Curve(llinter_6.LineSubSegements)
supports_pt_2 = Point(duppt_4)
q_num_3 = Number(flatten(repeat_4))
pt_19 = Point(flatten(demesh_3.Vertices))
vec_8 = Vector(vec_7)
Z_8 = UnitZ(Factor=q_num_3)
rev_9 = Reverse(Vector=Z_8)
matprops_3 = MaterialPropertiesKaramba3D(
    FamilyOfMaterial="Mild Steel",
    Name="Fe250",
    YoungsModulus_kN_cm2="21000",
    InPlaneShearModulus_kN_cm2=8076,
    TransverseShearModulus_kN_cm2=8076,
    SpecificWeight_kN_m3="78.5",
    CoefficientOfThermalExpansion_1_C=1e-05,
    YieldStrength_kN_cm2="25",
    mode="Isotrop")
matselect_2 = MaterialSelectionKaramba3D(menu=[dropdown(1), dropdown(2)])
panel_32 = Panel("""ISNB40M
ISNB50M
ISNB65M
ISNB80M
ISNB90M
ISNB100M
ISNB110M""")
panel_33 = Panel("""ISNB50M
ISNB50M
ISNB65M
ISNB80M
ISNB90M
ISNB100M
ISNB110M""")
panel_34 = Panel("""0.32
0.36
0.36
0.4
0.4
0.45
0.48""")
panel_35 = Panel("""4.83
6.03
7.61
8.89
10.16
11.43
12.7""")
cross_section_3 = CrossSectionKaramba3D(
    FamilyNameOfCrossSection="ISNB",
    NameOfCrossSection=panel_32,
    ElementIdentifier=panel_33,
    Material=matprops_3,
    Diameter_cm=panel_35,
    WallThickness_cm=panel_34,
    mode="Circular Hollow")
crosecrselect_2 = CrossSectionRangeSelectorKaramba3D(MaximumHeight_cm=-1, MaximumWidth_cm=-1, Material=matselect_2, menu=[dropdown(2), dropdown(0), dropdown(1)])
supp_2 = SupportKaramba3D(PosInd=supports_pt_2, menu=[buttons(on, on, on, off, off, off)])
loads_5 = LoadsKaramba3D(ForceVector=vec_8, Local=False, PosInd=pt_19, LCase=0, mode="Point")  # -> flatten(Load)
gencstable_3 = GenerateCrossSectionTableKaramba3D(CrossSections=cross_section_3)
Y_3 = UnitY(Factor="0.001")
beam_joints_2 = BeamJointsKaramba3D(
    ElementIdentifiers="Upper Chord",
    CtKNMAtStartingNode=Vector(0, 0, 0),
    CrKNmRadAtStartingNode=Y_3,
    CtKNMAtEndNode=Vector(0, 0, 0),
    CrKNmRadAtEndNode=Y_3,
    menu=[buttons(off, off, off, off, off, off), buttons(off, off, off, off, off, off)])
linetobeam_2 = LineToBeamKaramba3D(
    Line=upperchord_crv_2,
    Identifier=graft("Upper Chord"),
    CrossSection=cross_section_3,
    New=True,
    Remove=True,
    LimitDistance_m=0.005)  # -> Element, Points, Info
panel_36 = Panel(gencstable_3)
readcstable_3 = ReadCrossSectionTableFromFileKaramba3D()  # -> CrossSection, Info

loads_6 = LoadsKaramba3D(ForceVector=rev_9, Local=False, PosInd=pt_17, LCase=Slider(1, range=0..1), mode="Point")  # -> flatten(Load)

assemble_2 = AssembleModelKaramba3D(
    Elem=flatten(linetobeam_2.Element),
    Support=flatten(supp_2),
    Load=flatten([loads_5, loads_6]),
    Joint=flatten(beam_joints_2),
    LimitDistance_m=0.005)  # -> Model, Info, Mass_kg, CenterOfGravity
analyze_2 = AnalyzeKaramba3D(Model=assemble_2.Model)  # -> CalculatedModel, MaximumDisplacement_cm, ResultingForceOfGravity_kN, ElasticEnergy_kNm
modelview_3 = ModelViewKaramba3D(Model=analyze_2.CalculatedModel, ResultFactors=1, ResultCase=-1)  # -> Model, DeformedMesh, DeformedAxes, DeformedModel
b_forces_2 = BeamForcesKaramba3D(AnalyzedModel=analyze_2.CalculatedModel, LCase=-1, MaximumDistanceBetweenResults_m=-1, NumberOfResultsPerBeamElement=2)  # -> AnalyzedModel, NormalForce_kN, ShearForceVz_kN, ShearForceVy_kN, BendingMomentMt_kNm, BendingMomentMy_kNm, BendingMomentMz_kNm
opticrosec_2 = OptimizeCrossSectionKaramba3D(
    Model=assemble_2.Model,
    CrossSections=cross_section_3,
    MaximumUtilization=1,
    MaximumDisplacement_cm=-1,
    UltimateLimitStateIterations="1",
    DisplacementIterations=5,
    NumberOfSamplePoints=3,
    ElasticDesign=True,
    GammaM0=1,
    GammaM1=1)  # -> ModelWithOptimizedCrossSections, Info, Mass_kg, MaximumDisplacement_cm, ElasticEnergy_kNm
item_20 = ListItem(List=b_forces_2.NormalForce_kN, Index=0, Wrap=True)  # -> flatten(Item)
beamview_2 = BeamViewKaramba3D(Model=modelview_3.Model)  # -> Model, MeshesOfRenderedBeams, DeformedBeamAxes, LegendColors, LegendTags
num_11 = Number(opticrosec_2.Mass_kg)
modelview_4 = ModelViewKaramba3D(Model=opticrosec_2.ModelWithOptimizedCrossSections, ResultFactors=1, ResultCase=-1)  # -> Model, DeformedMesh, DeformedAxes, DeformedModel
nodedisp_2 = NodalDisplacementsKaramba3D(AnalyzedModel=modelview_3.Model, ResultCase=Slider(0, range=0..1))  # -> AnalyzedModel, NodalTranslations_m, NodalRotations_rad
curvepoint_2 = PointOnCurve(beamview_2.DeformedBeamAxes, parameter=0.5)
roundd_3 = RoundToDecimalPlace(NumberX=item_20, DecimalPlace=Slider(2, range=0..10), RoundType=0)  # -> Rounded, Difference
tag_3 = TextTag(Location=curvepoint_2, Text=roundd_3.Rounded)
item_21 = ListItem(List=nodedisp_2.NodalTranslations_m, Index=Slider(80, range=0..100), Wrap=True)
panel_37 = Panel(item_21)
devec_2 = DeconstructVector(Vector=nodedisp_2.NodalTranslations_m)  # -> XComponent, YComponent, ZComponent
abs_5 = Absolute(Value=devec_2.ZComponent)
abs_6 = Absolute(Value=devec_2.XComponent)
abs_7 = Absolute(Value=devec_2.YComponent)
hilonums_4 = HighestLowestNumbers(Numbers=abs_5)  # -> Highest, Lowest
hilonums_5 = HighestLowestNumbers(Numbers=abs_6)  # -> Highest, Lowest
hilonums_6 = HighestLowestNumbers(Numbers=abs_7)  # -> Highest, Lowest

deflection_max_4 = Panel(hilonums_4.Highest)
deflection_max_5 = Panel(hilonums_5.Highest)
deflection_max_6 = Panel(hilonums_6.Highest)
# PLANE
panel_38 = Panel(num_11)

# ----
# KARAMBA MODEL
# KARAMBA OPTIMIZATION
upperchord_crv_3 = Curve(move_11.Geometry)
supports_pt_3 = Point(move_12.Geometry)
matselect_3 = MaterialSelectionKaramba3D(menu=[dropdown(1), dropdown(2)])
supp_3 = SupportKaramba3D(PosInd=supports_pt_3, menu=[buttons(on, on, on, off, off, off)])
Y_4 = UnitY(Factor="0.001")
beam_joints_3 = BeamJointsKaramba3D(
    ElementIdentifiers="Upper Chord",
    CtKNMAtStartingNode=Vector(0, 0, 0),
    CrKNmRadAtStartingNode=Y_4,
    CtKNMAtEndNode=Vector(0, 0, 0),
    CrKNmRadAtEndNode=Y_4,
    menu=[buttons(off, off, off, off, off, off), buttons(off, off, off, off, off, off)])

# ---- group: Cross Section Range Selector (Karamba3D)
crosecrselect_3 = CrossSectionRangeSelectorKaramba3D(MaximumHeight_cm=-1, MaximumWidth_cm=-1, Material=matselect_3, menu=[dropdown(2), dropdown(0), dropdown(1)])

# ---- group: Line to Beam (Karamba3D)
linetobeam_3 = LineToBeamKaramba3D(
    Line=upperchord_crv_3,
    Identifier=graft("Upper Chord"),
    CrossSection=cross_section,
    New=True,
    Remove=True,
    LimitDistance_m=0.005)  # -> Element, Points, Info

# ---- group: Assemble Model (Karamba3D)
assemble_3 = AssembleModelKaramba3D(
    Elem=flatten(linetobeam_3.Element),
    Support=flatten(supp_3),
    Load=flatten([loads, loads_2]),
    Joint=flatten(beam_joints_3),
    LimitDistance_m=0.005)  # -> Model, Info, Mass_kg, CenterOfGravity

# ---- group: Analyze (Karamba3D)
analyze_3 = AnalyzeKaramba3D(Model=assemble_3.Model)  # -> CalculatedModel, MaximumDisplacement_cm, ResultingForceOfGravity_kN, ElasticEnergy_kNm

# ---- group: Model View (Karamba3D)
modelview_5 = ModelViewKaramba3D(Model=analyze_3.CalculatedModel, ResultFactors=1, ResultCase=-1)  # -> Model, DeformedMesh, DeformedAxes, DeformedModel

# ---- group: Optimize Cross Section (Karamba3D)
opticrosec_3 = OptimizeCrossSectionKaramba3D(
    Model=assemble_3.Model,
    CrossSections=cross_section,
    MaximumUtilization=1,
    MaximumDisplacement_cm=-1,
    UltimateLimitStateIterations="1",
    DisplacementIterations=5,
    NumberOfSamplePoints=3,
    ElasticDesign=True,
    GammaM0=1,
    GammaM1=1)  # -> ModelWithOptimizedCrossSections, Info, Mass_kg, MaximumDisplacement_cm, ElasticEnergy_kNm

# ---- group: Beam View (Karamba3D)
beamview_3 = BeamViewKaramba3D(Model=modelview_5.Model)  # -> Model, MeshesOfRenderedBeams, DeformedBeamAxes, LegendColors, LegendTags

# ----
b_forces_3 = BeamForcesKaramba3D(AnalyzedModel=analyze_3.CalculatedModel, LCase=-1, MaximumDistanceBetweenResults_m=-1, NumberOfResultsPerBeamElement=2)  # -> AnalyzedModel, NormalForce_kN, ShearForceVz_kN, ShearForceVy_kN, BendingMomentMt_kNm, BendingMomentMy_kNm, BendingMomentMz_kNm
item_22 = ListItem(List=b_forces_3.NormalForce_kN, Index=0, Wrap=True)  # -> flatten(Item)
num_12 = Number(opticrosec_3.Mass_kg)
nodedisp_3 = NodalDisplacementsKaramba3D(AnalyzedModel=modelview_5.Model, ResultCase=Slider(0, range=0..1))  # -> AnalyzedModel, NodalTranslations_m, NodalRotations_rad
curvepoint_3 = PointOnCurve(beamview_3.DeformedBeamAxes, parameter=0.5)
roundd_4 = RoundToDecimalPlace(NumberX=item_22, DecimalPlace=Slider(2, range=0..10), RoundType=0)  # -> Rounded, Difference
tag_4 = TextTag(Location=curvepoint_3, Text=roundd_4.Rounded)
item_23 = ListItem(List=nodedisp_3.NodalTranslations_m, Index=Slider(80, range=0..100), Wrap=True)
panel_39 = Panel(item_23)

# ---- group: Model View (Karamba3D)
modelview_6 = ModelViewKaramba3D(Model=opticrosec_3.ModelWithOptimizedCrossSections, ResultFactors=1, ResultCase=-1)  # -> Model, DeformedMesh, DeformedAxes, DeformedModel

# ----
devec_3 = DeconstructVector(Vector=nodedisp_3.NodalTranslations_m)  # -> XComponent, YComponent, ZComponent
abs_8 = Absolute(Value=devec_3.ZComponent)
abs_9 = Absolute(Value=devec_3.XComponent)
abs_10 = Absolute(Value=devec_3.YComponent)
hilonums_7 = HighestLowestNumbers(Numbers=abs_8)  # -> Highest, Lowest
hilonums_8 = HighestLowestNumbers(Numbers=abs_9)  # -> Highest, Lowest
hilonums_9 = HighestLowestNumbers(Numbers=abs_10)  # -> Highest, Lowest
deflection_max_7 = Panel(hilonums_7.Highest)
deflection_max_8 = Panel(hilonums_9.Highest)
# FDM
deflection_max_9 = Panel(hilonums_8.Highest)
panel_40 = Panel(num_12)

# ==== cluster GHPythonRemote: Connects the Grasshopper Python component to an external Python instance.
python = PythonScript()  # -> gh_parent_doc_dir
# ---------- python: Python ----------
from os import path

gh_parent_doc_dir = path.abspath(path.dirname(ghenv.Component.OnPingDocument().Owner.OnPingDocument().FilePath))
# ---------- end python ----------
# GH to python remote example.
# Pierre Cuvilliers, 2017-2018
# Released under the MIT license
# github.com/pilcru/ghpythonremote
# Runs and connects to an external python engine, and
# assigns imported modules to scriptcontext.sticky variables.
# 
# Arguments:
#       code (str): Path to the GH_to_python_sticky.py code file.
#       location (str): Path to a python executable, or to a folder
#             containing `python.exe`, or the name of a conda-created
#             virtual environment prefixed by `conda://` (`conda://env_name`).
#             If empty, finds python from your windows %PATH%.
#       run (boolean): Creates the connection, and imports new
#             modules, when turned to True. Kills the connection,
#             and deletes the references to the imports, when turned
#             to False.
#       modules (str list): List of module names to import in the
#             remote python. They will be added to the
#             scriptcontext.sticky dictionary, allowing them to be
#             reused from other python components in the same
#             Grasshopper document. Submodules (for example
#             `numpy.linalg` have to be added explicitly to this list
#             to be available later.
#       log_level (str from ['NOTSET', 'DEBUG', 'INFO', 'WARNING', 'ERROR', 'CRITICAL']):
#             Logging level to use for the local IronPython and the
#             remote python instance.
#       working_dir (str): Working directory for the remote python
#             instance.
# 
# Returns:
#       out (str): Console output with DEBUG information.
#       linked_modules (str list): list of imported module names.
#       rpy (rpyc connection object): The object representing the
#             remote Python interpreter.
location = ClusterInput()  # location (str): Path to a python executable, or to a folder containing `python.exe`, or the name of a conda-created virtual environment prefixed by `conda://` (`conda://env_name`). If empty, finds python from your windows %PATH%.
run = ClusterInput()  # run (boolean): Creates the connection, and imports new modules, when turned to True. Kills the connection,and deletes the references to the imports, when turned to False.
modules = ClusterInput()  # modules (str list): List of module names to import in the remote python. They will be added to the scriptcontext.sticky dictionary, allowing them to be reused from other python components in the same Grasshopper document. Submodules (for example `numpy.linalg` have to be added explicitly to this list to be available later.
list = ValueList({"CRITICAL", "ERROR", "WARNING", "INFO", "DEBUG", "NOTSET"}, selected="DEBUG")
panel = Panel(python)
ghpythonremote = GHPythonRemote(location=location, run=run, modules=modules, log_level=list, working_dir=panel)  # -> out, linked_modules, rpy; inputs run: Boolean, modules: list
# ---------- ghpythonremote: Python ----------
import inspect
import logging
from os import path
import sys
from time import sleep

import scriptcontext

import ghpythonremote
from ghpythonremote.connectors import GrasshopperToPythonRemote

local_log_level = getattr(logging, log_level, logging.WARNING)
logger = logging.getLogger("ghpythonremote")
logger.setLevel(local_log_level)
ch = logging.StreamHandler()
ch.setLevel(local_log_level)
formatter = logging.Formatter("%(levelname)s: %(name)s:\n%(message)s")
ch.setFormatter(formatter)
logger.handlers = []
logger.addHandler(ch)
logger = logging.getLogger("ghpythonremote.GH_to_python")

ROOT = path.abspath(path.dirname(inspect.getfile(ghpythonremote)))
rpyc_server_py = path.join(ROOT, "pythonservice.py")

# Set connection to CLOSED if this is the first run
# and initialize set of linked modules
try:
    remote_python_status
except NameError:
    remote_python_status = "CLOSED"
    lkd_modules = set()

# Wait for connection to connect or terminate
timer = 0
while remote_python_status == "CONNECTING" or remote_python_status == "CLOSING":
    sleep(1)
    timer += 1
    if timer == 10:
        try:
            gh2py_manager.__exit__(*sys.exc_info())
        except Exception:
            pass
        remote_python_status = "CLOSED"
        lkd_modules = set()
        raise RuntimeError(
            "Connection left in an inconsistent state and not returning. Reset "
            "everything."
        )

if run:
    if not remote_python_status == "OPEN":
        remote_python_status = "CONNECTING"
        gh2py_manager = GrasshopperToPythonRemote(
            rpyc_server_py,
            location=location,
            timeout=10,
            port=None,
            log_level=log_level,
            working_dir=working_dir,
        )
        gh2py = gh2py_manager.__enter__()
        remote_python_status = "OPEN"

    # Stuff that we can reach
    rpymod = gh2py.py_remote_modules  # A getter function for a named python module
    rpy = gh2py.connection  # Represents the remote instance root object
    scriptcontext.sticky["rpy"] = rpy
    # Add modules
    for mod in modules:
        try:
            scriptcontext.sticky[mod] = rpymod(mod)
            lkd_modules.add(mod)
        except ImportError:
            gh2py_manager.__exit__(*sys.exc_info())
            raise

elif not remote_python_status == "CLOSED":
    remote_python_status = "CLOSING"
    # Remove linked modules
    for mod in lkd_modules:
        del scriptcontext.sticky[mod]
    del scriptcontext.sticky["rpy"]
    gh2py_manager.__exit__(*sys.exc_info())
    lkd_modules = set()
    remote_python_status = "CLOSED"

# Change variable name because ghpython resets outputs to None before each run
linked_modules = lkd_modules

logger.info("GH to python connection is {}".format(remote_python_status))
# ---------- end ghpythonremote ----------
out = ClusterOutput(ghpythonremote.out)  # Console output.
linked_modules = ClusterOutput(ghpythonremote.linked_modules)  # Names of modules that were successfully added to the scriptcontext.sticky dictionary.
rpy = ClusterOutput(ghpythonremote.rpy)  # The object representing the remote python instance
python_2 = PythonScript(module_names=ghpythonremote.linked_modules)  # -> import_statements; inputs module_names: list
# ---------- python_2: Python ----------
import_statements = ["import scriptcontext as sc"]
for module_name in module_names:
    import_statements.append("{0} = sc.sticky['{0}']".format(module_name))

if len(module_names) == 0:
    import_statements = []
# ---------- end python_2 ----------
import_statements = ClusterOutput(python_2)  # Useful import statements to use the imported modules in your scripts.
