# Grasshopper definition wind load fdm form find.gh (Grasshopper 1.0.7)
# Copyright: © 2017-2018 Pierre Cuvilliers, Caitlin Mueller, Massachusetts Institute of Technology
# plug-ins: Pufferfish, LunchBox, Kangaroo2 Components, Weaverbird

# ---- group: RECTANGLE
number_slider = Slider(6, range=0..100)
number_slider_2 = Slider(6, range=0..100)
# BASE GEOMETRY
pt = ConstructPoint(XCoordinate=0, YCoordinate=0, ZCoordinate=0)
neg = Negative(Value=number_slider)
neg_2 = Negative(Value=number_slider_2)
vec = VectorXYZ(XComponent=number_slider, YComponent=number_slider_2, ZComponent=0)  # -> Vector, Length
vec_2 = VectorXYZ(XComponent=neg, YComponent=neg_2, ZComponent=0)  # -> Vector, Length
move = Move(Geometry=pt, Motion=vec_2.Vector)  # -> Geometry, Transform
move_2 = Move(Geometry=pt, Motion=vec.Vector)  # -> Geometry, Transform
rec_2pt = Rectangle2Pt(Plane=PlaneXY(0, 0, 0), PointA=move_2.Geometry, PointB=move.Geometry, Radius=0)  # -> Rectangle, Length
srf = Surface(rec_2pt.Rectangle)

# ---- group: CIRCLE
pt_2 = ConstructPoint(XCoordinate=0, YCoordinate=0, ZCoordinate=0)
circle = CircleCNR(Center=pt_2, Normal=Vector(0, 0, 1), Radius=Slider(30, range=0..100))
srf_2 = Surface(circle)

# ----
pt_3 = Point(pt_2)
srf_3 = Surface(srf)
geo = Geometry(rec_2pt.Rectangle)
topo_choose = Slider(0, range=0..4)
force_density = Slider(2, range=1..10)
galapagos = Galapagos(fitness=num_13, gene=[topo_choose, subdivision, force_density])
multiplication = Multiplication(A=force_density, B=5)

# ---- group: IMPORT GHPYTHON
panel = Panel("""numpy
scipy
networkx
scipy.sparse""")
pythonremote = GHPythonRemote(location="C:\Users\nisha\anaconda3\envs\rhino_remote\python.exe", run=Toggle(True), modules=panel)  # -> out, linked_modules, rpy, import_statements

# ---- group: Dimension
multiplication_2 = Multiplication(A=number_slider_2, B=2)
Y = UnitY(Factor=multiplication_2)
X = UnitX(Factor=multiplication_2)
neg_3 = Negative(Value=Y)
pt_4 = Point(move_2.Geometry)
move_3 = Move(Geometry=move.Geometry, Motion=X)  # -> Geometry, Transform
move_4 = Move(Geometry=pt_4, Motion=neg_3)  # -> Geometry, Transform
neg_4 = Negative(Value=Slider(1, range=0..1))
aligndim = AlignedDimension(
    Plane=PlaneXY(0, 0, 0),
    PointA=move_3.Geometry,
    PointB=move.Geometry,
    Offset=1,
    Text="{0:0.00}",
    Size=Slider(0.2, range=0..1))
aligndim_2 = AlignedDimension(Plane=PlaneXY(0, 0, 0), PointA=move_4.Geometry, PointB=pt_4, Offset=neg_4, Text="{0:0.00}", Size=Slider(0.2, range=0..1))

# ----
number_slider_3 = Slider(20, range=0..100)
number_slider_4 = Slider(20, range=0..100)
Y_2 = UnitY(Factor=number_slider_3)
Y_3 = UnitY(Factor=number_slider_4)
# MEMBER SIZING
number_slider_5 = Slider(-15, range=-20..20)
pt_5 = ConstructPoint(XCoordinate=number_slider_5, YCoordinate=number_slider_3, ZCoordinate=0)
pt_6 = ConstructPoint(XCoordinate=Slider(-15, range=-20..20), YCoordinate=number_slider_4, ZCoordinate=0)
yz = YZPlane(Origin=pt_5)
yz_2 = YZPlane(Origin=pt_6)

# ---- group: FORCE VALUES TAG
number_slider_6 = Slider(60, range=0..1000)
X_2 = UnitX(Factor=number_slider_6)
division = Division(A=number_slider_6, B=Slider(7, range=0..10))
move_5 = Move(Motion=X_2)  # -> Geometry, Transform
area = Area(Geometry=srf_3)  # -> Area, Centroid
neg_5 = Negative(Value=division)
vec_3 = VectorXYZ(XComponent=number_slider_6, YComponent=neg_5, ZComponent=0)  # -> Vector, Length
move_6 = Move(Geometry=area.Centroid, Motion=vec_3.Vector)  # -> Geometry, Transform
tag = TextTag(Location=move_6.Geometry, Text="Diamond Panels")

# ----
number_slider_7 = Slider(20, range=0..100)
number_slider_8 = Slider(20, range=0..100)
vec_4 = VectorXYZ(XComponent=number_slider_7, YComponent=number_slider_7, ZComponent=0)  # -> Vector, Length
vec_5 = VectorXYZ(XComponent=number_slider_8, YComponent=number_slider_8, ZComponent=0)  # -> Vector, Length
number_slider_9 = Slider(20, range=0..100)
vec_6 = VectorXYZ(XComponent=number_slider_9, YComponent=number_slider_9, ZComponent=0)  # -> Vector, Length

# ---- group: MESHING
subdivision = Slider(12, range=6..24)
# MESHING
diamond = DiamondPanels(Surface=srf_3, UDivisions=subdivision, VDivisions=subdivision)  # -> DiamondPanels, TriPanels
trib = TrianglePanelsB(Surface=srf_3, UDivisions=subdivision, VDivisions=subdivision)
quads = QuadPanels(Surface=srf_3, UDivisions=subdivision, VDivisions=subdivision)
tric = TrianglePanelsC(Surface=srf_3, UDivisions=subdivision, VDivisions=subdivision)
tria = TriangularPanelsA(Surface=srf_3, UDivisions=subdivision, VDivisions=subdivision)

# ----
panel_2 = Panel(subdivision)
brep = Brep(flatten([diamond.DiamondPanels, diamond.TriPanels]))
python = GhPythonScript(x=brep, y=tria, z=trib, u=tric, v=quads, i=topo_choose)  # -> out, a; inputs x: list, y: list, z: list, u: list, v: list
# ---------- python: Python ----------
if i==0 :
    a = x
if i==1:
    a = y
if i==2:
    a = z
if i==3:
    a = u
if i==4:
    a = v
# ---------- end python ----------

# ---- group: MESHING (continued)
join = BrepJoin(Breps=python.a)  # -> Breps, Closed
debrep = DeconstructBrep(Brep=join.Breps)  # -> Faces, Edges, Vertices
join_2 = BrepJoin(Breps=debrep.Faces)  # -> Breps, Closed
edges = BrepEdges(Brep=join_2.Breps)  # -> Naked, Interior, NonManifold
line = Line([edges.Naked, edges.Interior])

# ---- group: FORCE DENSITY
panel_3 = Panel(multiplication)
lng = ListLength(Edges=line)
neg_6 = Negative(Value=panel_3)
repeat = RepeatData(Data=neg_6, Length=lng)
multiplication_3 = Multiplication(A=repeat, B=Slider(1, range=0..10))

# ---- group: FIXED POINTS
end = EndPoints(Curve=edges.Naked)  # -> Start, End
pt_7 = Point([end.End, end.Start])
duppt = RemoveDuplicatePts(Points=pt_7, Tolerance=0.01)

# ----
lng_2 = ListLength(List=duppt)
division_2 = Division(A=subdivision, B=2)
division_3 = Division(A=subdivision, B=2)
line_2 = Line(line)
line_3 = Line(line)
end_2 = EndPoints(Curve=line_2)  # -> Start, End
end_3 = EndPoints(Curve=line_3)  # -> Start, End
python_2 = GhPythonScript(x=end_2.Start, y=end_2.End)  # -> flatten(array); inputs x: Point3d, y: Point3d
# ---------- python_2: Python ----------
import rhinoscriptsyntax as rs


array  = [ ((x[0],x[1]) , (y[0],y[1])) ]


print(array)
# ---------- end python_2 ----------
fixed_points = Point(duppt)
num = Number(multiplication_3)
fixed_points_2 = Point(duppt)
python_3 = GhPythonScript(x=end_3.Start, y=end_3.End)  # -> flatten(array); inputs x: Point3d, y: Point3d; same code as python_2
python_4 = GhPythonScript(x=fixed_points)  # -> aa; inputs x: list of Point3d
# ---------- python_4: Python ----------
import rhinoscriptsyntax as rs

#CONVERT GUID DATA TO RS POINT3D
a = []
for item in x:
    a.append(rs.coerce3dpoint(item))

# MAKE ARRAYS OF POINTS
aa=[]
for item in a:
    aa.append((item[0],item[1]))
# ---------- end python_4 ----------
num_2 = Number(multiplication_3)
python_5 = GhPythonScript(x=fixed_points_2)  # -> aa; inputs x: list of Point3d; same code as python_4

# ---- group: LOADING
area_2 = Area(Geometry=srf_3)  # -> Area, Centroid
pt_8 = Point(debrep.Vertices)
lng_3 = ListLength(List=pt_8)
num_3 = Number("3.5")
multiplication_4 = Multiplication(A=Slider(5, range=0..10), B=area_2.Area)

# ----
subtraction = Subtraction(A=lng_3, B=lng_2)

# ---- group: LOADING (continued)
division_4 = Division(A=multiplication_4, B=subtraction)

# ---- group: FORCE DENSITY METHOD SOLVER
line_4 = Line(line)
end_4 = EndPoints(Curve=line_4)  # -> Start, End
num_4 = Number(division_4)
python_6 = GhPythonScript(x=end_4.Start, y=end_4.End)  # -> flatten(array); inputs x: Point3d, y: Point3d; same code as python_2
# FORCE DENSITY METHOD
fixed_points_3 = Point(duppt)
num_5 = Number(multiplication_3)
loading = Negative(Value=num_4)
python_7 = GhPythonScript(x=fixed_points_3)  # -> aa; inputs x: list of Point3d; same code as python_4
solver = GhPythonScript(fxpt=flatten(python_7), x=flatten(python_6), q=num_5, load=loading)  # -> Cr, Cf, x_ound, y_ound, z_found, fxpt, CON, fxpt_indx, rpt_indx, u; inputs fxpt: list, x: list, q: list
# ---------- solver: Python ----------
import ghpythonremote
import scriptcontext as sc
from ghpythonlib.treehelpers import list_to_tree
ssa = sc.sticky['scipy.sparse']
sci = sc.sticky['scipy']
np =sc.sticky['numpy']

lines = np.array(x)
lines = np.around(lines,decimals =4)
no_lines = len(lines)  # no_lines means no. of lines 

#get unique sets of points save them in matrix u and get indices in indices
lines = np.reshape(lines,(no_lines*2,2))
u,indices = np.unique(lines,return_inverse = True,axis = 0)
unqpt= np.unique(indices,return_inverse = False)
u_pt_len = len(indices)
#print ("length of u is",len(u))
#print('unique points are',u)

# CREATE CONNNECTIVITY MATRIX.
row = np.repeat(np.arange(no_lines),repeats =2 )
col = indices
data = np.tile([1,-1],no_lines)
cols = len(u)
C = ssa.csc_matrix( (data,(row,col)), shape = (no_lines,cols) ).todense()
CON = C.copy()

#GET FIXED POINT INDEX FROM LIST OF UNIQUE POINTS
fxpt = np.array(fxpt)
fxpt = np.around(fxpt,decimals =4)
fxpt_id = np.lexsort((fxpt[:,1],fxpt[:,0]))
fxpt = fxpt[fxpt_id]
res = (u[:, None] == fxpt).all(-1).any(-1)
fxpt_indx = np.where(res)
rpt_indx = np.where(np.invert(res))


#print('FXPT_INDX' , fxpt_indx)
#print(fxpt)

#create Q and Qf matrix for fixed point and free point - connectivity matrices. 
Qf = C[:,fxpt_indx]
Cf = np.reshape(Qf,(Qf.shape[0],Qf.shape[2]))
Qr = C[:,rpt_indx]
Cr = np.reshape(Qr,(Qr.shape[0],Qr.shape[2]))
#Cr = np.delete(C, fxpt_indx, axis=1)
#print(Cr.shape)

#CREATE DIAGONAL FORCE DENSITY MATRIX
q=np.array(q)
q = np.around(q,decimals =4)
Q=np.diag(q)
#print('Q shape',Q.shape)

#CREATE POINT LOAD VECTORS 
p_x = np.zeros((len(u)-len(fxpt),1))
p_y = np.zeros((len(u)-len(fxpt),1))
p_z = np.full((len(u)-len(fxpt),1),load)
#np.tile(load,len(u)-len(fxpt))
#p_z = np.reshape(p_z,(p_z.shape[0],1))

#CREATE FIXED POINT CO-ORDINATE VECTORS
x_f = fxpt[:,0]
x_f = np.reshape(x_f,(x_f.shape[0],))
y_f = fxpt[:,1]
y_f = np.reshape(y_f,(y_f.shape[0],))
z_f=  np.full((x_f.shape[0],), 0)

print(C.shape)

#CREATE D AND D_F
D = Cr.T.dot(Q).dot(Cr)
D_f = Cr.T.dot(Q).dot(Cf)


#GET THE CO-ORDINATES
#print("OK TILL NOW2")

print(np.linalg.inv(D).dot(p_x))
x_ound = np.linalg.inv(D).dot(p_x - np.reshape(D_f.dot(x_f),(D_f.dot(x_f).shape[1],1)))
y_ound = np.linalg.inv(D).dot(p_y - np.reshape(D_f.dot(y_f),(D_f.dot(y_f).shape[1],1)))
z_found = np.linalg.inv(D).dot(p_z - np.reshape(D_f.dot(z_f),(D_f.dot(z_f).shape[1],1)))



print("ok")
# ---------- end solver ----------
python_8 = GhPythonScript(
    Cr=solver.Cr,
    Cf=solver.Cf,
    x=solver.x_ound,
    y=solver.y_ound,
    z=solver.z_found,
    fxpt=solver.fxpt,
    CON=solver.CON,
    fxpt_indx=solver.fxpt_indx,
    rpt_indx=solver.rpt_indx,
    u=solver.u)  # -> a, sptx, spty, sptz, eptx, epty, eptz
# ---------- python_8: Python ----------
import rhinoscriptsyntax as rs
import ghpythonremote
import scriptcontext as sc
from ghpythonlib.treehelpers import list_to_tree
ssa = sc.sticky['scipy.sparse']
sci = sc.sticky['scipy']
np =sc.sticky['numpy']
                
xx =np.array(x)
x=np.reshape(x,(len(x),1))
y = np.array(y)
y=np.reshape(y,(len(y),1))
z = np.array(z)
z = np.around(z,decimals=4)
z=np.reshape(z,(len(z),1))
        
xedo = np.zeros((len(fxpt),1))
fxpt = np.hstack((fxpt,xedo))
fxpt_id = np.lexsort((fxpt[:,1],fxpt[:,0]))
fxpt = fxpt[fxpt_id]
        
xyz=np.concatenate((x,y,z),axis=1)
#xyz= np.vstack((fxpt,xyz))
        
pt_num = len(fxpt)+len(x)
allpt = np.zeros((pt_num,3))
allpt[fxpt_indx] = fxpt
allpt[rpt_indx]=xyz

print(u)
xedo = np.zeros((len(u),1))
u = np.hstack((u,xedo))
print(fxpt)
print(fxpt_indx)
#print(allpt)
                
                
        
con =CON.copy()
#con = np.concatenate((Cf,Cr),axis =1)
cone =CON.copy()
                
con[con==1] =0
con[con==-1] = 1
spt = np.dot(con,allpt)
                
cone[cone==-1] =0
ept = np.dot(cone,allpt)
                
#PUSH DATA TO GRASSHOPPER TREE
sptx = ghpythonremote.obtain(spt[0:,0].tolist())
sptx =list_to_tree(sptx,source=[0,])
                
spty = ghpythonremote.obtain(spt[0:,1].tolist())
spty =list_to_tree(spty,source=[0,])
                
sptz = ghpythonremote.obtain(spt[0:,2].tolist())
sptz =list_to_tree(sptz,source=[0,])
                
eptx = ghpythonremote.obtain(ept[0:,0].tolist())
eptx =list_to_tree(eptx,source=[0,])
                
epty = ghpythonremote.obtain(ept[0:,1].tolist())
epty =list_to_tree(epty,source=[0,])
                
eptz = ghpythonremote.obtain(ept[0:,2].tolist())
eptz =list_to_tree(eptz,source=[0,])
# ---------- end python_8 ----------
pt_9 = ConstructPoint(XCoordinate=flatten(python_8.sptx), YCoordinate=flatten(python_8.spty), ZCoordinate=flatten(python_8.sptz))
pt_10 = ConstructPoint(XCoordinate=flatten(python_8.eptx), YCoordinate=flatten(python_8.epty), ZCoordinate=flatten(python_8.eptz))
ln = Line(StartPoint=pt_9, EndPoint=pt_10)

# ---- group: TAG AND POINT FOR FINAL STRUCTURE
number_slider_10 = Slider(30, range=0..1000)
X_3 = UnitX(Factor=number_slider_10)
division_5 = Division(A=number_slider_10, B=2)
move_7 = Move(FixPoints=fixed_points_3, Motion=X_3)  # -> Geometry, Transform
area_3 = Area(Geometry=srf_3)  # -> Area, Centroid
neg_7 = Negative(Value=division_5)
panel_4 = Panel("""FINAL GRIDSHELL FORM
Note: Red - Tension
Blue- Compression""")
vec_7 = VectorXYZ(XComponent=number_slider_10, YComponent=neg_7, ZComponent=0)  # -> Vector, Length
move_8 = Move(Geometry=area_3.Centroid, Motion=vec_7.Vector)  # -> Geometry, Transform
tag_2 = TextTag(Location=move_8.Geometry, Text=panel_4)

# ---- group: DISPLAY FINAL STRUCTURE WITH STRESSES
num_6 = Number(flatten(python_8.sptz))
len = Length(Curve=ln)
num_7 = Number(flatten(python_8.eptz))
python_9 = GhPythonScript(x=num_6, y=num_7, z=len)  # -> out, a
# ---------- python_9: Python ----------
print(x , y, z)
if x == 0 and y == 0 :
    a = 0.1 
else:
    a= z
# ---------- end python_9 ----------
multiplication_5 = Multiplication(FD=num_5, B=python_9.a)
abs = Absolute(Value=multiplication_5)
division_6 = Division(A=abs, B=Slider(750, range=0..1000))
pipe = Pipe(Curve=ln, Radius=division_6, Caps=0)
X_4 = UnitX(Factor=number_slider_10)
expression = Expression(
    x=flatten(multiplication_5),
    y=ColourSwatch(SwatchColor=RGB(224, 31, 31)),
    z=ColourSwatch(SwatchColor=RGB(49, 67, 204)),
    Expression="if(x≥0,y,z)")
move_9 = Move(Geometry=pipe, Motion=X_4)  # -> Geometry, Transform
preview = CustomPreview(Geometry=flatten(move_9.Geometry), Material=expression)

# ----
move_10 = Move(Geometry=pt_9, Motion=Y_2)  # -> Geometry, Transform
move_11 = Move(Geometry=pt_9, Motion=Y_3)  # -> Geometry, Transform
duppt_2 = RemoveDuplicatePts(Points=move_10.Geometry, Tolerance=0.01)
duppt_3 = RemoveDuplicatePts(Points=move_11.Geometry, Tolerance=0.01)
sort_pt = SortPoints(Points=duppt_2)  # -> Points, Indices

# ---- group: BASE GEOMETRY
number_slider_11 = Slider(250, range=0..1000)
# ANNOTATIONS
division_7 = Division(A=number_slider_10, B=2)
neg_8 = Negative(Value=division_7)
area_4 = Area(Geometry=srf_3)  # -> Area, Centroid
vec_8 = VectorXYZ(XComponent=pt_3, YComponent=neg_8, ZComponent=0)  # -> Vector, Length
move_12 = Move(Geometry=area_4.Centroid, Motion=vec_8.Vector)  # -> Geometry, Transform
tag_3 = TextTag(Location=move_12.Geometry, Text="BASE GEOMETRY WITH MESH")

# ----
sort_pt_2 = SortPoints(Points=duppt_3)  # -> Points, Indices

# ---- group: SHOW MEMBER CENTERLINE
number_slider_12 = Slider(30, range=0..1000)
X_5 = UnitX(Factor=number_slider_6)
move_13 = Move(Geometry=ln, Motion=X_5)  # -> Geometry, Transform

# ----
lng_4 = ListLength(List=sort_pt.Points)
lng_5 = ListLength(List=sort_pt_2.Points)
division_8 = Division(A=lng_4, B=2)
division_9 = Division(A=lng_5, B=2)
addition = Addition(A=division_8, B=division_2)
subtraction_2 = Subtraction(A=division_9, B=division_3)
addition_2 = Addition(A=division_9, B=division_3)
split = SplitList(List=sort_pt.Points, Index=addition)  # -> ListA, ListB
split_2 = SplitList(List=sort_pt_2.Points, Index=subtraction_2)  # -> ListA, ListB

# ---- group: SHOW FORCES
midpt = CurveMiddle(Curve=move_13.Geometry)
roundd = RoundToDecimalPlace(NumberX=multiplication_5, DecimalPlace=Slider(2, range=0..10), RoundType=0)  # -> Rounded, Difference
tag_4 = TextTag(Location=midpt, Text=roundd.Rounded)

# ----
pt_11 = Point(split.ListA)
pt_12 = Point(split_2.ListB)
project = Project(Geometry=pt_11, Plane=yz)  # -> Geometry, Transform

# ---- group: TOTAL LOAD PATH
multiplication_6 = Multiplication(FORCE=abs, LENGTH=python_9.a)
ma = MassAddition(Input=multiplication_6)  # -> Result, PartialResults
total_load_path = Panel(ma.Result)

# ----
num_8 = Number(simplify(total_load_path))
project_2 = Project(Geometry=pt_12, Plane=yz_2)  # -> Geometry, Transform

bnd = Bounds(Numbers=flatten([python_8.sptz, python_8.eptz]))
dedomain = DeconstructDomain(Domain=bnd)  # -> Start, End
panel_5 = Panel(dedomain.End)

num_9 = Number(graft([topo_choose, subdivision, panel_5]))
weight = Panel([num_9, num_8, panel_3])
rec = DataRecorder(weight, DataLimit=-10, RecordData=True)
num_10 = Number(rec)
panel_6 = Panel(num_10)
hull = ConvexHull(Points=project.Geometry, Plane=yz)  # -> Hull, HullZ, Indices
hull_2 = ConvexHull(Points=project_2.Geometry, Plane=yz_2)  # -> Hull, HullZ, Indices
voronoi = Voronoi(Points=project.Geometry, Plane=yz, BruteForceOverride=False)
num_11 = Number(dedomain.End)
voronoi_2 = Voronoi(Points=project_2.Geometry, Plane=yz_2, BruteForceOverride=False)
move_14 = Move(Geometry=fixed_points_3, Motion=Y_2)  # -> Geometry, Transform
move_15 = Move(Geometry=fixed_points_3, Motion=Y_3)  # -> Geometry, Transform
rint = RegionIntersection(CurvesA=graft(voronoi), CurvesB=hull.Hull, Plane=yz)  # -> flatten(Result)
intersection = SetIntersection(SetA=move_14.Geometry, SetB=pt_11)  # -> flatten(Union)
intersection_2 = SetIntersection(SetA=move_15.Geometry, SetB=pt_12)  # -> flatten(Union)
rint_2 = RegionIntersection(CurvesA=graft(voronoi_2), CurvesB=hull_2.Hull, Plane=yz_2)  # -> flatten(Result)
index = ItemIndex(List=pt_11, Item=intersection)
area_5 = Area(Geometry=voronoi)  # -> Area, Centroid
index_2 = ItemIndex(List=pt_12, Item=intersection_2)
python_10 = GhPythonScript(x=area_5.Area, y=rint)  # -> out, a; inputs x: list, y: list
# ---------- python_10: Python ----------
for i in range(0,len(x)):
    if x[i] > 0 :
        item=1
    else:
        y.insert(i,0)
a=y
# ---------- end python_10 ----------
area_6 = Area(Geometry=rint)  # -> Area, Centroid
panel_7 = Panel(index)
area_7 = Area(Geometry=voronoi_2)  # -> Area, Centroid
area_8 = Area(Geometry=rint_2)  # -> Area, Centroid
panel_8 = Panel(index_2)
python_11 = GhPythonScript(x=total_load_path, y=panel_5, lh=Slider(2, range=0..10), hh=Slider(3, range=0..10))  # -> out, graft(a)
# ---------- python_11: Python ----------
a = x

if y < lh :
    a = x * 5

if y > hh :
    a = x * 5
# ---------- end python_11 ----------
python_12 = GhPythonScript(x=total_load_path, y=panel_5, lh=Slider(1.5, range=0..10))  # -> out, graft(a); disabled
# ---------- python_12: Python ----------
a =y
if y <= lh :
    a = y * 10
# ---------- end python_12 ----------
python_13 = GhPythonScript(x=area_5.Area, y=area_6.Area)  # -> out, a; inputs x: list, y: list; same code as python_10
del = DelaunayMesh(Points=duppt_2, Plane=PlaneXY(0, 0, 0))
python_14 = GhPythonScript(x=area_7.Area, y=area_8.Area)  # -> out, a; inputs x: list, y: list; same code as python_10
del_2 = DelaunayMesh(Points=duppt_3, Plane=PlaneXY(0, 0, 0))
num_12 = Number(python_12.a)
num_13 = Number(python_11.a)
wbedges = WeaverbirdsMeshEdges(MeshOrPolylines=del)
wbedges_2 = WeaverbirdsMeshEdges(MeshOrPolylines=del_2)
panel_9 = Panel(num_12)
panel_10 = Panel(num_13)
end_5 = EndPoints(Curve=wbedges)  # -> Start, End
end_6 = EndPoints(Curve=wbedges_2)  # -> Start, End
multiplication_7 = Multiplication(A=python_13.a, B=Slider(2, range=0..10))
multiplication_8 = Multiplication(A=python_14.a, B=Slider(2, range=0..10))
duppt_4 = RemoveDuplicatePts(Points=[end_5.Start, end_5.End], Tolerance=0.01)
duppt_5 = RemoveDuplicatePts(Points=[end_6.Start, end_6.End], Tolerance=0.01)
cull_i = CullIndex(List=multiplication_7, Indices=panel_7, Wrap=True)
cull_i_2 = CullIndex(List=multiplication_8, Indices=panel_8, Wrap=True)
lng_6 = ListLength(List=duppt_4)
lng_7 = ListLength(List=move_14.Geometry)
lng_8 = ListLength(List=cull_i)
lng_9 = ListLength(List=duppt_5)
lng_10 = ListLength(List=move_15.Geometry)
lng_11 = ListLength(List=cull_i_2)
subtraction_3 = Subtraction(A=lng_6, B=lng_7, C=lng_8)
subtraction_4 = Subtraction(A=lng_9, B=lng_10, C=lng_11)
repeat_2 = RepeatData(Data=Slider(0, range=0..100), Length=subtraction_3)
repeat_3 = RepeatData(Data=Slider(0, range=0..100), Length=subtraction_4)
merge = Merge(Data1=flatten(cull_i), Data2=flatten(repeat_2))
merge_2 = Merge(Data1=flatten(repeat_3), Data2=flatten(cull_i_2))
neg_9 = Negative(Value=merge_2)
num_14 = Number(division_4)
num_15 = Number(division_4)
loading_2 = Negative(Value=num_14)
loading_3 = Negative(Value=num_15)
solver_2 = GhPythonScript(fxpt=flatten(python_4), x=flatten(python_2), q=num, qx=merge, load=loading_2)  # -> Cr, Cf, x_ound, y_ound, z_found, fxpt, CON, fxpt_indx, rpt_indx, u; inputs fxpt: list, x: list, q: list, qx: list
# ---------- solver_2: Python ----------
import ghpythonremote
import scriptcontext as sc
from ghpythonlib.treehelpers import list_to_tree
ssa = sc.sticky['scipy.sparse']
sci = sc.sticky['scipy']
np =sc.sticky['numpy']

lines = np.array(x)
lines = np.around(lines,decimals =4)
no_lines = len(lines)  # no_lines means no. of lines 

#get unique sets of points save them in matrix u and get indices in indices
lines = np.reshape(lines,(no_lines*2,2))
u,indices = np.unique(lines,return_inverse = True,axis = 0)
unqpt= np.unique(indices,return_inverse = False)
u_pt_len = len(indices)
#print ("length of u is",len(u))
#print('unique points are',u)

# CREATE CONNNECTIVITY MATRIX.
row = np.repeat(np.arange(no_lines),repeats =2 )
col = indices
data = np.tile([1,-1],no_lines)
cols = len(u)
C = ssa.csc_matrix( (data,(row,col)), shape = (no_lines,cols) ).todense()
CON = C.copy()

#GET FIXED POINT INDEX FROM LIST OF UNIQUE POINTS
fxpt = np.array(fxpt)
fxpt = np.around(fxpt,decimals =4)
fxpt_id = np.lexsort((fxpt[:,1],fxpt[:,0]))
fxpt = fxpt[fxpt_id]
res = (u[:, None] == fxpt).all(-1).any(-1)
fxpt_indx = np.where(res)
rpt_indx = np.where(np.invert(res))


#print('FXPT_INDX' , fxpt_indx)
#print(fxpt)

#create Q and Qf matrix for fixed point and free point - connectivity matrices. 
Qf = C[:,fxpt_indx]
Cf = np.reshape(Qf,(Qf.shape[0],Qf.shape[2]))
Qr = C[:,rpt_indx]
Cr = np.reshape(Qr,(Qr.shape[0],Qr.shape[2]))
#Cr = np.delete(C, fxpt_indx, axis=1)
#print(Cr.shape)

#CREATE DIAGONAL FORCE DENSITY MATRIX
q=np.array(q)
q = np.around(q,decimals =4)
Q=np.diag(q)
#print('Q shape',Q.shape)

#CREATE POINT LOAD VECTORS 
#p_x = np.zeros((len(u)-len(fxpt),1))
p_x = np.array(qx)
p_x = np.reshape(p_x, (p_x.shape[0],1))
p_y = np.zeros((len(u)-len(fxpt),1))
p_z = np.full((len(u)-len(fxpt),1),load)
#np.tile(load,len(u)-len(fxpt))
#p_z = np.reshape(p_z,(p_z.shape[0],1))

#CREATE FIXED POINT CO-ORDINATE VECTORS
x_f = fxpt[:,0]
x_f = np.reshape(x_f,(x_f.shape[0],))
y_f = fxpt[:,1]
y_f = np.reshape(y_f,(y_f.shape[0],))
z_f=  np.full((x_f.shape[0],), 0)

print(C.shape)

#CREATE D AND D_F
D = Cr.T.dot(Q).dot(Cr)
D_f = Cr.T.dot(Q).dot(Cf)


#GET THE CO-ORDINATES
#print("OK TILL NOW2")

print(np.linalg.inv(D).dot(p_x))
x_ound = np.linalg.inv(D).dot(p_x - np.reshape(D_f.dot(x_f),(D_f.dot(x_f).shape[1],1)))
y_ound = np.linalg.inv(D).dot(p_y - np.reshape(D_f.dot(y_f),(D_f.dot(y_f).shape[1],1)))
z_found = np.linalg.inv(D).dot(p_z - np.reshape(D_f.dot(z_f),(D_f.dot(z_f).shape[1],1)))



print("ok")
# ---------- end solver_2 ----------
solver_3 = GhPythonScript(fxpt=flatten(python_5), x=flatten(python_3), q=num_2, qx=neg_9, load=loading_3)  # -> Cr, Cf, x_ound, y_ound, z_found, fxpt, CON, fxpt_indx, rpt_indx, u; inputs fxpt: list, x: list, q: list, qx: list; same code as solver_2
python_15 = GhPythonScript(
    Cr=solver_2.Cr,
    Cf=solver_2.Cf,
    x=solver_2.x_ound,
    y=solver_2.y_ound,
    z=solver_2.z_found,
    fxpt=solver_2.fxpt,
    CON=solver_2.CON,
    fxpt_indx=solver_2.fxpt_indx,
    rpt_indx=solver_2.rpt_indx,
    u=solver_2.u)  # -> a, sptx, spty, sptz, eptx, epty, eptz; same code as python_8
python_16 = GhPythonScript(
    Cr=solver_3.Cr,
    Cf=solver_3.Cf,
    x=solver_3.x_ound,
    y=solver_3.y_ound,
    z=solver_3.z_found,
    fxpt=solver_3.fxpt,
    CON=solver_3.CON,
    fxpt_indx=solver_3.fxpt_indx,
    rpt_indx=solver_3.rpt_indx,
    u=solver_3.u)  # -> a, sptx, spty, sptz, eptx, epty, eptz; same code as python_8
pt_13 = ConstructPoint(XCoordinate=flatten(python_15.sptx), YCoordinate=flatten(python_15.spty), ZCoordinate=flatten(python_15.sptz))
pt_14 = ConstructPoint(XCoordinate=flatten(python_15.eptx), YCoordinate=flatten(python_15.epty), ZCoordinate=flatten(python_15.eptz))
pt_15 = ConstructPoint(XCoordinate=flatten(python_16.sptx), YCoordinate=flatten(python_16.spty), ZCoordinate=flatten(python_16.sptz))
pt_16 = ConstructPoint(XCoordinate=flatten(python_16.eptx), YCoordinate=flatten(python_16.epty), ZCoordinate=flatten(python_16.eptz))
ln_2 = Line(StartPoint=pt_15, EndPoint=pt_16)
addition_3 = Addition(A=python_16.spty, B=python_15.spty)
addition_4 = Addition(A=python_16.sptx, B=python_15.sptx)
addition_5 = Addition(A=python_16.sptz, B=python_15.sptz)
addition_6 = Addition(A=python_16.epty, B=python_15.epty)
addition_7 = Addition(A=python_16.eptz, B=python_15.eptz)
addition_8 = Addition(A=python_16.eptx, B=python_15.eptx)
ln_3 = Line(StartPoint=pt_13, EndPoint=pt_14)
division_10 = Division(A=addition_4, B=2)
move_16 = Move(Geometry=ln_3, Motion=vec_4.Vector)  # -> Geometry, Transform
division_11 = Division(A=addition_3, B=2)
division_12 = Division(A=addition_5, B=2)
division_13 = Division(A=addition_7, B=2)
division_14 = Division(A=addition_8, B=2)
division_15 = Division(A=addition_6, B=2)
move_17 = Move(Geometry=ln_2, Motion=vec_5.Vector)  # -> Geometry, Transform
pt_17 = ConstructPoint(XCoordinate=division_14, YCoordinate=division_15, ZCoordinate=division_13)
pt_18 = ConstructPoint(XCoordinate=division_10, YCoordinate=division_11, ZCoordinate=division_12)
ln_4 = Line(StartPoint=pt_18, EndPoint=pt_17)
move_18 = Move(Geometry=ln_4, Motion=vec_6.Vector)  # -> Geometry, Transform
len_2 = Length(Curve=flatten(ln_4))
num_16 = Number(flatten(division_12))
num_17 = Number(flatten(division_13))
python_17 = GhPythonScript(x=num_16, y=num_17, z=len_2)  # -> out, a; same code as python_9
multiplication_9 = Multiplication(FD=num_2, B=python_17.a)
abs_2 = Absolute(Value=multiplication_9)
multiplication_10 = Multiplication(FORCE=flatten(abs_2), LENGTH=flatten(python_17.a))  # -> flatten(Result)
ma_2 = MassAddition(Input=multiplication_10)  # -> Result, PartialResults
total_load_path_2 = Panel(ma_2.Result)

# ==== cluster GHPythonRemote: Connects the Grasshopper Python component to an external Python instance.
python = PythonScript()  # -> gh_parent_doc_dir
# ---------- python: Python ----------
from os import path

gh_parent_doc_dir = path.abspath(path.dirname(ghenv.Component.OnPingDocument().Owner.OnPingDocument().FilePath))
# ---------- end python ----------
# GH to python remote example.
# Pierre Cuvilliers, 2017-2018
# Released under the MIT license
# github.com/pilcru/ghpythonremote
# Runs and connects to an external python engine, and
# assigns imported modules to scriptcontext.sticky variables.
# 
# Arguments:
#       code (str): Path to the GH_to_python_sticky.py code file.
#       location (str): Path to a python executable, or to a folder
#             containing `python.exe`, or the name of a conda-created
#             virtual environment prefixed by `conda://` (`conda://env_name`).
#             If empty, finds python from your windows %PATH%.
#       run (boolean): Creates the connection, and imports new
#             modules, when turned to True. Kills the connection,
#             and deletes the references to the imports, when turned
#             to False.
#       modules (str list): List of module names to import in the
#             remote python. They will be added to the
#             scriptcontext.sticky dictionary, allowing them to be
#             reused from other python components in the same
#             Grasshopper document. Submodules (for example
#             `numpy.linalg` have to be added explicitly to this list
#             to be available later.
#       log_level (str from ['NOTSET', 'DEBUG', 'INFO', 'WARNING', 'ERROR', 'CRITICAL']):
#             Logging level to use for the local IronPython and the
#             remote python instance.
#       working_dir (str): Working directory for the remote python
#             instance.
# 
# Returns:
#       out (str): Console output with DEBUG information.
#       linked_modules (str list): list of imported module names.
#       rpy (rpyc connection object): The object representing the
#             remote Python interpreter.
location = ClusterInput()  # location (str): Path to a python executable, or to a folder containing `python.exe`, or the name of a conda-created virtual environment prefixed by `conda://` (`conda://env_name`). If empty, finds python from your windows %PATH%.
run = ClusterInput()  # run (boolean): Creates the connection, and imports new modules, when turned to True. Kills the connection,and deletes the references to the imports, when turned to False.
modules = ClusterInput()  # modules (str list): List of module names to import in the remote python. They will be added to the scriptcontext.sticky dictionary, allowing them to be reused from other python components in the same Grasshopper document. Submodules (for example `numpy.linalg` have to be added explicitly to this list to be available later.
list = ValueList({"CRITICAL", "ERROR", "WARNING", "INFO", "DEBUG", "NOTSET"}, selected="DEBUG")
panel = Panel(python)
ghpythonremote = GHPythonRemote(location=location, run=run, modules=modules, log_level=list, working_dir=panel)  # -> out, linked_modules, rpy; inputs run: Boolean, modules: list
# ---------- ghpythonremote: Python ----------
import inspect
import logging
from os import path
import sys
from time import sleep

import scriptcontext

import ghpythonremote
from ghpythonremote.connectors import GrasshopperToPythonRemote

local_log_level = getattr(logging, log_level, logging.WARNING)
logger = logging.getLogger("ghpythonremote")
logger.setLevel(local_log_level)
ch = logging.StreamHandler()
ch.setLevel(local_log_level)
formatter = logging.Formatter("%(levelname)s: %(name)s:\n%(message)s")
ch.setFormatter(formatter)
logger.handlers = []
logger.addHandler(ch)
logger = logging.getLogger("ghpythonremote.GH_to_python")

ROOT = path.abspath(path.dirname(inspect.getfile(ghpythonremote)))
rpyc_server_py = path.join(ROOT, "pythonservice.py")

# Set connection to CLOSED if this is the first run
# and initialize set of linked modules
try:
    remote_python_status
except NameError:
    remote_python_status = "CLOSED"
    lkd_modules = set()

# Wait for connection to connect or terminate
timer = 0
while remote_python_status == "CONNECTING" or remote_python_status == "CLOSING":
    sleep(1)
    timer += 1
    if timer == 10:
        try:
            gh2py_manager.__exit__(*sys.exc_info())
        except Exception:
            pass
        remote_python_status = "CLOSED"
        lkd_modules = set()
        raise RuntimeError(
            "Connection left in an inconsistent state and not returning. Reset "
            "everything."
        )

if run:
    if not remote_python_status == "OPEN":
        remote_python_status = "CONNECTING"
        gh2py_manager = GrasshopperToPythonRemote(
            rpyc_server_py,
            location=location,
            timeout=10,
            port=None,
            log_level=log_level,
            working_dir=working_dir,
        )
        gh2py = gh2py_manager.__enter__()
        remote_python_status = "OPEN"

    # Stuff that we can reach
    rpymod = gh2py.py_remote_modules  # A getter function for a named python module
    rpy = gh2py.connection  # Represents the remote instance root object
    scriptcontext.sticky["rpy"] = rpy
    # Add modules
    for mod in modules:
        try:
            scriptcontext.sticky[mod] = rpymod(mod)
            lkd_modules.add(mod)
        except ImportError:
            gh2py_manager.__exit__(*sys.exc_info())
            raise

elif not remote_python_status == "CLOSED":
    remote_python_status = "CLOSING"
    # Remove linked modules
    for mod in lkd_modules:
        del scriptcontext.sticky[mod]
    del scriptcontext.sticky["rpy"]
    gh2py_manager.__exit__(*sys.exc_info())
    lkd_modules = set()
    remote_python_status = "CLOSED"

# Change variable name because ghpython resets outputs to None before each run
linked_modules = lkd_modules

logger.info("GH to python connection is {}".format(remote_python_status))
# ---------- end ghpythonremote ----------
out = ClusterOutput(ghpythonremote.out)  # Console output.
linked_modules = ClusterOutput(ghpythonremote.linked_modules)  # Names of modules that were successfully added to the scriptcontext.sticky dictionary.
rpy = ClusterOutput(ghpythonremote.rpy)  # The object representing the remote python instance
python_2 = PythonScript(module_names=ghpythonremote.linked_modules)  # -> import_statements; inputs module_names: list
# ---------- python_2: Python ----------
import_statements = ["import scriptcontext as sc"]
for module_name in module_names:
    import_statements.append("{0} = sc.sticky['{0}']".format(module_name))

if len(module_names) == 0:
    import_statements = []
# ---------- end python_2 ----------
import_statements = ClusterOutput(python_2)  # Useful import statements to use the imported modules in your scripts.
